# Grasshopper definition BroExempel.gh (Grasshopper 0.9.76)
# plug-ins: Karamba, MiStrAn

pt = ConstructPoint(XCoordinate=0, YCoordinate=0, ZCoordinate=0)
ln = Line()
number_slider = Slider(100, range=0..100)
number_slider_2 = Slider(1, range=0..1000)
number_slider_3 = Slider(0.001, range=0..0.001)
srf = Surface(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)
srf_2 = Surface(<surface referenced from the Rhino model>)
number_slider_4 = Slider(100, range=0..500)
number_slider_5 = Slider(0.1, range=0..0.1)
number_slider_6 = Slider(10, range=0..10)
number_slider_7 = Slider(1, range=0..1)
scale = Scale(Geometry=srf, Center=Point(0, 0, 0), Factor=Slider(1, range=0..1))  # -> Geometry, Transform
srf_3 = Surface(scale.Geometry)
bbox = BoundingBox(Content=scale.Geometry, Plane=PlaneXY(0, 0, 0))  # -> Box, Box_2
division = Division(A=number_slider_4, B=4)
boxprop = BoxProperties(Box=bbox.Box)  # -> Center, Diagonal, Area, Volume, Degeneracy
sdivide = DivideSurface(Surface=srf_3, UCount=number_slider_4, VCount=division)  # -> Points, Normals, Parameters
mesh_uv = MeshSurface(Surface=srf_3, UCount=number_slider_4, VCount=division, Overhang=True, Equalize=False)
number_slider_8 = Slider(2000, range=0..2000)
tri = Triangulate(Mesh=mesh_uv)  # -> Mesh, Count
mesh = Mesh(tri.Mesh)
face_area = FaceArea(mesh=tri.Mesh)  # -> num_2, S
medges = MeshEdges(Mesh=mesh)  # -> NakedEdges, InteriorEdges, NonManifoldEdges
demesh = DeconstructMesh(Mesh=mesh)  # -> Vertices, Faces, Colours, Normals
tstat = TreeStatistics(Tree=sdivide.Points)  # -> Paths, Length, Count
offset = Offset(Surface=face_area.S, Distance=0.1, Retrim=True)
lng = ListLength(List=tstat.Length)
division_2 = Division(A=lng, B=2)
medges_2 = MeshEdges(Mesh=tri.Mesh)  # -> NakedEdges, InteriorEdges, NonManifoldEdges
X = UnitX(Factor=number_slider_8)
item = ListItem(List=tstat.Paths, Index=0, Wrap=True)  # -> Item1, Item
Z = UnitZ(Factor=number_slider_8)
item_2 = ListItem(List=tstat.Paths, Index=division_2, Wrap=True)
meshtoshell = MeshToShellKaramba(Point=demesh.Vertices, Mesh=mesh, LDist=0.005)  # -> Point, Element, Info
number_slider_9 = Slider(10000, range=0..10000)
branch = TreeBranch(Tree=sdivide.Points, Path=item_2, MaintainPaths=True)
branch_2 = TreeBranch(Tree=sdivide.Points, Path=item.Item1, MaintainPaths=True)
branch_3 = TreeBranch(Tree=sdivide.Points, Path=item.Item, MaintainPaths=True)
bc_points = Point(flatten([branch_2, branch_3]))
cp = ClosestPoint(Point=bc_points, Cloud=demesh.Vertices)  # -> ClosestPoint, CPIndex, Distance
supp = SupportKaramba(PosInd=cp.CPIndex, menu=[buttons(on, on, on, on, on, on)])
number_slider_10 = Slider(10, range=0..10)
lng_2 = ListLength(List=branch)
division_3 = Division(A=lng_2, B=3)
number_slider_11 = Slider(9, range=0..10)
index = ItemIndex(List=meshtoshell.Point, Item=meshtoshell.Point)
matprops = MaterialPropertiesKaramba(
    ElementsIdentifiers=index,
    YoungsModulus_kN_cm2=21000,
    ShearModulus_kN_cm2=8076,
    SpecificWeight_kN_m3=Slider(0, range=0..100),
    CoefficientOfThermalExpansion_1_C=1e-05,
    YieldStrength_kN_cm2=Slider(500, range=0..1000),
    Name="S235")
shift = ShiftList(List=branch, Shift=division_3, Wrap=False)
neg = Negative(Value=division_3)
shift_2 = ShiftList(List=shift, Shift=neg, Wrap=False)
load_pts = Point(flatten(shift_2))
cp_2 = ClosestPoint(Point=load_pts, Cloud=demesh.Vertices)  # -> ClosestPoint, CPIndex, Distance
lng_3 = ListLength(List=shift_2)
division_4 = Division(A=Slider(1000, range=0..1000000), B=lng_3)
dup = DuplicateData(Data=division_4, Number=lng_3, Order=True)
cross_sections = CrossSectionsKaramba(Heights_cm=Slider(1, range=0..1), mode="Shell")
vec = VectorXYZ(XComponent=0, YComponent=0, ZComponent=0)  # -> Vector, Length
triangle = MeshTriangle(CornerA=0, CornerB=1, CornerC=2)
neg_2 = Negative(Value=dup)
Z_2 = UnitZ(Factor=neg_2)
force_vecs = Vector(Z_2)
division_5 = Division(A=force_vecs, B=1000)
loads = LoadsKaramba(ForceVector=division_5, Local=True, PosInd=cp_2.CPIndex, LCase=0, mode="Point")
assemble = AssembleModelKaramba(
    Point=meshtoshell.Point,
    Elem=meshtoshell.Element,
    Support=supp,
    Load=loads,
    CrossSection=cross_sections,
    Material=matprops,
    LimitDistance_m=0.005)  # -> Model, Info, Mass_kg, CenterOfGravity
analyzethi = AnalyzeThIKaramba(Model=assemble.Model)  # -> CalculatedModel, MaximumDisplacement_m, ResultingForceOfGravity_kN, ElasticEnergy_kNm
karamba = Panel(analyzethi.MaximumDisplacement_m)
nodedisp = NodalDisplacementsKaramba(AnalyzedModel=analyzethi.CalculatedModel)  # -> AnalyzedModel, NodalTranslations_m, NodalRotations_rad
mistran = MiStrAn(
    Run=Toggle(False),
    Mesh=tri.Mesh,
    BC=flatten([branch_2, branch_3]),
    LoadPoints=shift_2,
    LoadVectors=Z_2,
    DistLoadVFaces=triangle,
    DistLoadVecs=vec.Vector,
    Thickness=Slider(0.01, range=0..0.01))  # -> Displacements, Rotations, Reactions, DeformedMesh, PrincipalStresses
modelview = ModelViewKaramba(Model=nodedisp.AnalyzedModel, LoadCaseFactorsForLinearSuperposition=1, IndexIncrementOfVisibleLoadcase=0)  # -> Model, DeformedMesh, DeformedAxes, DeformedModel
multiplication = Multiplication(A=nodedisp.NodalTranslations_m, B=1000)
demesh_2 = DeconstructMesh(Mesh=mesh)  # -> Vertices, Faces, Colours, Normals
devec = DeconstructVector(Vector=mistran.Displacements)  # -> XComponent, YComponent, ZComponent
devec_2 = DeconstructVector(Vector=nodedisp.NodalTranslations_m)  # -> XComponent, YComponent, ZComponent
vlen = VectorLength(Vector=mistran.Displacements)
move = Move(Geometry=demesh_2.Vertices, Motion=multiplication)  # -> Geometry, Transform
division_6 = Division(A=devec.ZComponent, B=devec_2.ZComponent)
conmesh = ConstructMesh(Vertices=move.Geometry, Faces=demesh_2.Faces)
sort = SortList(Keys=vlen)  # -> Keys, ValuesA
subtraction = Subtraction(A=division_6, B=1)
item_3 = ListItem(List=sort.Keys, Index=0, Wrap=True)  # -> Item1, Item
mistran_2 = Panel(item_3.Item1)
division_7 = Division(A=karamba, B=mistran_2)  # -> flatten(Result)
panel = Panel(division_7)
panel_2 = Panel(division_6)
number_slider_12 = Slider(100, range=0..100)
demesh_3 = DeconstructMesh(Mesh=tri.Mesh)  # -> Vertices, Faces, Colours, Normals
vlen_2 = VectorLength(Vector=mistran.PrincipalStresses)
multiplication_2 = Multiplication(A=mistran.Displacements, B=Slider(1000, range=0..1000))
sort_2 = SortList(Keys=vlen_2)  # -> Keys, ValuesA
item_4 = ListItem(List=sort_2.Keys, Index=0, Wrap=True)  # -> Item1, Item
move_2 = Move(Geometry=demesh_3.Vertices, Motion=multiplication_2)  # -> Geometry, Transform
gradient = Gradient(
    LowerLimit=item_4.Item,
    UpperLimit=item_4.Item1,
    Parameter=vlen_2,
    stops=[0: RGB(39, 72, 161), 0.269: RGB(1, 192, 229), 0.435: RGB(18, 178, 90), 0.536: RGB(79, 186, 8), 0.733: RGB(220, 237, 32), 0.851: RGB(247, 159, 20), 1: RGB(243, 57, 0)])
conmesh_2 = ConstructMesh(Vertices=move_2.Geometry, Faces=demesh_3.Faces, Colours=gradient)
mesh_2 = Mesh(conmesh_2)
meshperface = CSharpScript(M=mesh_2)  # -> out, A; inputs M: Mesh
# ---------- meshperface: C# ----------
    List<Mesh> meshesOut = new List<Mesh>();
    foreach(MeshFace mf in M.Faces){
      Mesh meshToAdd = new Mesh();
      meshToAdd.Vertices.Add(M.Vertices[mf.A]);
      meshToAdd.Vertices.Add(M.Vertices[mf.B]);
      meshToAdd.Vertices.Add(M.Vertices[mf.C]);
      if(mf.IsQuad){
        meshToAdd.Vertices.Add(M.Vertices[mf.D]);
        meshToAdd.Faces.AddFace(new MeshFace(0, 1, 2, 3));
      } else {
        meshToAdd.Faces.AddFace(new MeshFace(0, 1, 2));
      }
      meshesOut.Add(meshToAdd);
    }
    A = meshesOut;
# ---------- end meshperface ----------
preview = CustomPreview(Geometry=meshperface.A, Shader=gradient)
medges_3 = MeshEdges(Mesh=conmesh_2)  # -> NakedEdges, InteriorEdges, NonManifoldEdges
merge = Merge(Data1=medges_3.NakedEdges, Data2=medges_3.InteriorEdges, Data3=medges_3.NonManifoldEdges)

# ==== cluster FaceArea
mesh = ClusterInput()
mesh_2 = Mesh(mesh)
demesh = DeconstructMesh(Mesh=mesh_2)  # -> Vertices, Faces, Colours, Normals
deface = DeconstructFace(Face=demesh.Faces)  # -> CornerA, CornerB, CornerC, CornerD
item = ListItem(List=demesh.Vertices, Index=deface.CornerB, Wrap=True)
item_2 = ListItem(List=demesh.Vertices, Index=deface.CornerA, Wrap=True)
item_3 = ListItem(List=demesh.Vertices, Index=deface.CornerC, Wrap=True)
srf4pt = _4PointSurface(CornerA=item_2, CornerB=item, CornerC=item_3)
area = Area(Geometry=srf4pt)  # -> Area, Centroid
S = ClusterOutput(srf4pt)
num = Number(area.Area)
num_2 = ClusterOutput(num)
