# Grasshopper definition FredrikStad.gh (Grasshopper 0.9.76)
# plug-ins: Karamba, MiStrAnGH

series = Series(Start=0, Step=0.1, Count=10)
series_2 = Series(Start=0, Step=0.1, Count=10)
number_slider = Slider(0, range=0..1)
series_3 = Series(Start=0.01, Step=0.012, Count=10)
graph = GraphMapper(series, x0=0, x1=1, y0=0, y1=1, container_name="Conic", Cx=0.7761623263, Cy=0.3239305019)
number_slider_2 = Slider(1.6, range=0..3)
graph_2 = GraphMapper(
    series_2,
    x0=0,
    x1=1,
    y0=0,
    y1=1,
    container_name="Bezier",
    cpx=[0, 0.25, 0.4478259981, 1],
    cpy=[0, 0.25, 0.5402898788, 0.5623186827])
series_4 = Series(Start=0, Step=2.8, Count=10)
multiplication = Multiplication(A=graph, B=Slider(2.38, range=0..10))
addition = Addition(A=Slider(0.3, range=0..1), B=multiplication)
sectioncurve = SectionCurve(depth=reverse(addition), sharpness=series_3)
panel = Panel(graph)
Z = UnitZ(Factor=graph_2)
multiplication_2 = Multiplication(A=Slider(1.6, range=0..10), B=Z)
long_stiffener_pos = Panel("""-0.75
0.75""")
trans_stiffener_pos = Panel("""2
4
6
8
10
12
16
20
24""")
X = UnitX(Factor=series_4)
crv = Curve(flatten(sectioncurve))
addition_2 = Addition(A=multiplication_2, B=X)
pt = ConstructPoint(XCoordinate=0, YCoordinate=long_stiffener_pos, ZCoordinate=0)
pt_2 = ConstructPoint(XCoordinate=trans_stiffener_pos, YCoordinate=0, ZCoordinate=0)
yz = YZPlane(Origin=addition_2)
xz = XZPlane(Origin=pt)
yz_2 = YZPlane(Origin=pt_2)
orient = Orient(Geometry=crv, Source=PlaneXY(0, 0, 0), Target=yz)  # -> Geometry, Transform
loft = Loft(Curves=orient.Geometry, Options={Adjust=False, Closed=False, LoftEnds=0, LoftSimp=0, LoftType=0, Rebuild=10, Refit=0.01})
pt_3 = ConstructPoint(XCoordinate=8, YCoordinate=0, ZCoordinate=0)
xz_2 = XZPlane(Origin=Point(0, 0, 0))
Z_2 = UnitZ(Factor=Slider(0.55, range=0..1))
merge = Merge(Data1=yz_2, Data2=xz)
cap = CapHoles(Brep=loft)
circle = CircleCNR(Center=pt_3, Normal=Vector(0, 0, 1), Radius=Slider(0.15, range=0..1))
neg = Negative(Value=Z_2)
rectangle = Rectangle(Plane=[merge, xz_2], XSize=Domain(-100, 100), YSize=Domain(-100, 100), Radius=0)  # -> Rectangle, Length
extr = Extrude(Base=circle, Direction=neg)
sec = BrepPlane(Brep=cap, Plane=merge)  # -> flatten(Curves), Points
split_multiple = CSharpScript(B=cap, C=flatten([rectangle.Rectangle, extr]), tol=Slider(0.001, range=0..0.001))  # -> R; inputs B: Brep, C: list of Brep, tol: Double
# ---------- split_multiple: C# ----------
    List<Brep> pool = new List<Brep>();


    Brep[] firstResult = B.Split(C[0], tol);
    pool.AddRange(firstResult);
    
    Brep joinedBreps = Brep.JoinBreps(firstResult, tol)[0];

    for (int i = 1; i < C.Count; i++)
    {

        Brep[] result = joinedBreps.Split(C[i], tol);
        if(result.Length > 1)
        joinedBreps = Brep.JoinBreps(result, tol)[0];

    }

    R = joinedBreps;
# ---------- end split_multiple ----------
boundary = BoundarySurfaces(Edges=sec.Curves)
brep = Brep(split_multiple)
merge_2 = Merge(Data1=brep, Data2=boundary)  # -> flatten(Result)
mesh_breps = MeshBreps(
    Brep=merge_2,
    MeshResolution=Slider(0.2, range=0..1),
    EdgeRefinementFactor=0.67,
    PointReduction=False,
    SmoothingStepSize=1,
    SmoothingIterations=5)  # -> Mesh, Info
mjoin = MeshJoin(Meshes=mesh_breps.Mesh)
cullmesh = CleanMesh(Mesh=mjoin, Tolerance=Slider(0.001, range=0..0.001))  # -> CulledMesh, CulledFaces
demesh = DeconstructMesh(Mesh=cullmesh.CulledMesh)  # -> Vertices, Faces, Colours, Normals
lng = ListLength(List=demesh.Vertices)
pdecon = Deconstruct(Point=demesh.Vertices)  # -> XComponent, YComponent, ZComponent
series_5 = Series(Start=0, Step=1, Count=lng)
equals = Equality(FirstNumber=pdecon.XComponent, SecondNumber=0)  # -> Equality, Inequality
cull = CullPattern(List=series_5, CullPattern=equals.Equality)
cull_2 = CullPattern(List=demesh.Vertices, CullPattern=equals.Equality)
support = CreateSupport(
    NodeID=cull,
    SupportInXDirection=True,
    SupportInYDirection=True,
    SupportInZDirection=True,
    SupportInXXDirection=True,
    SupportInYYDirection=True,
    SupportInZZDirection=True)
section = Section(
    EModulusInLongitudinalDirection_GPa=210,
    EModulusInTransverseDirection_GPA=210,
    LongitudinalShearModulus_GPA=79.3,
    PoissonsRatio=0.3,
    LaminaThickness_mm=10,
    Angles_degree=0,
    Density_kg_m_3=7800)
gravity = MiStrAnGravityLoad()
assemble = MiStrAnAssembleStructure(Mesh=cullmesh.CulledMesh, MiStrAnSupports=support, MiStrAnLoads=gravity, GeneratedSection=section)
eigenfreq = Eigenfrequencies(Structure=assemble, RangeToSearchWithin=200, NumberOfEigenfrequencies=1)  # -> LowestEigenfrequency, Structure, Residuals, AnalysisInfo
eigenmodes = EigenModes(Structure=eigenfreq.Structure, ScaleFactor=Slider(-100, range=-100..100))
analyse = MiStrAnAnalyseStructure(Run=Toggle(True), MiStrAnStructure=assemble)  # -> AnalysedStructure, Displacements, Rotations, Reactions, PrincipalStresses, PrincipalStressAngles, VonMisesStresses
visres = VisualiseResults(
    Structure=analyse.AnalysedStructure,
    ScaleDeformation=100,
    BottomLimiter=0,
    TopLimiter=1,
    StressMeshType=Slider(1, range=0..1))  # -> DeformedMesh, VonMisesStressPlot
drawprincarrows = DrawPrincipalstressArrows(Structure=analyse.AnalysedStructure)
mesh = Mesh(visres.VonMisesStressPlot)

# ==== cluster SectionCurve
panel = Panel("-1")
sharpness = ClusterInput()
sharpness_2 = Number(sharpness)
depth = ClusterInput()
depth_2 = Number(depth)
subtraction = Subtraction(A=1, B=sharpness_2)
lng = ListLength(List=depth_2)
neg = Negative(Value=depth_2)
multiplication = Multiplication(A=neg, B=subtraction)
pt = ConstructPoint(XCoordinate="-1.5", YCoordinate=0, ZCoordinate=0)
pt_2 = ConstructPoint(XCoordinate="-0.2", YCoordinate=multiplication, ZCoordinate=0)
pt_3 = ConstructPoint(XCoordinate="-1.45", YCoordinate="0.1", ZCoordinate=0)
pt_4 = ConstructPoint(XCoordinate=0, YCoordinate=neg, ZCoordinate=0)
dup = DuplicateData(Data=pt, Number=lng, Order=True)
dup_2 = DuplicateData(Data=pt_3, Number=lng, Order=True)
yz = YZPlane(Origin=Point(0, 0, 0))
mirror = Mirror(Geometry=pt_2, Plane=yz)  # -> Geometry, Transform
mirror_2 = Mirror(Geometry=dup, Plane=yz)  # -> Geometry, Transform
mirror_3 = Mirror(Geometry=dup_2, Plane=yz)  # -> Geometry, Transform
ln = Line(StartPoint=dup_2, EndPoint=mirror_3.Geometry)
ln_2 = Line(StartPoint=dup_2, EndPoint=dup)
ln_3 = Line(StartPoint=mirror_3.Geometry, EndPoint=mirror_2.Geometry)
entwine = Entwine(Branch00=dup, Branch01=pt_2, Branch02=pt_4, Branch03=mirror.Geometry, Branch04=mirror_2.Geometry, FlattenInputs=True)
flip = FlipMatrix(Data=entwine)
intcrv = Interpolate(Vertices=flip, Degree=3, Periodic=False, KnotStyle=1)  # -> Curve, Length, Domain
merge = Merge(Data1=simplify(graft(ln)), Data2=simplify(graft(ln_2)), Data3=simplify(graft(ln_3)), Data4=simplify(intcrv.Curve))
join = JoinCurves(Curves=merge, Preserve=False)  # -> flatten(Curves)
crv = Curve(join)
crv_2 = ClusterOutput(crv)
