# Grasshopper definition FredrikStad_GeometryInvestigation.gh (Grasshopper 0.9.76)
# plug-ins: Karamba, MiStrAnGH

a = Slider(1, range=0..1)
series = Series(Start=0, Step=0.1111111111, Count=10)
number_slider = Slider(0.5, range=0..1)
series_2 = Series(Start=0, Step=0.1, Count=10)
series_3 = Series(Start=0, Step=0.1, Count=10)
number_slider_2 = Slider(0, range=0..1)
series_4 = Series(Start=0.01, Step=0.012, Count=10)
graph = GraphMapper(series_2, x0=0, x1=1, y0=0, y1=1, container_name="Conic", Cx=0.7761623263, Cy=0.3239305019)
number_slider_3 = Slider(1.6, range=0..3)
graph_2 = GraphMapper(
    series_3,
    x0=0,
    x1=1,
    y0=0,
    y1=1,
    container_name="Bezier",
    cpx=[0, 0.25, 0.4478259981, 1],
    cpy=[0, 0.25, 0.5402898788, 0.5623186827])
neg = Negative(Value=number_slider)
c_script = CSharpScript(x=series, a=Slider(0.5, range=0..1), b="-1", c=number_slider)  # -> y; inputs x: Double, a: Double, b: Double, c: Double
# ---------- c_script: C# ----------
    y = a * Math.Pow(x,2) + b * x + c;
# ---------- end c_script ----------
number_slider_4 = Slider(3.43, range=0..10)
series_5 = Series(Start=0, Step=3.1111, Count=10)
number_slider_5 = Slider(0.73, range=0..1)
multiplication = Multiplication(A=graph, B=Slider(3.54, range=0..10))
addition = Addition(A=Slider(0.59, range=0..1), B=multiplication)
Z = UnitZ(Factor=graph_2)
sectioncurve = SectionCurve(depth=reverse(addition), sharpness=series_4)
multiplication_2 = Multiplication(A=c_script, B=number_slider_4)  # -> reverse(Result)
addition_2 = Addition(A=number_slider_5, B=multiplication_2)
multiplication_3 = Multiplication(A=Slider(1.6, range=0..10), B=Z)
item = ListItem(List=addition_2, Index=0, Wrap=True)  # -> Item1, Item
long_stiffener_pos = Panel("""-0.75
0.75""")
trans_stiffener_pos = Panel("""2
4
6
8
10
12
16
20
24""")
X = UnitX(Factor=series_5)
galapagos = Galapagos(fitness=addition_5, gene=[number_slider_5, number_slider_4])
addition_3 = Addition(A=multiplication_3, B=X)
larger = LargerThan(FirstNumber=item.Item1, SecondNumber=3)  # -> LargerThan, OrEqualTo
crv = Curve(flatten(sectioncurve))
panel = Panel(addition_2)
pt = ConstructPoint(XCoordinate=0, YCoordinate=long_stiffener_pos, ZCoordinate=0)
pt_2 = ConstructPoint(XCoordinate=trans_stiffener_pos, YCoordinate=0, ZCoordinate=0)
yz = YZPlane(Origin=addition_3)
xz = XZPlane(Origin=pt)
yz_2 = YZPlane(Origin=pt_2)
orient = Orient(Geometry=crv, Source=PlaneXY(0, 0, 0), Target=yz)  # -> Geometry, Transform
loft = Loft(Curves=orient.Geometry, Options={Adjust=False, Closed=False, LoftEnds=0, LoftSimp=0, LoftType=0, Rebuild=10, Refit=0.01})
xz_2 = XZPlane(Origin=Point(0, 0, 0))
merge = Merge(Data1=yz_2, Data2=xz)
memorizer = CSharpScript(x=number_slider_5, reset=Button())  # -> out, A; inputs reset: Boolean
# ---------- memorizer: C# ----------
    values.Add(x);
    if(reset)
      values.Clear();

    A = values;
# ---------- memorizer: C# additional code ----------
  List<object> values = new List<object>();
# ---------- end memorizer ----------
memorizer_2 = CSharpScript(x=number_slider_4, reset=Button())  # -> out, A; inputs reset: Boolean; same code as memorizer
cap = CapHoles(Brep=loft)
rectangle = Rectangle(Plane=[merge, xz_2], XSize=Domain(-100, 100), YSize=Domain(-100, 100), Radius=0)  # -> Rectangle, Length
panel_2 = Panel(memorizer.A)
panel_3 = Panel(memorizer_2.A)
merge_2 = Merge(Data1=rectangle.Rectangle)
sec = BrepPlane(Brep=cap, Plane=merge)  # -> flatten(Curves), Points
split_multiple = CSharpScript(B=cap, C=flatten(merge_2), tol=Slider(0.001, range=0..0.001))  # -> R; inputs B: Brep, C: list of Brep, tol: Double
# ---------- split_multiple: C# ----------
    List<Brep> pool = new List<Brep>();


    Brep[] firstResult = B.Split(C[0], tol);
    pool.AddRange(firstResult);
    
    Brep joinedBreps = Brep.JoinBreps(firstResult, tol)[0];

    for (int i = 1; i < C.Count; i++)
    {

        Brep[] result = joinedBreps.Split(C[i], tol);
        if(result.Length > 1)
        joinedBreps = Brep.JoinBreps(result, tol)[0];

    }

    R = joinedBreps;
# ---------- end split_multiple ----------
boundary = BoundarySurfaces(Edges=sec.Curves)
brep = Brep(split_multiple)
merge_3 = Merge(Data1=brep, Data2=boundary)  # -> flatten(Result)
mesh = Mesh(merge_3)
mesh_breps = MeshBreps(
    Brep=merge_3,
    MeshResolution=Slider(0.1, range=0..2),
    EdgeRefinementFactor=0.67,
    PointReduction=False,
    SmoothingStepSize=1,
    SmoothingIterations=5)  # -> Mesh, Info
mjoin = MeshJoin(Meshes=mesh_breps.Mesh)
cullmesh = CleanMesh(Mesh=mjoin, Tolerance=Slider(0.001, range=0..0.001))  # -> CulledMesh, CulledFaces
demesh = DeconstructMesh(Mesh=cullmesh.CulledMesh)  # -> Vertices, Faces, Colours, Normals
mesh_face_area = CSharpScript(M=mesh)  # -> flatten(A); inputs M: Mesh
# ---------- mesh_face_area: C# ----------
    List<double> Area = new List<double>();

    for (int i = 0; i < M.Faces.Count; i++)
    {
      int faceIndex = i;

      Point3d a = M.Vertices[M.Faces[faceIndex].A];
      Point3d b = M.Vertices[M.Faces[faceIndex].B];
      Point3d c = M.Vertices[M.Faces[faceIndex].C];

      Vector3d vecA = new Vector3d(b - a);
      Vector3d vecB = new Vector3d(c - a);

      double area = Vector3d.CrossProduct(vecA, vecB).Length / 2;
      Area.Add(area);
    }

    A = Area;
# ---------- end mesh_face_area ----------
lng = ListLength(List=demesh.Vertices)
pdecon = Deconstruct(Point=demesh.Vertices)  # -> XComponent, YComponent, ZComponent
series_6 = Series(Start=0, Step=1, Count=lng)
ma = MassAddition(Input=mesh_face_area)  # -> Result, PartialResults
equals = Equality(FirstNumber=pdecon.XComponent, SecondNumber=0)  # -> Equality, Inequality
basebrep = Brep(cap)
cull = CullPattern(List=series_6, CullPattern=equals.Equality)
cull_2 = CullPattern(List=demesh.Vertices, CullPattern=equals.Equality)
larger_2 = LargerThan(FirstNumber=ma.Result, SecondNumber=245)  # -> LargerThan, OrEqualTo
debrep = DeconstructBrep(Brep=basebrep)  # -> Faces, Edges, Vertices
item_2 = ListItem(List=debrep.Faces, Index=3, Wrap=True)
int = Integer(larger_2.LargerThan)
support = CreateSupport(
    NodeID=cull,
    SupportInXDirection=True,
    SupportInYDirection=True,
    SupportInZDirection=True,
    SupportInXXDirection=True,
    SupportInYYDirection=True,
    SupportInZZDirection=True)
panel_4 = Panel("false")
merge_4 = Merge(Data1=support)  # -> flatten(Result)
inclusion_mesh = InclusionMesh(srf=item_2)
total_area = Panel(ma.Result)
mesh_2 = Mesh(cullmesh.CulledMesh)
facen = FaceNormals(Mesh=mesh_2)  # -> Centers, Normals
lng_2 = ListLength(List=facen.Centers)
gravity = MiStrAnGravityLoad()
series_7 = Series(Start=0, Step=1, Count=lng_2)
minc = MeshInclusion(Mesh=inclusion_mesh, Point=facen.Centers, Strict=False)
section = Section(
    EModulusInLongitudinalDirection_GPa=210,
    EModulusInTransverseDirection_GPA=210,
    LongitudinalShearModulus_GPA=79.3,
    PoissonsRatio=0.3,
    LaminaThickness_mm=10,
    Angles_degree=0,
    Density_kg_m_3=7800)
cull_3 = CullPattern(List=series_7, CullPattern=minc)
Z_2 = UnitZ(Factor=Slider(2, range=0..10))
neg_2 = Negative(Value=Z_2)
distload = MiStrAnDistributedLoad(ElementId=cull_3, ForceVector_kN=neg_2)
merge_5 = Merge(Data1=distload, Data2=gravity)  # -> flatten(Result)
assemble = MiStrAnAssembleStructure(Mesh=cullmesh.CulledMesh, MiStrAnSupports=merge_4, MiStrAnLoads=merge_5, GeneratedSection=section)  # -> AssembledStructure, DuplicateSections
number_slider_6 = Slider(1000, range=0..1000)
number_slider_7 = Slider(200, range=0..1000)
eigenfreq = Eigenfrequencies(
    Structure=assemble.AssembledStructure,
    RangeToSearchWithin=Slider(10000, range=0..10000),
    NumberOfEigenfrequencies=Slider(10, range=0..10))  # -> LowestEigenfrequency, Structure, Residuals, AnalysisInfo
analyse = MiStrAnAnalyseStructure(Run=Toggle(True), MiStrAnStructure=assemble.AssembledStructure)  # -> AnalysedStructure, Displacements, Rotations, Reactions, PrincipalStresses, PrincipalStressAngles, VonMisesStresses
series_8 = Series(Start=0, Step=1, Count=74701)
number_slider_8 = Slider(10, range=0..10)
sort = SortList(Keys=analyse.VonMisesStresses, ValuesA=series_8)  # -> Keys, reverse(ValuesA)
vlen = VectorLength(Vector=analyse.Displacements)
sort_2 = SortList(Keys=vlen)  # -> Keys, ValuesA
visres = VisualiseResults(
    Structure=analyse.AnalysedStructure,
    ScaleDeformation=Slider(1, range=1..100),
    BottomLimiter=0,
    TopLimiter=Slider(1, range=0..1),
    StressMeshType=Slider(1, range=0..1))  # -> DeformedMesh, VonMisesStressPlot
drawprincarrows = DrawPrincipalstressArrows(Structure=analyse.AnalysedStructure)
item_3 = ListItem(List=sort_2.Keys, Index=0, Wrap=True)  # -> Item1, Item
addition_4 = Addition(A=int, B=item_3.Item1)
mesh_3 = Mesh(visres.VonMisesStressPlot)
int_2 = Integer(larger.LargerThan)
addition_5 = Addition(A=int_2, B=addition_4)
memorizer_3 = CSharpScript(x=addition_5, reset=Button())  # -> out, A; inputs reset: Boolean; same code as memorizer
panel_5 = Panel(memorizer_3.A)
results = Panel(addition_5)
division = Division(A=56, B=400)
panel_6 = Panel(division)

# ==== cluster SectionCurve
panel = Panel("-1")
sharpness = ClusterInput()
sharpness_2 = Number(sharpness)
depth = ClusterInput()
depth_2 = Number(depth)
subtraction = Subtraction(A=1, B=sharpness_2)
lng = ListLength(List=depth_2)
neg = Negative(Value=depth_2)
multiplication = Multiplication(A=neg, B=subtraction)
pt = ConstructPoint(XCoordinate="-1.5", YCoordinate=0, ZCoordinate=0)
pt_2 = ConstructPoint(XCoordinate="-0.2", YCoordinate=multiplication, ZCoordinate=0)
pt_3 = ConstructPoint(XCoordinate="-1.45", YCoordinate="0.1", ZCoordinate=0)
pt_4 = ConstructPoint(XCoordinate=0, YCoordinate=neg, ZCoordinate=0)
dup = DuplicateData(Data=pt, Number=lng, Order=True)
dup_2 = DuplicateData(Data=pt_3, Number=lng, Order=True)
yz = YZPlane(Origin=Point(0, 0, 0))
mirror = Mirror(Geometry=pt_2, Plane=yz)  # -> Geometry, Transform
mirror_2 = Mirror(Geometry=dup, Plane=yz)  # -> Geometry, Transform
mirror_3 = Mirror(Geometry=dup_2, Plane=yz)  # -> Geometry, Transform
ln = Line(StartPoint=dup_2, EndPoint=mirror_3.Geometry)
ln_2 = Line(StartPoint=dup_2, EndPoint=dup)
ln_3 = Line(StartPoint=mirror_3.Geometry, EndPoint=mirror_2.Geometry)
entwine = Entwine(Branch00=dup, Branch01=pt_2, Branch02=pt_4, Branch03=mirror.Geometry, Branch04=mirror_2.Geometry, FlattenInputs=True)
flip = FlipMatrix(Data=entwine)
intcrv = Interpolate(Vertices=flip, Degree=3, Periodic=False, KnotStyle=1)  # -> Curve, Length, Domain
merge = Merge(Data1=simplify(graft(ln)), Data2=simplify(graft(ln_2)), Data3=simplify(graft(ln_3)), Data4=simplify(intcrv.Curve))
join = JoinCurves(Curves=merge, Preserve=False)  # -> flatten(Curves)
crv = Curve(join)
crv_2 = ClusterOutput(crv)

# ==== cluster InclusionMesh
srf = ClusterInput()
srf_2 = Surface(srf)
offset = Offset(Surface=srf_2, Distance=[0.01, -0.01], Retrim=True)
edges = BrepEdges(Brep=offset)  # -> Naked, Interior, NonManifold
join = JoinCurves(Curves=edges.Naked, Preserve=False)
trim = TrimTree(Tree=join, Depth=2)
loft = Loft(Curves=trim, Options={Adjust=False, Closed=False, LoftEnds=0, LoftSimp=0, LoftType=0, Rebuild=10, Refit=0.01})
join_2 = BrepJoin(Breps=flatten([loft, offset]))  # -> Breps, Closed
mesh = Mesh(join_2.Breps)
mesh_2 = ClusterOutput(mesh)
