# Grasshopper definition FredrikStad_modelVerification.gh (Grasshopper 0.9.76)
# plug-ins: Karamba, MiStrAnGH

series = Series(Start=0, Step=0.1, Count=10)
series_2 = Series(Start=0, Step=0.1, Count=10)
number_slider = Slider(0, range=0..1)
series_3 = Series(Start=0.01, Step=0.012, Count=10)
graph = GraphMapper(series, x0=0, x1=1, y0=0, y1=1, container_name="Conic", Cx=0.7761623263, Cy=0.3239305019)
number_slider_2 = Slider(1.6, range=0..3)
graph_2 = GraphMapper(
    series_2,
    x0=0,
    x1=1,
    y0=0,
    y1=1,
    container_name="Bezier",
    cpx=[0, 0.25, 0.4478259981, 1],
    cpy=[0, 0.25, 0.5402898788, 0.5623186827])
series_4 = Series(Start=0, Step=3.1111, Count=10)
multiplication = Multiplication(A=graph, B=Slider(3.54, range=0..10))
addition = Addition(A=Slider(0.59, range=0..1), B=multiplication)
sectioncurve = SectionCurve(depth=reverse(addition), sharpness=series_3)
Z = UnitZ(Factor=graph_2)
multiplication_2 = Multiplication(A=Slider(1.6, range=0..10), B=Z)
long_stiffener_pos = Panel("""-0.75
0.75""")
trans_stiffener_pos = Panel("""2
4
6
8
10
12
16
20
24""")
X = UnitX(Factor=series_4)
crv = Curve(flatten(sectioncurve))
addition_2 = Addition(A=multiplication_2, B=X)
pt = ConstructPoint(XCoordinate=0, YCoordinate=long_stiffener_pos, ZCoordinate=0)
pt_2 = ConstructPoint(XCoordinate=trans_stiffener_pos, YCoordinate=0, ZCoordinate=0)
yz = YZPlane(Origin=addition_2)
xz = XZPlane(Origin=pt)
yz_2 = YZPlane(Origin=pt_2)
orient = Orient(Geometry=crv, Source=PlaneXY(0, 0, 0), Target=yz)  # -> Geometry, Transform
loft = Loft(Curves=orient.Geometry, Options={Adjust=False, Closed=False, LoftEnds=0, LoftSimp=0, LoftType=0, Rebuild=10, Refit=0.01})
xz_2 = XZPlane(Origin=Point(0, 0, 0))
merge = Merge(Data1=yz_2, Data2=xz)
cap = CapHoles(Brep=loft)
rectangle = Rectangle(Plane=[merge, xz_2], XSize=Domain(-100, 100), YSize=Domain(-100, 100), Radius=0)  # -> Rectangle, Length
merge_2 = Merge(Data1=rectangle.Rectangle)
sec = BrepPlane(Brep=cap, Plane=merge)  # -> flatten(Curves), Points
split_multiple = CSharpScript(B=cap, C=flatten(merge_2), tol=Slider(0.001, range=0..0.001))  # -> R; inputs B: Brep, C: list of Brep, tol: Double
# ---------- split_multiple: C# ----------
    List<Brep> pool = new List<Brep>();


    Brep[] firstResult = B.Split(C[0], tol);
    pool.AddRange(firstResult);
    
    Brep joinedBreps = Brep.JoinBreps(firstResult, tol)[0];

    for (int i = 1; i < C.Count; i++)
    {

        Brep[] result = joinedBreps.Split(C[i], tol);
        if(result.Length > 1)
        joinedBreps = Brep.JoinBreps(result, tol)[0];

    }

    R = joinedBreps;
# ---------- end split_multiple ----------
boundary = BoundarySurfaces(Edges=sec.Curves)
brep = Brep(split_multiple)
cross_sections = CrossSectionsKaramba(Heights_cm=1, mode="Shell")
# Carbon fibre top
matprops = MaterialPropertiesKaramba(
    YoungsModulus_kN_cm2=21000,
    ShearModulus_kN_cm2=7930,
    SpecificWeight_kN_m3=76.518,
    CoefficientOfThermalExpansion_1_C=1e-05,
    YieldStrength_kN_cm2=23.5,
    Name="S235")
loads = LoadsKaramba(Vector=Vector(0, 0, -1), LCase=0, mode="Gravity")
merge_3 = Merge(Data1=brep, Data2=boundary)  # -> flatten(Result)
mesh_breps = MeshBreps(
    Brep=merge_3,
    MeshResolution=Slider(0.1, range=0..2),
    EdgeRefinementFactor=0.67,
    PointReduction=False,
    SmoothingStepSize=1,
    SmoothingIterations=5)  # -> Mesh, Info
mjoin = MeshJoin(Meshes=mesh_breps.Mesh)
cullmesh = CleanMesh(Mesh=mjoin, Tolerance=Slider(0.001, range=0..0.001))  # -> CulledMesh, CulledFaces
mesh = Mesh(cullmesh.CulledMesh)
demesh = DeconstructMesh(Mesh=mesh)  # -> Vertices, Faces, Colours, Normals
meshtoshell = MeshToShellKaramba(Point=demesh.Vertices, Mesh=mesh, LDist=0.005)  # -> Point, Element, Info
demesh_2 = DeconstructMesh(Mesh=cullmesh.CulledMesh)  # -> Vertices, Faces, Colours, Normals
lng = ListLength(List=demesh_2.Vertices)
pdecon = Deconstruct(Point=demesh_2.Vertices)  # -> XComponent, YComponent, ZComponent
series_5 = Series(Start=0, Step=1, Count=lng)
equals = Equality(FirstNumber=pdecon.XComponent, SecondNumber=0)  # -> Equality, Inequality
cull = CullPattern(List=demesh_2.Vertices, CullPattern=equals.Equality)
sup_pts = Point(cull)
supp = SupportKaramba(PosInd=sup_pts, menu=[buttons(on, on, on, on, on, on)])
assemble = AssembleModelKaramba(
    Elem=meshtoshell.Element,
    Support=supp,
    Load=loads,
    CrossSection=cross_sections,
    Material=matprops,
    LimitDistance_m=0.005)  # -> Model, Info, Mass_kg, CenterOfGravity
analyzethi = AnalyzeThIKaramba(Model=assemble.Model)  # -> CalculatedModel, MaximumDisplacement_m, ResultingForceOfGravity_kN, ElasticEnergy_kNm
cull_2 = CullPattern(List=series_5, CullPattern=equals.Equality)
support = CreateSupport(
    NodeID=cull_2,
    SupportInXDirection=True,
    SupportInYDirection=True,
    SupportInZDirection=True,
    SupportInXXDirection=True,
    SupportInYYDirection=True,
    SupportInZZDirection=True)
# Carbon fibre top
modelview = ModelViewKaramba(Model=analyzethi.CalculatedModel, LoadCaseFactorsForLinearSuperposition=1, IndexIncrementOfVisibleLoadcase=0)  # -> Model, DeformedMesh, DeformedAxes, DeformedModel
panel = Panel("false")
merge_4 = Merge(Data1=support)  # -> flatten(Result)
nodedisp = NodalDisplacementsKaramba(AnalyzedModel=analyzethi.CalculatedModel)  # -> AnalyzedModel, NodalTranslations_m, NodalRotations_rad
nvibes = NaturalVibrationsKaramba(Model=analyzethi.CalculatedModel, FromIndex=1, NumberOfModes=1, MaximumNumberOfIterations=30, Epsilon=1e-05)  # -> ModelWithVibrationModesAsLoadCaseResults, NaturalFrequencies_Hz, ModalMass_kg, ParticipationFactorInGlobalXYAndZDirection
gravity = MiStrAnGravityLoad()
section = Section(
    EModulusInLongitudinalDirection_GPa=210,
    EModulusInTransverseDirection_GPA=210,
    LongitudinalShearModulus_GPA=79.3,
    PoissonsRatio=0.3,
    LaminaThickness_mm=10,
    Angles_degree=0,
    Density_kg_m_3=7800)
assemble_2 = MiStrAnAssembleStructure(Mesh=cullmesh.CulledMesh, MiStrAnSupports=merge_4, MiStrAnLoads=gravity, GeneratedSection=section)  # -> AssembledStructure, DuplicateSections
eigenfreq = Eigenfrequencies(Structure=assemble_2.AssembledStructure, RangeToSearchWithin=1000, NumberOfEigenfrequencies=20)  # -> LowestEigenfrequency, Structure, Residuals, AnalysisInfo
eigenmodes = EigenModes(Structure=eigenfreq.Structure, ScaleFactor=Slider(100, range=-100..100))
analyse = MiStrAnAnalyseStructure(Run=Toggle(True), MiStrAnStructure=assemble_2.AssembledStructure)  # -> AnalysedStructure, Displacements, Rotations, Reactions, PrincipalStresses, PrincipalStressAngles, VonMisesStresses
series_6 = Series(Start=0, Step=1, Count=74701)
number_slider_3 = Slider(1, range=1..100)
item = ListItem(List=eigenmodes, Index=Slider(1, range=0..20), Wrap=True)  # -> reverse(Item)
number_slider_4 = Slider(10, range=0..10)
sort = SortList(Keys=analyse.VonMisesStresses, ValuesA=series_6)  # -> Keys, reverse(ValuesA)
vlen = VectorLength(Vector=analyse.Displacements)
sort_2 = SortList(Keys=vlen)  # -> Keys, ValuesA
visres = VisualiseResults(
    Structure=analyse.AnalysedStructure,
    ScaleDeformation=Slider(50, range=0..100),
    BottomLimiter=0,
    TopLimiter=Slider(1, range=0..1),
    StressMeshType=Slider(1, range=0..1))  # -> DeformedMesh, VonMisesStressPlot
drawprincarrows = DrawPrincipalstressArrows(Structure=analyse.AnalysedStructure)  # disabled
item_2 = ListItem(List=sort_2.Keys, Index=0, Wrap=True)  # -> Item1, Item
division = Division(A=item_2.Item1, B=analyzethi.MaximumDisplacement_m)
mesh_2 = Mesh(visres.DeformedMesh)
results = Panel(item_2.Item1)
subtraction = Subtraction(A=Slider(1, range=0..1), B=division)
memorizer = CSharpScript(x=item_2.Item1, reset=Button())  # -> out, A; inputs reset: Boolean
# ---------- memorizer: C# ----------
    values.Add(x);
    if(reset)
      values.Clear();

    A = values;
# ---------- memorizer: C# additional code ----------
  List<object> values = new List<object>();
# ---------- end memorizer ----------
division_2 = Division(A=56, B=400)
panel_2 = Panel(division_2)

# ==== cluster SectionCurve
panel = Panel("-1")
sharpness = ClusterInput()
sharpness_2 = Number(sharpness)
depth = ClusterInput()
depth_2 = Number(depth)
subtraction = Subtraction(A=1, B=sharpness_2)
lng = ListLength(List=depth_2)
neg = Negative(Value=depth_2)
multiplication = Multiplication(A=neg, B=subtraction)
pt = ConstructPoint(XCoordinate="-1.5", YCoordinate=0, ZCoordinate=0)
pt_2 = ConstructPoint(XCoordinate="-0.2", YCoordinate=multiplication, ZCoordinate=0)
pt_3 = ConstructPoint(XCoordinate="-1.45", YCoordinate="0.1", ZCoordinate=0)
pt_4 = ConstructPoint(XCoordinate=0, YCoordinate=neg, ZCoordinate=0)
dup = DuplicateData(Data=pt, Number=lng, Order=True)
dup_2 = DuplicateData(Data=pt_3, Number=lng, Order=True)
yz = YZPlane(Origin=Point(0, 0, 0))
mirror = Mirror(Geometry=pt_2, Plane=yz)  # -> Geometry, Transform
mirror_2 = Mirror(Geometry=dup, Plane=yz)  # -> Geometry, Transform
mirror_3 = Mirror(Geometry=dup_2, Plane=yz)  # -> Geometry, Transform
ln = Line(StartPoint=dup_2, EndPoint=mirror_3.Geometry)
ln_2 = Line(StartPoint=dup_2, EndPoint=dup)
ln_3 = Line(StartPoint=mirror_3.Geometry, EndPoint=mirror_2.Geometry)
entwine = Entwine(Branch00=dup, Branch01=pt_2, Branch02=pt_4, Branch03=mirror.Geometry, Branch04=mirror_2.Geometry, FlattenInputs=True)
flip = FlipMatrix(Data=entwine)
intcrv = Interpolate(Vertices=flip, Degree=3, Periodic=False, KnotStyle=1)  # -> Curve, Length, Domain
merge = Merge(Data1=simplify(graft(ln)), Data2=simplify(graft(ln_2)), Data3=simplify(graft(ln_3)), Data4=simplify(intcrv.Curve))
join = JoinCurves(Curves=merge, Preserve=False)  # -> flatten(Curves)
crv = Curve(join)
crv_2 = ClusterOutput(crv)
