# Grasshopper definition FredrikStadv2materialOpt.gh (Grasshopper 0.9.76)
# plug-ins: Karamba, MiStrAnGH

# ---- group: saved optimisation
indices_10mm_cfrp = Integer([35391, 39514, 33930, 36092, 64323, 68471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])
indices_30mm_cfrp = Integer([36775, 66069, 36977, 66126, 37089, 36749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])
indices_20mm_cfrp = Integer([35553, 64680, 37944, 65226, 35973, 37077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])
mesh = Mesh(Tree({0;0}: [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], {0;1}: [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], {0;2}: [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]))
weight_20mm = Number([1548.408724, 1548.408724, 16.331827, 701.031173, 1017.914552, 579.240457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])
weight_30mm = Number([2461.744916, 2461.744916, 4874.63779, 2192.021911, 3872.948997, 4311.394868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])
weight_10mm = Number([880.834488, 880.834488, 1997.722919, 0.186505, 780.904779, 1590.454536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])
def = Number([0.121315, 0.121315, 0.134487, 0.113731, 0.131024, 0.132441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])

# ---- group: latest
_5mm = Panel("""221.219647
221.219647
0.187963
146.493288
0.091295
0
432.958411
1155.146832
0
1309.160911
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""")
_19mm = Panel("""182.328051
182.328051
1058.548908
1698.625094
1137.337168
1428.429494
1144.433103
1292.984941
871.241061
257.904048
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""")
_12mm = Panel("""536.569642
536.569642
869.304415
229.303444
790.567211
499.4652
783.565198
634.851503
1056.727758
1528.972603
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""")
def_2 = Panel("""0.112689
0.112689
0.142242
0.147402
0.142894
0.144608
0.142902
0.144073
0.140655
0.133837
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""")
multiplication = Multiplication(A=def_2, B=10)
division = Division(A=_12mm, B=1000)
division_2 = Division(A=_19mm, B=1000)
pt = ConstructPoint(XCoordinate=division_2, YCoordinate=division, ZCoordinate=multiplication)
del = DelaunayMesh(Points=pt, Plane=PlaneXY(0, 0, 0))

# ----
_19mm_2 = Panel("""997.827273
997.827273
1709.496887
1403.709224
223.121631
815.55831
1214.69179
315.216971
1819.507885
537.42722
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""")
_12mm_2 = Panel("""708.933711
708.933711
218.2792
377.754236
1704.713572
1112.39434
280.345486
457.566545
108.479711
81.373192
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""")
def_3 = Panel("""0.136417
0.136417
0.149202
0.142566
0.138201
0.140861
0.132556
0.114564
0.150629
0.115477
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""")
multiplication_2 = Multiplication(A=def_3, B=10)
division_3 = Division(A=_12mm_2, B=1000)
division_4 = Division(A=_19mm_2, B=1000)
pt_2 = ConstructPoint(XCoordinate=division_4, YCoordinate=division_3, ZCoordinate=multiplication_2)
del_2 = DelaunayMesh(Points=pt_2, Plane=PlaneXY(0, 0, 0))
series = Series(Start=0, Step=0.1, Count=10)
series_2 = Series(Start=0, Step=0.1, Count=10)
number_slider = Slider(0, range=0..1)
series_3 = Series(Start=0.01, Step=0.012, Count=10)
graph = GraphMapper(series, x0=0, x1=1, y0=0, y1=1, container_name="Conic", Cx=0.7761623263, Cy=0.3239305019)
number_slider_2 = Slider(1.6, range=0..3)
graph_2 = GraphMapper(
    series_2,
    x0=0,
    x1=1,
    y0=0,
    y1=1,
    container_name="Bezier",
    cpx=[0, 0.25, 0.4478259981, 1],
    cpy=[0, 0.25, 0.5402898788, 0.5623186827])
series_4 = Series(Start=0, Step=3.1111, Count=10)
multiplication_3 = Multiplication(A=graph, B=Slider(3.54, range=0..10))
addition = Addition(A=Slider(0.59, range=0..1), B=multiplication_3)
sectioncurve = SectionCurve(depth=reverse(addition), sharpness=series_3)
Z = UnitZ(Factor=graph_2)
multiplication_4 = Multiplication(A=Slider(1.6, range=0..10), B=Z)
long_stiffener_pos = Panel("""-0.75
0.75""")
trans_stiffener_pos = Panel("""2
4
6
8
10
12
16
20
24""")
X = UnitX(Factor=series_4)
crv = Curve(flatten(sectioncurve))
addition_2 = Addition(A=multiplication_4, B=X)
galapagos = Galapagos(fitness=item_16, gene=[number_slider_4, number_slider_5])
pt_3 = ConstructPoint(XCoordinate=0, YCoordinate=long_stiffener_pos, ZCoordinate=0)
pt_4 = ConstructPoint(XCoordinate=trans_stiffener_pos, YCoordinate=0, ZCoordinate=0)
yz = YZPlane(Origin=addition_2)
xz = XZPlane(Origin=pt_3)
yz_2 = YZPlane(Origin=pt_4)
orient = Orient(Geometry=crv, Source=PlaneXY(0, 0, 0), Target=yz)  # -> Geometry, Transform
loft = Loft(Curves=orient.Geometry, Options={Adjust=False, Closed=False, LoftEnds=0, LoftSimp=0, LoftType=0, Rebuild=10, Refit=0.01})
xz_2 = XZPlane(Origin=Point(0, 0, 0))
merge = Merge(Data1=yz_2, Data2=xz)
cap = CapHoles(Brep=loft)
rectangle = Rectangle(Plane=[merge, xz_2], XSize=Domain(-100, 100), YSize=Domain(-100, 100), Radius=0)  # -> Rectangle, Length

# ----
# Support Brep
number_slider_3 = Slider(0.55, range=0..1)
pt_5 = ConstructPoint(XCoordinate=8, YCoordinate=0, ZCoordinate=0)
Z_2 = UnitZ(Factor=number_slider_3)
brep = Brep(cap)
circle = CircleCNR(Center=pt_5, Normal=Vector(0, 0, 1), Radius=Slider(0.3, range=0..1))
neg = Negative(Value=Z_2)
project = Project(Curve=circle, Brep=brep, Direction=Vector(0, 0, 1))
extr = Extrude(Base=circle, Direction=neg)
planar = Planar(Curve=project)  # -> Planar, Plane, Deviation
cull = CullPattern(List=project, CullPattern=invert(planar.Planar))
Z_3 = UnitZ(Factor=[-0.01, 0.01])
move = Move(Geometry=cull, Motion=Z_3)  # -> Geometry, Transform
loft_2 = Loft(Curves=move.Geometry, Options={Adjust=False, Closed=False, LoftEnds=0, LoftSimp=0, LoftType=0, Rebuild=10, Refit=0.01})
split = SplitBrep(Brep=brep, Cutter=loft_2)
item = ListItem(List=split, Index=1, Wrap=True)
move_2 = Move(Geometry=item, Motion=Z_3)  # -> Geometry, Transform
join = BrepJoin(Breps=flatten([move_2.Geometry, loft_2]))  # -> Breps, Closed

material_region_curves = Curve([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])
neg_2 = Negative(Value="0.01")
Z_4 = UnitZ(Factor=["0.01", neg_2])
move_3 = Move(Geometry=material_region_curves, Motion=graft(Z_4))  # -> Geometry, Transform
flip = FlipMatrix(Data=move_3.Geometry)
loft_3 = Loft(Curves=flip, Options={Adjust=False, Closed=False, LoftEnds=0, LoftSimp=0, LoftType=0, Rebuild=10, Refit=0.01})  # -> flatten(Loft)
merge_2 = Merge(Data1=rectangle.Rectangle, Data2=loft_3)
supportbrep = Brep(join.Breps)
supportbrep_2 = Brep(supportbrep)
sec = BrepPlane(Brep=cap, Plane=merge)  # -> flatten(Curves), Points
split_multiple = CSharpScript(B=cap, C=flatten(merge_2), tol=Slider(0.001, range=0..0.001))  # -> R; inputs B: Brep, C: list of Brep, tol: Double
# ---------- split_multiple: C# ----------
    List<Brep> pool = new List<Brep>();


    Brep[] firstResult = B.Split(C[0], tol);
    pool.AddRange(firstResult);
    
    Brep joinedBreps = Brep.JoinBreps(firstResult, tol)[0];

    for (int i = 1; i < C.Count; i++)
    {

        Brep[] result = joinedBreps.Split(C[i], tol);
        if(result.Length > 1)
        joinedBreps = Brep.JoinBreps(result, tol)[0];

    }

    R = joinedBreps;
# ---------- end split_multiple ----------
boundary = BoundarySurfaces(Edges=sec.Curves)
brep_2 = Brep(split_multiple)
merge_3 = Merge(Data1=brep_2, Data2=boundary)  # -> flatten(Result)
mesh_breps = MeshBreps(
    Brep=merge_3,
    MeshResolution=Slider(0.1, range=0..2),
    EdgeRefinementFactor=0.67,
    PointReduction=False,
    SmoothingStepSize=1,
    SmoothingIterations=5)  # -> Mesh, Info
mjoin = MeshJoin(Meshes=mesh_breps.Mesh)
supportbrep_3 = Brep(supportbrep)
mesh_2 = Mesh(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)
cullmesh = CleanMesh(Mesh=mjoin, Tolerance=Slider(0.001, range=0..0.001))  # -> CulledMesh, CulledFaces

number_slider_4 = Slider(893, range=0..9286)
number_slider_5 = Slider(4277, range=0..13277)
element_indices_sorted_by_highest_stress = Integer([36775, 36977, 66069, 36749, 65956, 37198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])
mesh_3 = Mesh(cullmesh.CulledMesh)
series_5 = Series(Start=0, Step=1, Count=number_slider_4)
series_6 = Series(Start=0, Step=1, Count=50000)
series_7 = Series(Start=0, Step=1, Count=number_slider_5)
mesh_face_area = CSharpScript(M=mesh_3)  # -> A; inputs M: Mesh
# ---------- mesh_face_area: C# ----------
    List<double> Area = new List<double>();

    for (int i = 0; i < M.Faces.Count; i++)
    {
      int faceIndex = i;

      Point3d a = M.Vertices[M.Faces[faceIndex].A];
      Point3d b = M.Vertices[M.Faces[faceIndex].B];
      Point3d c = M.Vertices[M.Faces[faceIndex].C];

      Vector3d vecA = new Vector3d(b - a);
      Vector3d vecB = new Vector3d(c - a);

      double area = Vector3d.CrossProduct(vecA, vecB).Length / 2;
      Area.Add(area);
    }

    A = Area;
# ---------- end mesh_face_area ----------
item_2 = ListItem(List=element_indices_sorted_by_highest_stress, Index=series_5, Wrap=True)
cull_i = CullIndex(List=element_indices_sorted_by_highest_stress, Indices=series_5, Wrap=True)
item_3 = ListItem(List=cull_i, Index=series_7, Wrap=True)
maximum_tonnge = Panel("1928")
item_4 = ListItem(List=mesh_face_area, Index=item_2, Wrap=True)
item_5 = ListItem(List=mesh_face_area, Index=item_3, Wrap=True)
multiplication_5 = Multiplication(A=item_4, B=60.8)
multiplication_6 = Multiplication(A=item_5, B=38.4)
ma = MassAddition(Input=multiplication_5)  # -> Result, PartialResults
ma_2 = MassAddition(Input=multiplication_6)  # -> Result, PartialResults
weight_30mm_2 = Number(ma.Result)
subtraction = Subtraction(A=maximum_tonnge, B=weight_30mm_2)
weight_20mm_2 = Number(ma_2.PartialResults)
max_weight_for_20mm = Number(subtraction)
smaller = SmallerThan(FirstNumber=weight_20mm_2, SecondNumber=max_weight_for_20mm)  # -> SmallerThan, OrEqualTo
int = Integer(smaller.OrEqualTo)
ma_3 = MassAddition(Input=int)  # -> Result, PartialResults
split_2 = SplitList(List=series_7, Index=ma_3.Result)  # -> ListA, ListB
cull_i_2 = CullIndex(List=cull_i, Indices=split_2.ListA, Wrap=True)
item_6 = ListItem(List=cull_i, Index=split_2.ListA, Wrap=True)
item_7 = ListItem(List=cull_i_2, Index=series_6, Wrap=True)
item_8 = ListItem(List=mesh_face_area, Index=item_6, Wrap=True)
item_9 = ListItem(List=mesh_face_area, Index=item_7, Wrap=True)
multiplication_7 = Multiplication(A=item_8, B=38.4)
multiplication_8 = Multiplication(A=item_9, B=16)
ma_4 = MassAddition(Input=multiplication_7)  # -> Result, PartialResults
ma_5 = MassAddition(Input=multiplication_8)  # -> Result, PartialResults
adjusted_weight_20mm = Number(ma_4.Result)
weight_10mm_2 = Number(ma_5.PartialResults)
panel = Panel(adjusted_weight_20mm)
addition_3 = Addition(A=weight_30mm_2, B=adjusted_weight_20mm)
subtraction_2 = Subtraction(A=maximum_tonnge, B=addition_3)
smaller_2 = SmallerThan(FirstNumber=weight_10mm_2, SecondNumber=subtraction_2)  # -> SmallerThan, OrEqualTo
int_2 = Integer(smaller_2.OrEqualTo)
ma_6 = MassAddition(Input=int_2)  # -> Result, PartialResults
split_3 = SplitList(List=cull_i_2, Index=ma_6.Result)  # -> ListA, ListB
split_4 = SplitList(List=weight_10mm_2, Index=ma_6.Result)  # -> ListA, ListB
adjusted_10mm = Number(split_4.ListA)
indices_10mm_cfrp_2 = Integer(split_3.ListA)
indices_30mm_cfrp_2 = Integer(item_2)
indices_20mm_cfrp_2 = Integer(item_6)
item_10 = ListItem(List=reverse(adjusted_10mm), Index=0, Wrap=True)
weight_20mm_3 = Number(adjusted_weight_20mm)
weight_30mm_3 = Number(weight_30mm_2)
weight_10mm_3 = Number(item_10)

entwine = Entwine(Branch00=indices_30mm_cfrp_2, Branch01=indices_20mm_cfrp_2, Branch02=indices_10mm_cfrp_2, FlattenInputs=True)
memorizer = CSharpScript(x=weight_20mm_3, reset=Button())  # -> out, A; inputs reset: Boolean
# ---------- memorizer: C# ----------
    values.Add(x);
    if(reset)
      values.Clear();

    A = values;
# ---------- memorizer: C# additional code ----------
  List<object> values = new List<object>();
# ---------- end memorizer ----------
panel_2 = Panel(memorizer.A)
mesh_keep_faces = CSharpScript(M=mesh_3, I=entwine)  # -> mesh, A; inputs M: Mesh, I: list of Int32
# ---------- mesh_keep_faces: C# ----------
    double totArea = 0;
    Mesh outMesh = new Mesh();
    for (int i = 0; i < I.Count; i++)
    {
      int faceIndex = I[i];
      
      Point3d a = M.Vertices[M.Faces[faceIndex].A];
      Point3d b = M.Vertices[M.Faces[faceIndex].B];
      Point3d c = M.Vertices[M.Faces[faceIndex].C];
      
      Vector3d vecA = new Vector3d(b - a);
      Vector3d vecB = new Vector3d(c - a);
      
      double area = Vector3d.CrossProduct(vecA, vecB).Length / 2;
      totArea += area;
      
      int _A = outMesh.Vertices.Add(a);
      int _B = outMesh.Vertices.Add(b);
      int _C = outMesh.Vertices.Add(c);
      outMesh.Faces.AddFace(new MeshFace(_A, _B, _C));
    }
    
    A = totArea;
    mesh = outMesh;
# ---------- end mesh_keep_faces ----------
memorizer_2 = CSharpScript(x=weight_30mm_3, reset=Button())  # -> out, A; inputs reset: Boolean; same code as memorizer
panel_3 = Panel(memorizer_2.A)
memorizer_3 = CSharpScript(x=weight_10mm_3, reset=Button())  # -> out, A; inputs reset: Boolean; same code as memorizer
panel_4 = Panel(memorizer_3.A)
mesh_4 = Mesh(mesh_keep_faces.mesh)

# ----
# Traditional CFRP
# Carbon fibre top
# Traditional CFRP
# Carbon fibre top
# Sandwich carbon fibre
# Traditional CFRP
# Carbon fibre top
# Sandwich carbon fibre
crv_2 = Curve([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])
Z_5 = UnitZ(Factor=[0.01, -0.01])
move_4 = Move(Geometry=graft(crv_2), Motion=Z_5)  # -> Geometry, Transform
basebrep = Brep(cap)
loft_4 = Loft(Curves=move_4.Geometry, Options={Adjust=False, Closed=False, LoftEnds=0, LoftSimp=0, LoftType=0, Rebuild=10, Refit=0.01})
thickness_top = Panel("""19
0.25
0.25
0.25
30
0.25
0.25
0.25
19""")
thickness_top_2 = Panel("""12
0.25
0.25
0.25
30
0.25
0.25
0.25
12""")
# Sandwich carbon fibre
ex = Panel("""138
38.6
38.6
38.6
0.01
38.6
38.6
38.6
138""")
poissons_ratio = Panel("""0.3
0.26
0.26
0.26
5
0.26
0.26
0.26
0.3""")
density = Panel("""1600
1800
1800
1800
0
1800
1800
1800
1600""")
ex_2 = Panel("""138
38.6
38.6
38.6
0.01
38.6
38.6
38.6
138""")
poissons_ratio_2 = Panel("""0.3
0.26
0.26
0.26
5
0.26
0.26
0.26
0.3""")
density_2 = Panel("""1600
1800
1800
1800
0
1800
1800
1800
1600""")
thickness_top_3 = Panel("""5
0.25
0.25
0.25
30
0.25
0.25
0.25
5""")
poissons_ratio_3 = Panel("""0.3
0.26
0.26
0.26
5
0.26
0.26
0.26
0.3""")
density_3 = Panel("""1600
1800
1800
1800
0
1800
1800
1800
1600""")
ex_3 = Panel("""138
38.6
38.6
38.6
0.01
38.6
38.6
38.6
138""")
split_5 = SplitBrep(Brep=basebrep, Cutter=loft_4)
item_11 = ListItem(List=split_5, Index=graft([1, 1, 2]), Wrap=True)  # -> flatten(Item)
gxy = Panel("""7.1
4.14
4.14
4.14
0.01
4.14
4.14
4.14
7.1""")
gxy_2 = Panel("""7.1
4.14
4.14
4.14
0.01
4.14
4.14
4.14
7.1""")
ey = Panel("""8.96
8.27
8.27
8.27
0.01
8.27
8.27
8.27
8.96""")
ey_2 = Panel("""8.96
8.27
8.27
8.27
0.01
8.27
8.27
8.27
8.96""")
angles = Panel("""0
45
-45
90
0
90
-45
45
0""")
angles_2 = Panel("""0
45
-45
90
0
90
-45
45
0""")
gxy_3 = Panel("""7.1
4.14
4.14
4.14
0.01
4.14
4.14
4.14
7.1""")
ey_3 = Panel("""8.96
8.27
8.27
8.27
0.01
8.27
8.27
8.27
8.96""")
angles_3 = Panel("""0
45
-45
90
0
90
-45
45
0""")
inclusion_mesh = InclusionMesh(srf=graft(item_11))
carbonfibre = Section(
    ElementId=indices_20mm_cfrp_2,
    EModulusInLongitudinalDirection_GPa=ex_2,
    EModulusInTransverseDirection_GPA=ey_2,
    LongitudinalShearModulus_GPA=gxy_2,
    PoissonsRatio=poissons_ratio_2,
    LaminaThickness_mm=thickness_top_2,
    Angles_degree=angles_2,
    Density_kg_m_3=density_2)
carbonfibre_2 = Section(
    ElementId=indices_10mm_cfrp_2,
    EModulusInLongitudinalDirection_GPa=ex_3,
    EModulusInTransverseDirection_GPA=ey_3,
    LongitudinalShearModulus_GPA=gxy_3,
    PoissonsRatio=poissons_ratio_3,
    LaminaThickness_mm=thickness_top_3,
    Angles_degree=angles_3,
    Density_kg_m_3=density_3)
carbonfibre_3 = Section(
    ElementId=indices_30mm_cfrp_2,
    EModulusInLongitudinalDirection_GPa=ex,
    EModulusInTransverseDirection_GPA=ey,
    LongitudinalShearModulus_GPA=gxy,
    PoissonsRatio=poissons_ratio,
    LaminaThickness_mm=thickness_top,
    Angles_degree=angles,
    Density_kg_m_3=density)

demesh = DeconstructMesh(Mesh=cullmesh.CulledMesh)  # -> Vertices, Faces, Colours, Normals
area = Area(Geometry=supportbrep_3)  # -> Area, Centroid
lng = ListLength(List=demesh.Vertices)
pdecon = Deconstruct(Point=demesh.Vertices)  # -> XComponent, YComponent, ZComponent
cp = ClosestPoint(Point=area.Centroid, Cloud=demesh.Vertices)  # -> ClosestPoint, CPIndex, Distance
series_8 = Series(Start=0, Step=1, Count=lng)
lng_2 = ListLength(List=indices_20mm_cfrp_2)
equals = Equality(FirstNumber=pdecon.XComponent, SecondNumber=0)  # -> Equality, Inequality
lng_3 = ListLength(List=indices_10mm_cfrp_2)
basebrep_2 = Brep(cap)
larger = LargerThan(FirstNumber=lng_2, SecondNumber=0)  # -> LargerThan, OrEqualTo
lng_4 = ListLength(List=indices_30mm_cfrp_2)
larger_2 = LargerThan(FirstNumber=lng_3, SecondNumber=0)  # -> LargerThan, OrEqualTo
cull_2 = CullPattern(List=series_8, CullPattern=equals.Equality)
cull_3 = CullPattern(List=demesh.Vertices, CullPattern=equals.Equality)
debrep = DeconstructBrep(Brep=basebrep_2)  # -> Faces, Edges, Vertices
larger_3 = LargerThan(FirstNumber=lng_4, SecondNumber=0)  # -> LargerThan, OrEqualTo
gate = StreamGate(Stream=carbonfibre, Gate=larger.LargerThan)  # -> Target0, Target1
gate_2 = StreamGate(Stream=carbonfibre_2, Gate=larger_2.LargerThan)  # -> Target0, Target1
item_12 = ListItem(List=debrep.Faces, Index=3, Wrap=True)
support = CreateSupport(
    NodeID=cp.CPIndex,
    SupportInXDirection=True,
    SupportInYDirection=True,
    SupportInZDirection=True,
    SupportInXXDirection="false",
    SupportInYYDirection="false",
    SupportInZZDirection="false")
support_2 = CreateSupport(
    NodeID=cull_2,
    SupportInXDirection=True,
    SupportInYDirection=True,
    SupportInZDirection=True,
    SupportInXXDirection=True,
    SupportInYYDirection=True,
    SupportInZZDirection=True)
gate_3 = StreamGate(Stream=carbonfibre_3, Gate=larger_3.LargerThan)  # -> Target0, Target1
panel_5 = Panel("false")
merge_4 = Merge(Data1=support_2)  # -> flatten(Result)
inclusion_mesh_2 = InclusionMesh(srf=item_12)
mesh_5 = Mesh(cullmesh.CulledMesh)
facen = FaceNormals(Mesh=mesh_5)  # -> Centers, Normals
lng_5 = ListLength(List=facen.Centers)
series_9 = Series(Start=0, Step=1, Count=lng_5)
minc = MeshInclusion(Mesh=inclusion_mesh_2, Point=facen.Centers, Strict=False)
section = Section(
    EModulusInLongitudinalDirection_GPa=210,
    EModulusInTransverseDirection_GPA=210,
    LongitudinalShearModulus_GPA=79.3,
    PoissonsRatio=0.3,
    LaminaThickness_mm=10,
    Angles_degree=0,
    Density_kg_m_3=7800)
gravity = MiStrAnGravityLoad()
cull_4 = CullPattern(List=series_9, CullPattern=minc)
Z_6 = UnitZ(Factor=Slider(2, range=0..10))
neg_3 = Negative(Value=Z_6)
number_slider_6 = Slider(30, range=0..100)
distload = MiStrAnDistributedLoad(ElementId=cull_4, ForceVector_kN=neg_3)
crv_3 = Curve([<curve referenced from the Rhino model> x76])
number_slider_7 = Slider(100, range=-100..100)  # disabled
lng_6 = ListLength(List=demesh.Faces)
number_slider_8 = Slider(0, range=0..20)  # disabled
angles_4 = Panel("""0
45
-45
90
0
90
-45
45
0""")
series_10 = Series(Start=0, Step=1, Count=lng_6)
number_slider_9 = Slider(1, range=1..100)
number_slider_10 = Slider(900, range=0..1000)
number_slider_11 = Slider(10, range=0..10)
mesh_6 = Mesh(reverse([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]))
get_stressed_elements = GetStressedElements(
    MeshToEvaluate=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,
    PrincipalStressesVector=[Vector(-0.3862339203, -3.32788185, 0), Vector(-0.4573195831, -3.796603644, 0), Vector(-0.1077882449, -4.272554098, 0), Vector(-0.02284988734, -0.9135879841, 0), Vector(-0.1289593549, -4.480518066, 0), Vector(0.1594040408, -1.789490793, 0)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],
    NbOfHighestStressedElements=Slider(2000, range=0..10000))  # -> NbElementsWithHighestStresses_Pts, NbElementsWithHighestStresses_Index, TheRestOfTheStresses, AreaOfHighStressedElements
pt_6 = Point(get_stressed_elements.NbElementsWithHighestStresses_Pts)
division_5 = Division(A=56, B=400)
panel_6 = Panel(division_5)
panel_7 = Panel("""60.8
38.4
16""")
material_region_curves_2 = Curve(material_region_curves)
panel_8 = Panel("""150
100
50""")
panel_9 = Panel("""60.8
38.4
16""")

# ----
# FRP
# Base materials
# Sandwich glass fibre
# Stiffeners
# Stiffeners
ex_4 = Panel("""38.6
38.6
38.6
38.6
0.01
38.6
38.6
38.6
38.6""")
v = Panel("""0.26
0.26
0.26
0.26
5
0.26
0.26
0.26
0.26""")
v_2 = Panel("""0.26
0.26
0.26
0.26
5
0.26
0.26
0.26
0.26""")
ex_5 = Panel("""38.6
38.6
38.6
38.6
0.01
38.6
38.6
38.6
38.6""")
mesh_7 = Mesh(cullmesh.CulledMesh)
t = Panel("""5
0.25
0.25
0.25
30
0.25
0.25
0.25
5""")
ey_4 = Panel("""8.27
8.27
8.27
8.27
0.01
8.27
8.27
8.27
8.27""")
t_2 = Panel("""3
0.25
0.25
0.25
30
0.25
0.25
0.25
3""")
ey_5 = Panel("""8.27
8.27
8.27
8.27
0.01
8.27
8.27
8.27
8.27""")
stiffener_surfaces = Brep(graft(boundary))
facen_2 = FaceNormals(Mesh=mesh_7)  # -> Centers, Normals
gxy_4 = Panel("""4.14
4.14
4.14
4.14
0.01
4.14
4.14
4.14
4.14""")
angles_6 = Panel("""0
45
-45
90
0
90
-45
45
0""")
lng_7 = ListLength(List=facen_2.Centers)
angles_7 = Panel("""0
45
-45
90
0
90
-45
45
0""")
gxy_5 = Panel("""4.14
4.14
4.14
4.14
0.01
4.14
4.14
4.14
4.14""")
inclusion_mesh_3 = InclusionMesh(srf=stiffener_surfaces)
series_11 = Series(Start=0, Step=1, Count=lng_7)
density_4 = Panel("""1800
1800
1800
1800
0
1800
1800
1800
1800""")
density_5 = Panel("""1800
1800
1800
1800
0
1800
1800
1800
1800""")
minc_2 = MeshInclusion(Mesh=graft(inclusion_mesh_3), Point=facen_2.Centers, Strict=False)
cull_5 = CullPattern(List=series_11, CullPattern=minc_2)  # -> flatten(List)
frp = Section(
    EModulusInLongitudinalDirection_GPa=ex_4,
    EModulusInTransverseDirection_GPA=ey_4,
    LongitudinalShearModulus_GPA=gxy_4,
    PoissonsRatio=v,
    LaminaThickness_mm=t,
    Angles_degree=angles_6,
    Density_kg_m_3=density_4)

cset = CreateSet(List=cull_5)  # -> Set, Map

frp_2 = Section(
    ElementId=cset.Set,
    EModulusInLongitudinalDirection_GPa=ex_5,
    EModulusInTransverseDirection_GPA=ey_5,
    LongitudinalShearModulus_GPA=gxy_5,
    PoissonsRatio=v_2,
    LaminaThickness_mm=t_2,
    Angles_degree=angles_7,
    Density_kg_m_3=density_5)

merge_5 = Merge(Data1=frp_2, Data2=frp, Data3=gate_3.Target1, Data4=gate.Target1, Data5=gate_2.Target1)

section_2 = MiStrAnSection(flatten(merge_5))

# ----
# Traditional CFRP
# Carbon fibre top
# Traditional CFRP
# Carbon fibre top
# Sandwich carbon fibre
# Traditional CFRP
# Carbon fibre top
# Sandwich carbon fibre
crv_4 = Curve([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])
Z_7 = UnitZ(Factor=[0.01, -0.01])
move_5 = Move(Geometry=graft(crv_4), Motion=Z_7)  # -> Geometry, Transform
basebrep_3 = Brep(cap)
loft_5 = Loft(Curves=move_5.Geometry, Options={Adjust=False, Closed=False, LoftEnds=0, LoftSimp=0, LoftType=0, Rebuild=10, Refit=0.01})
thickness_top_4 = Panel("""19
0.25
0.25
0.25
30
0.25
0.25
0.25
19""")
thickness_top_5 = Panel("""12
0.25
0.25
0.25
30
0.25
0.25
0.25
12""")
poissons_ratio_4 = Panel("""0.3
0.26
0.26
0.26
5
0.26
0.26
0.26
0.3""")
density_6 = Panel("""1600
1800
1800
1800
0
1800
1800
1800
1600""")
ex_6 = Panel("""138
38.6
38.6
38.6
0.01
38.6
38.6
38.6
138""")
ex_7 = Panel("""138
38.6
38.6
38.6
0.01
38.6
38.6
38.6
138""")
poissons_ratio_5 = Panel("""0.3
0.26
0.26
0.26
5
0.26
0.26
0.26
0.3""")
density_7 = Panel("""1600
1800
1800
1800
0
1800
1800
1800
1600""")
mesh_8 = Mesh(cullmesh.CulledMesh)
thickness_top_6 = Panel("""5
0.25
0.25
0.25
30
0.25
0.25
0.25
5""")
density_8 = Panel("""1600
1800
1800
1800
0
1800
1800
1800
1600""")
ex_8 = Panel("""138
38.6
38.6
38.6
0.01
38.6
38.6
38.6
138""")
poissons_ratio_6 = Panel("""0.3
0.26
0.26
0.26
5
0.26
0.26
0.26
0.3""")
split_6 = SplitBrep(Brep=basebrep_3, Cutter=loft_5)
item_13 = ListItem(List=split_6, Index=graft([2, 1, 2]), Wrap=True)  # -> flatten(Item)
gxy_6 = Panel("""7.1
4.14
4.14
4.14
0.01
4.14
4.14
4.14
7.1""")
gxy_7 = Panel("""7.1
4.14
4.14
4.14
0.01
4.14
4.14
4.14
7.1""")
ey_6 = Panel("""8.96
8.27
8.27
8.27
0.01
8.27
8.27
8.27
8.96""")
ey_7 = Panel("""8.96
8.27
8.27
8.27
0.01
8.27
8.27
8.27
8.96""")
angles_8 = Panel("""0
45
-45
90
0
90
-45
45
0""")
angles_9 = Panel("""0
45
-45
90
0
90
-45
45
0""")
gxy_8 = Panel("""7.1
4.14
4.14
4.14
0.01
4.14
4.14
4.14
7.1""")
ey_8 = Panel("""8.96
8.27
8.27
8.27
0.01
8.27
8.27
8.27
8.96""")
angles_10 = Panel("""0
45
-45
90
0
90
-45
45
0""")
facen_3 = FaceNormals(Mesh=mesh_8)  # -> Centers, Normals
lng_8 = ListLength(List=facen_3.Centers)
inclusion_mesh_4 = InclusionMesh(srf=graft(item_13))
series_12 = Series(Start=0, Step=1, Count=lng_8)
minc_3 = MeshInclusion(Mesh=graft(mesh_6), Point=facen_3.Centers, Strict=False)
cull_6 = CullPattern(List=series_12, CullPattern=minc_3)

bang = ExplodeTree(Data=simplify(cull_6))  # -> Branch0, Branch1, Branch2

carbonfibre_4 = Section(
    ElementId=bang.Branch1,
    EModulusInLongitudinalDirection_GPa=ex_7,
    EModulusInTransverseDirection_GPA=ey_7,
    LongitudinalShearModulus_GPA=gxy_7,
    PoissonsRatio=poissons_ratio_5,
    LaminaThickness_mm=thickness_top_5,
    Angles_degree=angles_9,
    Density_kg_m_3=density_7)
carbonfibre_5 = Section(
    ElementId=bang.Branch2,
    EModulusInLongitudinalDirection_GPa=ex_8,
    EModulusInTransverseDirection_GPA=ey_8,
    LongitudinalShearModulus_GPA=gxy_8,
    PoissonsRatio=poissons_ratio_6,
    LaminaThickness_mm=thickness_top_6,
    Angles_degree=angles_10,
    Density_kg_m_3=density_8)
carbonfibre_6 = Section(
    ElementId=bang.Branch0,
    EModulusInLongitudinalDirection_GPa=ex_6,
    EModulusInTransverseDirection_GPA=ey_6,
    LongitudinalShearModulus_GPA=gxy_6,
    PoissonsRatio=poissons_ratio_4,
    LaminaThickness_mm=thickness_top_4,
    Angles_degree=angles_8,
    Density_kg_m_3=density_6)

mesh_9 = Mesh(mesh_8)
int_3 = Integer(cull_6)
mesh_keep_faces_2 = CSharpScript(M=mesh_9, I=int_3)  # -> mesh, A; inputs M: Mesh, I: list of Int32; same code as mesh_keep_faces
ma_7 = MassAddition(Input=mesh_keep_faces_2.A)  # -> Result, PartialResults
multiplication_9 = Multiplication(A=ma_7.Result, B=graft(panel_7))
ma_8 = MassAddition(Input=flatten(multiplication_9))  # -> Result, PartialResults

# ----
# FRP
# Base materials
# Sandwich glass fibre
# Stiffeners
# Stiffeners
ex_9 = Panel("""38.6
38.6
38.6
38.6
0.01
38.6
38.6
38.6
38.6""")
v_3 = Panel("""0.26
0.26
0.26
0.26
5
0.26
0.26
0.26
0.26""")
v_4 = Panel("""0.26
0.26
0.26
0.26
5
0.26
0.26
0.26
0.26""")
ex_10 = Panel("""38.6
38.6
38.6
38.6
0.01
38.6
38.6
38.6
38.6""")
mesh_10 = Mesh(cullmesh.CulledMesh)
t_3 = Panel("""5
0.25
0.25
0.25
30
0.25
0.25
0.25
5""")
ey_9 = Panel("""8.27
8.27
8.27
8.27
0.01
8.27
8.27
8.27
8.27""")
t_4 = Panel("""3
0.25
0.25
0.25
30
0.25
0.25
0.25
3""")
ey_10 = Panel("""8.27
8.27
8.27
8.27
0.01
8.27
8.27
8.27
8.27""")
stiffener_surfaces_2 = Brep(graft(boundary))
facen_4 = FaceNormals(Mesh=mesh_10)  # -> Centers, Normals
gxy_9 = Panel("""4.14
4.14
4.14
4.14
0.01
4.14
4.14
4.14
4.14""")
lng_9 = ListLength(List=facen_4.Centers)
angles_12 = Panel("""0
45
-45
90
0
90
-45
45
0""")
gxy_10 = Panel("""4.14
4.14
4.14
4.14
0.01
4.14
4.14
4.14
4.14""")
inclusion_mesh_5 = InclusionMesh(srf=stiffener_surfaces_2)
series_13 = Series(Start=0, Step=1, Count=lng_9)
density_9 = Panel("""1800
1800
1800
1800
0
1800
1800
1800
1800""")
minc_4 = MeshInclusion(Mesh=graft(inclusion_mesh_5), Point=facen_4.Centers, Strict=False)
density_10 = Panel("""1800
1800
1800
1800
0
1800
1800
1800
1800""")
cull_7 = CullPattern(List=series_13, CullPattern=minc_4)  # -> flatten(List)
frp_3 = Section(
    EModulusInLongitudinalDirection_GPa=ex_9,
    EModulusInTransverseDirection_GPA=ey_9,
    LongitudinalShearModulus_GPA=gxy_9,
    PoissonsRatio=v_3,
    LaminaThickness_mm=t_3,
    Angles_degree=0,
    Density_kg_m_3=density_9)

cset_2 = CreateSet(List=cull_7)  # -> Set, Map

frp_4 = Section(
    ElementId=cset_2.Set,
    EModulusInLongitudinalDirection_GPa=ex_10,
    EModulusInTransverseDirection_GPA=ey_10,
    LongitudinalShearModulus_GPA=gxy_10,
    PoissonsRatio=v_4,
    LaminaThickness_mm=t_4,
    Angles_degree=angles_12,
    Density_kg_m_3=density_10)

merge_6 = Merge(Data1=frp_4, Data2=frp_3, Data3=carbonfibre_6, Data4=carbonfibre_4, Data5=carbonfibre_5)

section_3 = MiStrAnSection(flatten(merge_6))

# ----
# Traditional CFRP
# Sandwich carbon fibre
# Traditional CFRP
# Sandwich carbon fibre
thickness_top_7 = Panel("""19
0.25
0.25
0.25
30
0.25
0.25
0.25
19""")
thickness_top_8 = Panel("""12
0.25
0.25
0.25
30
0.25
0.25
0.25
12""")
poissons_ratio_7 = Panel("""0.3
0.26
0.26
0.26
5
0.26
0.26
0.26
0.3""")
density_11 = Panel("""1600
1800
1800
1800
0
1800
1800
1800
1600""")
ex_11 = Panel("""138
38.6
38.6
38.6
0.01
38.6
38.6
38.6
138""")
ex_12 = Panel("""138
38.6
38.6
38.6
0.01
38.6
38.6
38.6
138""")
poissons_ratio_8 = Panel("""0.3
0.26
0.26
0.26
5
0.26
0.26
0.26
0.3""")
density_12 = Panel("""1600
1800
1800
1800
0
1800
1800
1800
1600""")
thickness_top_9 = Panel("""5
0.25
0.25
0.25
30
0.25
0.25
0.25
5""")
density_13 = Panel("""1600
1800
1800
1800
0
1800
1800
1800
1600""")
ex_13 = Panel("""138
38.6
38.6
38.6
0.01
38.6
38.6
38.6
138""")
poissons_ratio_9 = Panel("""0.3
0.26
0.26
0.26
5
0.26
0.26
0.26
0.3""")
Z_8 = UnitZ(Factor=[0.01, -0.01])
move_6 = Move(Geometry=graft(material_region_curves_2), Motion=Z_8)  # -> Geometry, Transform
gxy_11 = Panel("""7.1
4.14
4.14
4.14
0.01
4.14
4.14
4.14
7.1""")
gxy_12 = Panel("""7.1
4.14
4.14
4.14
0.01
4.14
4.14
4.14
7.1""")
ey_11 = Panel("""8.96
8.27
8.27
8.27
0.01
8.27
8.27
8.27
8.96""")
ey_12 = Panel("""8.96
8.27
8.27
8.27
0.01
8.27
8.27
8.27
8.96""")
angles_13 = Panel("""0
45
-45
90
0
90
-45
45
0""")
angles_14 = Panel("""0
45
-45
90
0
90
-45
45
0""")
gxy_13 = Panel("""7.1
4.14
4.14
4.14
0.01
4.14
4.14
4.14
7.1""")
ey_13 = Panel("""8.96
8.27
8.27
8.27
0.01
8.27
8.27
8.27
8.96""")
angles_15 = Panel("""0
45
-45
90
0
90
-45
45
0""")
basebrep_4 = Brep(loft)
loft_6 = Loft(Curves=move_6.Geometry, Options={Adjust=False, Closed=False, LoftEnds=0, LoftSimp=0, LoftType=0, Rebuild=10, Refit=0.01})
mesh_11 = Mesh(cullmesh.CulledMesh)
split_7 = SplitBrep(Brep=basebrep_4, Cutter=loft_6)
item_14 = ListItem(List=split_7, Index=graft([1, 1, 1, 1]), Wrap=True)  # -> flatten(Item)
facen_5 = FaceNormals(Mesh=mesh_11)  # -> Centers, Normals
lng_10 = ListLength(List=facen_5.Centers)
inclusion_mesh_6 = InclusionMesh_3(srf=graft(item_14))
series_14 = Series(Start=0, Step=1, Count=lng_10)
minc_5 = MeshInclusion(Mesh=graft(inclusion_mesh_6), Point=facen_5.Centers, Strict=False)
cull_8 = CullPattern(List=facen_5.Centers, CullPattern=minc_5)

cull_9 = CullPattern(List=series_14, CullPattern=minc_5)
bang_2 = ExplodeTree(Data=cull_9)  # -> _0000, _0001, _0002, _0003
sunion = SetUnion(SetA=bang_2._0002, SetB=bang_2._0003)
difference = SetDifference(SetA=bang_2._0001, SetB=bang_2._0000)
difference_2 = SetDifference(SetA=sunion, SetB=bang_2._0001)
_30mm_indices = Integer(bang_2._0000)
_10mm_indices = Integer(difference_2)
_20mm_indices = Integer(difference)

carbonfibre_7 = Section(
    ElementId=_20mm_indices,
    EModulusInLongitudinalDirection_GPa=ex_12,
    EModulusInTransverseDirection_GPA=ey_12,
    LongitudinalShearModulus_GPA=gxy_12,
    PoissonsRatio=poissons_ratio_8,
    LaminaThickness_mm=thickness_top_8,
    Angles_degree=angles_14,
    Density_kg_m_3=density_12)
carbonfibre_8 = Section(
    ElementId=_10mm_indices,
    EModulusInLongitudinalDirection_GPa=ex_13,
    EModulusInTransverseDirection_GPA=ey_13,
    LongitudinalShearModulus_GPA=gxy_13,
    PoissonsRatio=poissons_ratio_9,
    LaminaThickness_mm=thickness_top_9,
    Angles_degree=angles_15,
    Density_kg_m_3=density_13)
carbonfibre_9 = Section(
    ElementId=_30mm_indices,
    EModulusInLongitudinalDirection_GPa=ex_11,
    EModulusInTransverseDirection_GPA=ey_11,
    LongitudinalShearModulus_GPA=gxy_11,
    PoissonsRatio=poissons_ratio_7,
    LaminaThickness_mm=thickness_top_7,
    Angles_degree=angles_13,
    Density_kg_m_3=density_11)

merge_7 = Merge(Data1=frp_2, Data2=frp_3, Data3=carbonfibre_9, Data4=carbonfibre_7, Data5=carbonfibre_8)
mesh_12 = Mesh(mesh_11)
int_4 = Integer(cull_8)
entwine_2 = Entwine(Branch00=_30mm_indices, Branch01=_20mm_indices, Branch02=_10mm_indices, FlattenInputs=True)
mesh_keep_faces_3 = CSharpScript(M=mesh_12, I=_30mm_indices)  # -> mesh, A; inputs M: Mesh, I: list of Int32; same code as mesh_keep_faces
mesh_13 = Mesh(flatten(mesh_keep_faces_3.mesh))
ma_9 = MassAddition(Input=mesh_keep_faces_3.A)  # -> Result, PartialResults
multiplication_10 = Multiplication(A=ma_9.Result, B=graft(panel_9))
ma_10 = MassAddition(Input=flatten(multiplication_10))  # -> Result, PartialResults

# ----
# OPTIMESIED RATIONALISED
# Base materials
# Sandwich glass fibre
# Stiffeners
ex_14 = Panel("""38.6
38.6
38.6
38.6
0.01
38.6
38.6
38.6
38.6""")
v_5 = Panel("""0.26
0.26
0.26
0.26
5
0.26
0.26
0.26
0.26""")
v_6 = Panel("""0.26
0.26
0.26
0.26
5
0.26
0.26
0.26
0.26""")
ex_15 = Panel("""38.6
38.6
38.6
38.6
0.01
38.6
38.6
38.6
38.6""")
mesh_14 = Mesh(cullmesh.CulledMesh)
t_5 = Panel("""10
0.25
0.25
0.25
30
0.25
0.25
0.25
10""")
ey_14 = Panel("""8.27
8.27
8.27
8.27
0.01
8.27
8.27
8.27
8.27""")
t_6 = Panel("""3
0.25
0.25
0.25
30
0.25
0.25
0.25
3""")
ey_15 = Panel("""8.27
8.27
8.27
8.27
0.01
8.27
8.27
8.27
8.27""")
stiffener_surfaces_3 = Brep(graft(boundary))
facen_6 = FaceNormals(Mesh=mesh_14)  # -> Centers, Normals
gxy_14 = Panel("""4.14
4.14
4.14
4.14
0.01
4.14
4.14
4.14
4.14""")
lng_11 = ListLength(List=facen_6.Centers)
angles_17 = Panel("""0
45
-45
90
0
90
-45
45
0""")
gxy_15 = Panel("""4.14
4.14
4.14
4.14
0.01
4.14
4.14
4.14
4.14""")
inclusion_mesh_7 = InclusionMesh_2(srf=stiffener_surfaces_3)
series_15 = Series(Start=0, Step=1, Count=lng_11)
density_14 = Panel("""2100
2100
2100
2100
0
2100
2100
2100
2100""")
minc_6 = MeshInclusion(Mesh=graft(inclusion_mesh_7), Point=facen_6.Centers, Strict=False)
density_15 = Panel("""2100
2100
2100
2100
0
2100
2100
2100
2100""")
cull_10 = CullPattern(List=series_15, CullPattern=minc_6)  # -> flatten(List)
frp_5 = Section(
    EModulusInLongitudinalDirection_GPa=ex_14,
    EModulusInTransverseDirection_GPA=ey_14,
    LongitudinalShearModulus_GPA=gxy_14,
    PoissonsRatio=v_5,
    LaminaThickness_mm=t_5,
    Angles_degree=0,
    Density_kg_m_3=density_14)
section_4 = MiStrAnSection(flatten(merge_7))

assemble = MiStrAnAssembleStructure(Mesh=cullmesh.CulledMesh, MiStrAnSupports=merge_4, MiStrAnLoads=flatten(distload), GeneratedSection=section_4)  # -> AssembledStructure, DuplicateSections
alignmattocurves = AlignMaterialAxisWithCurvesComponent(Structure=assemble.AssembledStructure, DirectionCurves=crv_3)  # disabled
eigenfreq = Eigenfrequencies(Structure=assemble.AssembledStructure, RangeToSearchWithin=100000, NumberOfEigenfrequencies=Slider(50, range=0..100))  # -> LowestEigenfrequency, Structure, Residuals, AnalysisInfo
structmass = StructureMass(Structure=assemble.AssembledStructure)
eigenmodes = EigenModes(Structure=eigenfreq.Structure, ScaleFactor=number_slider_7)  # disabled
analyse = MiStrAnAnalyseStructure(Run=Toggle(True), MiStrAnStructure=assemble.AssembledStructure)  # -> AnalysedStructure, Displacements, Rotations, Reactions, PrincipalStresses, PrincipalStressAngles, VonMisesStresses
drawmataxis = DrawMaterialAxis(Structure=alignmattocurves)  # disabled
item_15 = ListItem(List=eigenmodes, Index=number_slider_8, Wrap=True)  # disabled
sort = SortList(Keys=analyse.VonMisesStresses, ValuesA=series_10)  # -> Keys, reverse(ValuesA)
vlen = VectorLength(Vector=analyse.Displacements)
sort_2 = SortList(Keys=vlen)  # -> Keys, ValuesA
visres = VisualiseResults(
    Structure=analyse.AnalysedStructure,
    ScaleDeformation=Slider(20, range=0..100),
    BottomLimiter=0,
    TopLimiter=Slider(1, range=0..1),
    StressMeshType=Slider(1, range=0..1))  # -> DeformedMesh, VonMisesStressPlot
drawprincarrows = DrawPrincipalstressArrows(Structure=analyse.AnalysedStructure)  # disabled
item_16 = ListItem(List=sort_2.Keys, Index=0, Wrap=True)  # -> Item1, Item
mesh_15 = Mesh(visres.VonMisesStressPlot)
results = Panel(item_16.Item1)
memorizer_4 = CSharpScript(x=item_16.Item1, reset=Button())  # -> out, A; inputs reset: Boolean; same code as memorizer
panel_10 = Panel(memorizer_4.A)
cset_3 = CreateSet(List=cull_10)  # -> Set, Map

frp_6 = Section(
    ElementId=cset_3.Set,
    EModulusInLongitudinalDirection_GPa=ex_15,
    EModulusInTransverseDirection_GPA=ey_15,
    LongitudinalShearModulus_GPA=gxy_15,
    PoissonsRatio=v_6,
    LaminaThickness_mm=t_6,
    Angles_degree=angles_17,
    Density_kg_m_3=density_15)

# ==== cluster SectionCurve
panel = Panel("-1")
sharpness = ClusterInput()
sharpness_2 = Number(sharpness)
depth = ClusterInput()
depth_2 = Number(depth)
subtraction = Subtraction(A=1, B=sharpness_2)
lng = ListLength(List=depth_2)
neg = Negative(Value=depth_2)
multiplication = Multiplication(A=neg, B=subtraction)
pt = ConstructPoint(XCoordinate="-1.5", YCoordinate=0, ZCoordinate=0)
pt_2 = ConstructPoint(XCoordinate="-0.2", YCoordinate=multiplication, ZCoordinate=0)
pt_3 = ConstructPoint(XCoordinate="-1.45", YCoordinate="0.1", ZCoordinate=0)
pt_4 = ConstructPoint(XCoordinate=0, YCoordinate=neg, ZCoordinate=0)
dup = DuplicateData(Data=pt, Number=lng, Order=True)
dup_2 = DuplicateData(Data=pt_3, Number=lng, Order=True)
yz = YZPlane(Origin=Point(0, 0, 0))
mirror = Mirror(Geometry=pt_2, Plane=yz)  # -> Geometry, Transform
mirror_2 = Mirror(Geometry=dup, Plane=yz)  # -> Geometry, Transform
mirror_3 = Mirror(Geometry=dup_2, Plane=yz)  # -> Geometry, Transform
ln = Line(StartPoint=dup_2, EndPoint=mirror_3.Geometry)
ln_2 = Line(StartPoint=dup_2, EndPoint=dup)
ln_3 = Line(StartPoint=mirror_3.Geometry, EndPoint=mirror_2.Geometry)
entwine = Entwine(Branch00=dup, Branch01=pt_2, Branch02=pt_4, Branch03=mirror.Geometry, Branch04=mirror_2.Geometry, FlattenInputs=True)
flip = FlipMatrix(Data=entwine)
intcrv = Interpolate(Vertices=flip, Degree=3, Periodic=False, KnotStyle=1)  # -> Curve, Length, Domain
merge = Merge(Data1=simplify(graft(ln)), Data2=simplify(graft(ln_2)), Data3=simplify(graft(ln_3)), Data4=simplify(intcrv.Curve))
join = JoinCurves(Curves=merge, Preserve=False)  # -> flatten(Curves)
crv = Curve(join)
crv_2 = ClusterOutput(crv)

# ==== cluster InclusionMesh
srf = ClusterInput()
srf_2 = Surface(srf)
offset = Offset(Surface=srf_2, Distance=[0.01, -0.01], Retrim=True)
edges = BrepEdges(Brep=offset)  # -> Naked, Interior, NonManifold
join = JoinCurves(Curves=edges.Naked, Preserve=False)
trim = TrimTree(Tree=join, Depth=2)
loft = Loft(Curves=trim, Options={Adjust=False, Closed=False, LoftEnds=0, LoftSimp=0, LoftType=0, Rebuild=10, Refit=0.01})
join_2 = BrepJoin(Breps=flatten([loft, offset]))  # -> Breps, Closed
mesh = Mesh(join_2.Breps)
mesh_2 = ClusterOutput(mesh)

# ==== cluster InclusionMesh_2
srf = ClusterInput()
srf_2 = Surface(srf)
offset = Offset(Surface=srf_2, Distance=[0.005, -0.005], Retrim=True)
edges = BrepEdges(Brep=offset)  # -> Naked, Interior, NonManifold
join = JoinCurves(Curves=edges.Naked, Preserve=False)
trim = TrimTree(Tree=join, Depth=2)
loft = Loft(Curves=trim, Options={Adjust=False, Closed=False, LoftEnds=0, LoftSimp=0, LoftType=0, Rebuild=10, Refit=0.01})
join_2 = BrepJoin(Breps=flatten([loft, offset]))  # -> Breps, Closed
mesh = Mesh(join_2.Breps)
mesh_2 = ClusterOutput(mesh)

# ==== cluster InclusionMesh_3
neg = Negative(Value="0.015")
Z = UnitZ(Factor=["0.015", neg])
srf = ClusterInput()
srf_2 = Surface(srf)
move = Move(Geometry=srf_2, Motion=Z)  # -> Geometry, Transform
edges = BrepEdges(Brep=move.Geometry)  # -> Naked, Interior, NonManifold
join = JoinCurves(Curves=edges.Naked, Preserve=False)
trim = TrimTree(Tree=join, Depth=2)
loft = Loft(Curves=trim, Options={Adjust=False, Closed=False, LoftEnds=0, LoftSimp=0, LoftType=0, Rebuild=10, Refit=0.01})
join_2 = BrepJoin(Breps=flatten([loft, move.Geometry]))  # -> Breps, Closed
mesh = Mesh(join_2.Breps)
mesh_2 = ClusterOutput(mesh)
