# Grasshopper definition GURRAS_TESTFIL.gh (Grasshopper 0.9.76)
# plug-ins: Karamba, MiStrAn

number_slider = Slider(1, range=0..1)
pt = Point(Point(6.187004391, 14.76879502, 0))
rotate = Rotate(Center=Point(0, 0, 0), From=Vector(1, 0, 0), To=Vector(0, 1, 0))  # -> Geometry, Transform
vec = VectorXYZ(XComponent=number_slider, YComponent=number_slider, ZComponent=number_slider)  # -> Vector, Length
xy = XYPlane(Origin=Point(0, 0, 0))
number_slider_2 = Slider(1, range=0..1)
number_slider_3 = Slider(10, range=0..10)
number_slider_4 = Slider(1, range=0..10)
xz = XZPlane(Origin=Point(0, 0, 0))
pl = ConstructPlane(Origin=pt, XAxis=vec.Vector, YAxis=Vector(0, 1, 0))
prot = RotatePlane(Plane=xz, Angle=Slider(0.785, range=0..1))
pln = Plane(pl)
dom = ConstructDomain(DomainStart=expr("-x/2", number_slider_3), DomainEnd=expr("x/2", number_slider_3))
dom_2 = ConstructDomain(DomainStart=expr("-x/2", number_slider_4), DomainEnd=expr("x/2", number_slider_4))
number_slider_5 = Slider(3000, range=0..10000)
number_slider_6 = Slider(1000000, range=0..10000000)
number_slider_7 = Slider(10, range=0..10)
number_slider_8 = Slider(6, range=0..10)
number_slider_9 = Slider(90, range=0..100)
addition = Addition(A=number_slider_8, B=1)
planesrf = PlaneSurface(Plane=pln, XSize=dom, YSize=dom_2)
rectangle = Rectangle(Plane=pln, XSize=dom, YSize=dom_2, Radius=0)  # -> Rectangle, Length
division = Division(A=Slider(10000, range=0..10000), B=addition)
deplane = DeconstructPlane(Plane=pln)  # -> Origin, XAxis, YAxis, ZAxis
srf = Surface(planesrf)
repeat = RepeatData(Data=division, Length=addition)
mplane = MeshPlane(Boundary=rectangle.Rectangle, WidthCount=number_slider_9, HeightCount=number_slider_8)  # -> Mesh, Area
number_slider_10 = Slider(0, range=0..1)
sdivide = DivideSurface(Surface=srf, UCount=number_slider_9, VCount=number_slider_8)  # -> simplify(Points), Normals, Parameters
tstat = TreeStatistics(Tree=sdivide.Points)  # -> Paths, Length, Count
tri = Triangulate(Mesh=mplane.Mesh)  # -> Mesh, Count
item = ListItem(List=tstat.Paths, Index=0, Wrap=True)  # -> Item1, Item
del = DelaunayMesh(Points=flatten(sdivide.Points), Plane=pln)
demesh = DeconstructMesh(Mesh=tri.Mesh)  # -> Vertices, Faces, Colours, Normals
points = PointList(Points=demesh.Vertices, Size=Slider(0.1, range=0..1))
Z = UnitZ(Factor=-1)
branch = TreeBranch(Tree=simplify(sdivide.Points), Path=item.Item, MaintainPaths=True)  # -> flatten(Branch)
branch_2 = TreeBranch(Tree=simplify(sdivide.Points), Path=item.Item1, MaintainPaths=True)  # -> flatten(Branch)
multiplication = Multiplication(A=deplane.ZAxis, B=repeat)
medges = MeshEdges(Mesh=tri.Mesh)  # -> NakedEdges, InteriorEdges, NonManifoldEdges
panel = Panel(multiplication)
vdis = VectorDisplay(Anchor=branch_2, Vector=unitize(multiplication))
panel_2 = Panel("""false
true
false
false
false
false""")
mistran = MiStrAn(Run=Toggle(False), Mesh=tri.Mesh, BC=branch, LoadPoints=branch_2, LoadVectors=multiplication)  # -> Displacements, Reactions
panel_3 = Panel("""true
false
false
false
false
false""")
panel_4 = Panel("""false
false
true
false
false
false""")
license = LicenseKaramba()
item_2 = ListItem(List=mistran.Displacements, Index=Slider(1215, range=0..10000), Wrap=True)
panel_5 = Panel("""false
false
false
false
false
true""")
panel_6 = Panel("""false
false
false
false
true
false""")
panel_7 = Panel("""false
false
false
true
false
false""")
cull = CullPattern(List=mistran.Displacements, CullPattern=panel_3)
cull_2 = CullPattern(List=mistran.Displacements, CullPattern=panel_2)
cull_3 = CullPattern(List=mistran.Displacements, CullPattern=panel_4)
panel_8 = Panel(cull)
vec_2 = VectorXYZ(XComponent=cull, YComponent=cull_2, ZComponent=cull_3)  # -> Vector, Length
panel_9 = Panel(item_2)
vlen = VectorLength(Vector=vec_2.Vector)
multiplication_2 = Multiplication(A=cull_2, B=1000)
cull_4 = CullPattern(List=mistran.Displacements, CullPattern=panel_7)
multiplication_3 = Multiplication(A=cull_4, B=1000)
cull_5 = CullPattern(List=mistran.Displacements, CullPattern=panel_6)
cull_6 = CullPattern(List=mistran.Displacements, CullPattern=panel_5)
sort = SortList(Keys=vlen)  # -> Keys, ValuesA
multiplication_4 = Multiplication(A=multiplication_2, B=4)
multiplication_5 = Multiplication(A=cull_5, B=1000)
item_3 = ListItem(List=sort.Keys, Index=0, Wrap=True)  # -> Item1, Item
yy = Panel(multiplication_5)
zz = Panel(cull_6)
Z_2 = Panel(cull_3)
xx = Panel(multiplication_3)
panel_10 = Panel(item_3.Item1)
panel_11 = Panel(mistran.Reactions)
Y = Panel(multiplication_2)
panel_12 = Panel(mistran.Displacements)
