# Grasshopper definition GURRAS_TESTFIL_Mistran_Karamba_compare.gh (Grasshopper 0.9.76)
# plug-ins: Karamba, MiStrAn

xy = XYPlane(Origin=Point(0, 0, 0))
number_slider = Slider(0.785, range=0..1)
number_slider_2 = Slider(1, range=0..1)
number_slider_3 = Slider(10, range=0..10)
number_slider_4 = Slider(1, range=0..10)
xz = XZPlane(Origin=Point(0, 0, 0))
pln = Plane(xy)
dom = ConstructDomain(DomainStart=expr("-x/2", number_slider_3), DomainEnd=expr("x/2", number_slider_3))
dom_2 = ConstructDomain(DomainStart=expr("-x/2", number_slider_4), DomainEnd=expr("x/2", number_slider_4))
number_slider_5 = Slider(3000, range=0..10000)
number_slider_6 = Slider(1000000, range=0..10000000)
number_slider_7 = Slider(100, range=0..1000)
number_slider_8 = Slider(10, range=0..100)
addition = Addition(A=number_slider_8, B=1)
planesrf = PlaneSurface(Plane=pln, XSize=dom, YSize=dom_2)
rectangle = Rectangle(Plane=pln, XSize=dom, YSize=dom_2, Radius=0)  # -> Rectangle, Length
number_slider_9 = Slider(2000, range=0..2000)
division = Division(A=Slider(10000, range=0..10000), B=addition)
deplane = DeconstructPlane(Plane=pln)  # -> Origin, XAxis, YAxis, ZAxis
srf = Surface(planesrf)
repeat = RepeatData(Data=division, Length=addition)
mplane = MeshPlane(Boundary=rectangle.Rectangle, WidthCount=number_slider_7, HeightCount=number_slider_8)  # -> Mesh, Area
number_slider_10 = Slider(0, range=0..1)
sdivide = DivideSurface(Surface=srf, UCount=number_slider_7, VCount=number_slider_8)  # -> simplify(Points), Normals, Parameters
tstat = TreeStatistics(Tree=sdivide.Points)  # -> Paths, Length, Count
X = UnitX(Factor=number_slider_9)
Z = UnitZ(Factor=number_slider_9)
tri = Triangulate(Mesh=mplane.Mesh)  # -> Mesh, Count
mesh = Mesh(tri.Mesh)
medges = MeshEdges(Mesh=mesh)  # -> NakedEdges, InteriorEdges, NonManifoldEdges
demesh = DeconstructMesh(Mesh=mesh)  # -> Vertices, Faces, Colours, Normals
item = ListItem(List=tstat.Paths, Index=0, Wrap=True)  # -> Item1, Item
meshtoshell = MeshToShellKaramba(Point=demesh.Vertices, Mesh=mesh, LDist=0.005)  # -> Point, Element, Info
demesh_2 = DeconstructMesh(Mesh=tri.Mesh)  # -> Vertices, Faces, Colours, Normals
points = PointList(Points=demesh_2.Vertices, Size=Slider(0.1, range=0..1))
Z_2 = UnitZ(Factor=-1)
branch = TreeBranch(Tree=simplify(sdivide.Points), Path=item.Item, MaintainPaths=True)  # -> flatten(Branch)
bc_points = Point(branch)
cp = ClosestPoint(Point=bc_points, Cloud=demesh.Vertices)  # -> ClosestPoint, CPIndex, Distance
supp = SupportKaramba(PosInd=cp.CPIndex, menu=[buttons(on, on, on, on, on, on)])
branch_2 = TreeBranch(Tree=simplify(sdivide.Points), Path=item.Item1, MaintainPaths=True)  # -> flatten(Branch)
load_pts = Point(branch_2)
cp_2 = ClosestPoint(Point=load_pts, Cloud=demesh.Vertices)  # -> ClosestPoint, CPIndex, Distance
multiplication = Multiplication(A=deplane.XAxis, B=repeat)
force_vecs = Vector(multiplication)
division_2 = Division(A=force_vecs, B=1000)
loads = LoadsKaramba(ForceVector=division_2, Local=False, PosInd=cp_2.CPIndex, LCase=0, mode="Point")
number_slider_11 = Slider(9, range=0..10)
index = ItemIndex(List=meshtoshell.Point, Item=meshtoshell.Point)
matprops = MaterialPropertiesKaramba(
    ElementsIdentifiers=index,
    YoungsModulus_kN_cm2=21000,
    ShearModulus_kN_cm2=8076,
    SpecificWeight_kN_m3=Slider(0, range=0..100),
    CoefficientOfThermalExpansion_1_C=1e-05,
    YieldStrength_kN_cm2=Slider(500, range=0..1000),
    Name="S235")
medges_2 = MeshEdges(Mesh=tri.Mesh)  # -> NakedEdges, InteriorEdges, NonManifoldEdges
panel = Panel(multiplication)
vdis = VectorDisplay(Anchor=branch_2, Vector=unitize(multiplication))
panel_2 = Panel("""false
true
false
false
false
false""")
mistran = MiStrAn(Run=Toggle(True), Mesh=tri.Mesh, BC=branch, LoadPoints=branch_2, LoadVectors=multiplication, UseExactSolverMethod=False)  # -> Displacements, Reactions, Reactions_2, DeformedMesh
panel_3 = Panel("""true
false
false
false
false
false""")
panel_4 = Panel("""false
false
true
false
false
false""")
cross_sections = CrossSectionsKaramba(Heights_cm=Slider(10, range=0..10), mode="Shell")
assemble = AssembleModelKaramba(
    Point=meshtoshell.Point,
    Elem=meshtoshell.Element,
    Support=supp,
    Load=loads,
    CrossSection=cross_sections,
    Material=matprops,
    LimitDistance_m=0.005)  # -> Model, Info, Mass_kg, CenterOfGravity
analyzethi = AnalyzeThIKaramba(Model=assemble.Model)  # -> CalculatedModel, MaximumDisplacement_m, ResultingForceOfGravity_kN, ElasticEnergy_kNm
license = LicenseKaramba()
vlen = VectorLength(Vector=mistran.Displacements)
nodedisp = NodalDisplacementsKaramba(AnalyzedModel=analyzethi.CalculatedModel)  # -> AnalyzedModel, NodalTranslations_m, NodalRotations_rad
item_2 = ListItem(List=mistran.Displacements, Index=Slider(1215, range=0..10000), Wrap=True)
panel_5 = Panel("""false
false
false
false
false
true""")
panel_6 = Panel("""false
false
false
false
true
false""")
panel_7 = Panel("""false
false
false
true
false
false""")
sort = SortList(Keys=vlen)  # -> Keys, ValuesA
cull = CullPattern(List=mistran.Displacements, CullPattern=panel_3)
cull_2 = CullPattern(List=mistran.Displacements, CullPattern=panel_2)
cull_3 = CullPattern(List=mistran.Displacements, CullPattern=panel_4)
multiplication_2 = Multiplication(A=nodedisp.NodalTranslations_m, B=1000)
panel_8 = Panel(cull)
vec = VectorXYZ(XComponent=cull, YComponent=cull_2, ZComponent=cull_3)  # -> Vector, Length
panel_9 = Panel(item_2)
modelview = ModelViewKaramba(Model=nodedisp.AnalyzedModel, LoadCaseFactorsForLinearSuperposition=1, IndexIncrementOfVisibleLoadcase=0)  # -> Model, DeformedMesh, DeformedAxes, DeformedModel
vlen_2 = VectorLength(Vector=vec.Vector)
multiplication_3 = Multiplication(A=cull_2, B=1000)
cull_4 = CullPattern(List=mistran.Displacements, CullPattern=panel_7)
multiplication_4 = Multiplication(A=cull_4, B=1000)
cull_5 = CullPattern(List=mistran.Displacements, CullPattern=panel_6)
cull_6 = CullPattern(List=mistran.Displacements, CullPattern=panel_5)
sort_2 = SortList(Keys=vlen_2)  # -> Keys, ValuesA
multiplication_5 = Multiplication(A=multiplication_3, B=4)
multiplication_6 = Multiplication(A=cull_5, B=1000)
item_3 = ListItem(List=sort_2.Keys, Index=0, Wrap=True)  # -> Item1, Item
panel_10 = Panel(multiplication_2)
yy = Panel(multiplication_6)
zz = Panel(cull_6)
Z_3 = Panel(cull_3)
xx = Panel(multiplication_4)
panel_11 = Panel(item_3.Item1)
panel_12 = Panel(mistran.Reactions)
Y = Panel(multiplication_3)
panel_13 = Panel(mistran.Displacements)
