# Grasshopper definition GURRAS_TESTFIL_SIMPLETEST.gh (Grasshopper 0.9.76)
# plug-ins: Karamba, MiStrAnGH

number_slider = Slider(1, range=0..1)
pt = Point(Point(6.187004391, 14.76879502, 0))
rotate = Rotate(Center=Point(0, 0, 0), From=Vector(1, 0, 0), To=Vector(0, 1, 0))  # -> Geometry, Transform
vec = VectorXYZ(XComponent=number_slider, YComponent=number_slider, ZComponent=number_slider)  # -> Vector, Length
xy = XYPlane(Origin=Point(0, 0, 0))
xz = XZPlane(Origin=Point(0, 0, 0))
number_slider_2 = Slider(1, range=0..1)
number_slider_3 = Slider(10, range=0..10)
number_slider_4 = Slider(1, range=0..10)
pl = ConstructPlane(Origin=pt, XAxis=vec.Vector, YAxis=Vector(0, 1, 0))
prot = RotatePlane(Plane=xz, Angle=Slider(0.785, range=0..1))
pln = Plane(xy)
dom = ConstructDomain(DomainStart=expr("-x/2", number_slider_3), DomainEnd=expr("x/2", number_slider_3))
dom_2 = ConstructDomain(DomainStart=expr("-x/2", number_slider_4), DomainEnd=expr("x/2", number_slider_4))
number_slider_5 = Slider(3000, range=0..10000)
number_slider_6 = Slider(1000000, range=0..10000000)
number_slider_7 = Slider(40, range=0..1000)
number_slider_8 = Slider(4, range=0..10)
addition = Addition(A=number_slider_8, B=1)
planesrf = PlaneSurface(Plane=pln, XSize=dom, YSize=dom_2)
rectangle = Rectangle(Plane=pln, XSize=dom, YSize=dom_2, Radius=0)  # -> Rectangle, Length
number_slider_9 = Slider(2000, range=0..2000)
division = Division(A=Slider(10000, range=0..10000), B=addition)
deplane = DeconstructPlane(Plane=pln)  # -> Origin, XAxis, YAxis, ZAxis
srf = Surface(planesrf)
repeat = RepeatData(Data=division, Length=addition)
mplane = MeshPlane(Boundary=rectangle.Rectangle, WidthCount=number_slider_7, HeightCount=number_slider_8)  # -> Mesh, Area
number_slider_10 = Slider(0, range=0..100)
number_slider_11 = Slider(0, range=0..1)
sdivide = DivideSurface(Surface=srf, UCount=number_slider_7, VCount=number_slider_8)  # -> simplify(Points), Normals, Parameters
tstat = TreeStatistics(Tree=sdivide.Points)  # -> Paths, Length, Count
tri = Triangulate(Mesh=mplane.Mesh)  # -> Mesh, Count
mesh = Mesh(tri.Mesh)
medges = MeshEdges(Mesh=mesh)  # -> NakedEdges, InteriorEdges, NonManifoldEdges
demesh = DeconstructMesh(Mesh=mesh)  # -> Vertices, Faces, Colours, Normals
X = UnitX(Factor=number_slider_9)
Z = UnitZ(Factor=number_slider_9)
item = ListItem(List=tstat.Paths, Index=0, Wrap=True)  # -> Item1, Item
meshtoshell = MeshToShellKaramba(Point=demesh.Vertices, Mesh=mesh, LDist=0.005)  # -> Point, Element, Info
demesh_2 = DeconstructMesh(Mesh=tri.Mesh)  # -> Vertices, Faces, Colours, Normals
points = PointList(Points=demesh_2.Vertices, Size=Slider(0.1, range=0..1))
Z_2 = UnitZ(Factor=-1)
branch = TreeBranch(Tree=simplify(sdivide.Points), Path=item.Item, MaintainPaths=True)  # -> flatten(Branch)
bc_points = Point(branch)
cp = ClosestPoint(Point=bc_points, Cloud=demesh.Vertices)  # -> ClosestPoint, CPIndex, Distance
supp = SupportKaramba(PosInd=cp.CPIndex, menu=[buttons(on, on, on, on, on, on)])
branch_2 = TreeBranch(Tree=simplify(sdivide.Points), Path=item.Item1, MaintainPaths=True)  # -> flatten(Branch)
multiplication = Multiplication(A=deplane.ZAxis, B=repeat)
force_vecs = Vector(multiplication)
division_2 = Division(A=force_vecs, B=1000)
index = ItemIndex(List=meshtoshell.Point, Item=meshtoshell.Point)
demesh_3 = DeconstructMesh(Mesh=tri.Mesh)  # -> Vertices, Faces, Colours, Normals
division_3 = Division(A=Slider(76596, range=0..100000), B=1000)
pointload = MiStrAnPointload(Point=branch_2, ForceVector=multiplication)
loads = LoadsKaramba(Vector=Vector(0, 0, -1), LCase=0, mode="Gravity")
number_slider_12 = Slider(9, range=0..10)
medges_2 = MeshEdges(Mesh=tri.Mesh)  # -> NakedEdges, InteriorEdges, NonManifoldEdges
toggle = BooleanToggle(True)
panel = Panel(multiplication)
matprops = MaterialPropertiesKaramba(
    ElementsIdentifiers=index,
    YoungsModulus_kN_cm2=21000,
    ShearModulus_kN_cm2=8076,
    SpecificWeight_kN_m3=division_3,
    CoefficientOfThermalExpansion_1_C=1e-05,
    YieldStrength_kN_cm2=Slider(500, range=0..1000),
    Name="S235")
division_4 = Division(A=division_3, B=9.81)
support = CreateSupport(
    Point=branch,
    SupportInXDirection=True,
    SupportInYDirection=True,
    SupportInZDirection=True,
    SupportInXXDirection=True,
    SupportInYYDirection=True,
    SupportInZZDirection=True)
gravity = MiStrAnGravityLoad()
vdis = VectorDisplay(Anchor=branch_2, Vector=unitize(multiplication))
index_2 = ItemIndex(List=demesh_3.Faces, Item=demesh_3.Faces)
section = Section(IndexesOfFaces=index_2, LaminaThickness=Slider(0.1, range=0..0.1))
facen = FaceNormals(Mesh=tri.Mesh)  # -> Centers, Normals
assemble = MiStrAnAssembleStructure(Mesh=tri.Mesh, MiStrAnSupports=support, MiStrAnLoads=gravity, GeneratedSection=section)
cross_sections = CrossSectionsKaramba(Heights_cm=Slider(10, range=0..10), mode="Shell")
assemble_2 = AssembleModelKaramba(
    Point=meshtoshell.Point,
    Elem=meshtoshell.Element,
    Support=supp,
    Load=loads,
    CrossSection=cross_sections,
    Material=matprops,
    LimitDistance_m=0.005)  # -> Model, Info, Mass_kg, CenterOfGravity
analyzethi = AnalyzeThIKaramba(Model=assemble_2.Model)  # -> CalculatedModel, MaximumDisplacement_m, ResultingForceOfGravity_kN, ElasticEnergy_kNm
license = LicenseKaramba()
analyse = MiStrAnAnalyseStructure(Run=Toggle(False), MiStrAnStructure=assemble)  # -> Displacements, Rotations, Reactions, DeformedMesh, PrincipalStresses
nodedisp = NodalDisplacementsKaramba(AnalyzedModel=analyzethi.CalculatedModel)  # -> AnalyzedModel, NodalTranslations_m, NodalRotations_rad
multiplication_2 = Multiplication(A=nodedisp.NodalTranslations_m, B=1000)
Z_3 = UnitZ(Factor="7659.6")
division_5 = Division(A=Z_3, B=1000)
distload = MiStrAnDistributedLoad(CenterPoint=facen.Centers, ForceVector=Z_3)
vlen = VectorLength(Vector=analyse.Displacements)
sort = SortList(Keys=vlen)  # -> Keys, ValuesA
item_2 = ListItem(List=sort.Keys, Index=0, Wrap=True)  # -> Item1, Item
devec = DeconstructVector(Vector=analyse.Displacements)  # -> XComponent, YComponent, ZComponent
modelview = ModelViewKaramba(Model=nodedisp.AnalyzedModel, LoadCaseFactorsForLinearSuperposition=1, IndexIncrementOfVisibleLoadcase=0)  # -> Model, DeformedMesh, DeformedAxes, DeformedModel
devec_2 = DeconstructVector(Vector=nodedisp.NodalTranslations_m)  # -> XComponent, YComponent, ZComponent
panel_2 = Panel(item_2.Item1)
panel_3 = Panel(devec.ZComponent)
panel_4 = Panel(devec_2.ZComponent)
