# Grasshopper definition GravityBeam.gh (Grasshopper 0.9.76)
# plug-ins: Karamba, MiStrAnGH

xy = XYPlane(Origin=Point(0, 0, 0))
number_slider = Slider(1, range=0..1)
number_slider_2 = Slider(10, range=0..100)
number_slider_3 = Slider(1, range=0..10)
yz = YZPlane(Origin=Point(0, 0, 0))
X = UnitX(Factor=1)
pln = Plane(xy)
Z = UnitZ(Factor=0.5)
dom = ConstructDomain(DomainStart=expr("-x/2", number_slider_2), DomainEnd=expr("x/2", number_slider_2))
dom_2 = ConstructDomain(DomainStart=expr("-x/2", number_slider_3), DomainEnd=expr("x/2", number_slider_3))
number_slider_4 = Slider(40, range=0..160)
number_slider_5 = Slider(4, range=0..1000)
planesrf = PlaneSurface(Plane=pln, XSize=dom, YSize=dom_2)
rectangle = Rectangle(Plane=pln, XSize=dom, YSize=dom_2, Radius=0)  # -> Rectangle, Length
srf = Surface(planesrf)
rotate = Rotate(Geometry=srf, Angle=1.570796327, Plane=yz)  # -> Geometry, Transform
move = Move(Geometry=srf, Motion=srf)  # -> Geometry, Transform
move_2 = Move(Geometry=rotate.Geometry, Motion=Z)  # -> Geometry, Transform
sdivide = DivideSurface(Surface=move.Geometry, UCount=number_slider_4, VCount=number_slider_5)  # -> simplify(Points), Normals, Parameters
sdivide_2 = DivideSurface(Surface=move_2.Geometry, UCount=number_slider_4, VCount=number_slider_5)  # -> simplify(Points), Normals, Parameters
tstat = TreeStatistics(Tree=sdivide_2.Points)  # -> Paths, Length, Count
tstat_2 = TreeStatistics(Tree=sdivide.Points)  # -> Paths, Length, Count
mplane = MeshPlane(Boundary=rectangle.Rectangle, WidthCount=number_slider_4, HeightCount=number_slider_5)  # -> Mesh, Area
item = ListItem(List=tstat.Paths, Index=0, Wrap=True)  # -> Item1, Item
series = Series(Start=0, Step=1, Count=number_slider_4)
Z_2 = UnitZ(Factor=1)
tri = Triangulate(Mesh=mplane.Mesh)  # -> Mesh, Count
sdivide_3 = DivideSurface(Surface=srf, UCount=number_slider_4, VCount=number_slider_5)  # -> simplify(Points), Normals, Parameters
tstat_3 = TreeStatistics(Tree=sdivide_3.Points)  # -> Paths, Length, Count
yz_2 = YZPlane(Origin=Point(0, 0, 0))
item_2 = ListItem(List=tstat_2.Paths, Index=0, Wrap=True)  # -> Item1, Item
branch = TreeBranch(Tree=simplify(sdivide_2.Points), Path=series, MaintainPaths=True)
item_3 = ListItem(List=tstat_3.Paths, Index=0, Wrap=True)  # -> Item1, Item
division = Division(A=number_slider_4, B=2)
Z_3 = UnitZ(Factor=0.5)
rotate_2 = Rotate(Geometry=tri.Mesh, Angle=1.570796327, Plane=yz_2)  # -> Geometry, Transform
item_4 = ListItem(List=branch, Index=0, Wrap=True)  # -> Item1, Item
branch_2 = TreeBranch(Tree=simplify(sdivide.Points), Path=item_2.Item, MaintainPaths=True)  # -> flatten(Branch)
branch_3 = TreeBranch(Tree=simplify(sdivide_2.Points), Path=item.Item, MaintainPaths=True)  # -> flatten(Branch)
branch_4 = TreeBranch(Tree=simplify(sdivide_3.Points), Path=item_3.Item, MaintainPaths=True)  # -> flatten(Branch)
branch_5 = TreeBranch(Tree=simplify(sdivide.Points), Path=division, MaintainPaths=True)  # -> flatten(Branch)
move_3 = Move(Geometry=tri.Mesh, Motion=Z_2)  # -> Geometry, Transform
move_4 = Move(Geometry=rotate_2.Geometry, Motion=Z_3)  # -> Geometry, Transform
pt = Point(flatten(item_4.Item1))
branch_6 = TreeBranch(Tree=simplify(sdivide_3.Points), Path=item_2.Item1, MaintainPaths=True)
item_5 = ListItem(List=branch_3, Index=0, Wrap=True)  # -> Item1, Item
item_6 = ListItem(List=branch_4, Index=0, Wrap=True)  # -> Item1, Item
item_7 = ListItem(List=branch_2, Index=0, Wrap=True)  # -> Item1, Item
mjoin = MeshJoin(Meshes=[move_4.Geometry, move_3.Geometry, tri.Mesh])
v = Panel("""0.27
0.19
0.27
0.19
0.27""")
gxy = Panel("""7.2
5.5
7.2
5.5
7.2""")
demesh = DeconstructMesh(Mesh=mjoin)  # -> Vertices, Faces, Colours, Normals
Z_4 = UnitZ(Factor=Slider(5, range=0..100))
pt_2 = Point(branch_5)
pt_3 = Point([item_6.Item1, item_6.Item, item_7.Item1, item_7.Item, item_5.Item1, item_5.Item])
toggle = BooleanToggle(False)
panel = Panel("""45
-45
90
-45
45""")
panel_2 = Panel("""0
0
0
0
0""")
number_slider_6 = Slider(4, range=0..10)
ey = Panel("""10.3
12
10.3
12
10.3""")
multiplication = Multiplication(A=Z_4, B=-1)
number_slider_7 = Slider(10, range=0..22)
ex = Panel("""142
45
142
45
142""")
support = CreateSupport(
    Point=branch_4,
    SupportInXDirection=True,
    SupportInYDirection=True,
    SupportInZDirection=True,
    SupportInXXDirection=True,
    SupportInYYDirection=True,
    SupportInZZDirection=True)
support_2 = CreateSupport(
    Point=branch_6,
    SupportInXDirection=toggle,
    SupportInYDirection=toggle,
    SupportInZDirection=True,
    SupportInXXDirection=True,
    SupportInYYDirection=True,
    SupportInZZDirection=True)
t = Panel("""1
2
1
2
1""")
pointload = MiStrAnPointload(Point=pt, ForceVector_kN=multiplication)
gravity = MiStrAnGravityLoad()
deface = DeconstructFace(Face=demesh.Faces)  # -> CornerA, CornerB, CornerC, CornerD
cullpt = CullDuplicates(Points=demesh.Vertices, Tolerance=1e-06, CullMode=3)  # -> Points, Indices, Valence
Z_5 = UnitZ(Factor=Slider(-5, range=-10..10))
division_2 = Division(A=number_slider_7, B=10)
supp = SupportKaramba(PosInd=branch_4, menu=[buttons(on, on, on, on, on, on)])
item_8 = ListItem(List=demesh.Vertices, Index=deface.CornerA, Wrap=True)
supp_2 = SupportKaramba(PosInd=branch_6, menu=[buttons(off, off, on, on, on, on)])
item_9 = ListItem(List=demesh.Vertices, Index=deface.CornerB, Wrap=True)
item_10 = ListItem(List=demesh.Vertices, Index=deface.CornerC, Wrap=True)
section = Section(
    EModulusInLongitudinalDirection_GPa=ex,
    EModulusInTransverseDirection_GPA=ey,
    LongitudinalShearModulus_GPA=gxy,
    PoissonsRatio=v,
    LaminaThickness_mm=t,
    Angles_degree=simplify(panel_2),
    Density_kg_m_3=7800)  # -> flatten(Generated)
section_2 = Section(
    EModulusInLongitudinalDirection_GPa=210,
    EModulusInTransverseDirection_GPA=210,
    LongitudinalShearModulus_GPA=79.3,
    PoissonsRatio=0.3,
    LaminaThickness_mm=number_slider_7,
    Angles_degree=0,
    Density_kg_m_3=7800)
cross_sections = CrossSectionsKaramba(Heights_cm=division_2, mode="Shell")
cp = ClosestPoint(Point=item_8, Cloud=cullpt.Points)  # -> ClosestPoint, CPIndex, Distance
cp_2 = ClosestPoint(Point=item_10, Cloud=cullpt.Points)  # -> ClosestPoint, CPIndex, Distance
cp_3 = ClosestPoint(Point=item_9, Cloud=cullpt.Points)  # -> ClosestPoint, CPIndex, Distance
loads = LoadsKaramba(ForceVector=multiplication, Local=False, PosInd=pt, LCase=0, mode="Point")
loads_2 = LoadsKaramba(Vector=Vector(0, 0, -1), LCase=0, mode="Gravity")
matprops = MaterialPropertiesKaramba(
    YoungsModulus_kN_cm2=21000,
    ShearModulus_kN_cm2=Slider(7930, range=0..10000),
    SpecificWeight_kN_m3=Slider(78, range=0..100),
    CoefficientOfThermalExpansion_1_C=1e-05,
    YieldStrength_kN_cm2=23.5,
    Name="S235")
triangle = MeshTriangle(CornerA=cp.CPIndex, CornerB=cp_3.CPIndex, CornerC=cp_2.CPIndex)
conmesh = ConstructMesh(Vertices=cullpt.Points, Faces=triangle)
element_vectors = ElementVectors(mesh=conmesh)  # -> V, V_2, V_3
v3 = Vector(element_vectors.V_3)
v1 = Vector(element_vectors.V)
v2 = Vector(element_vectors.V_2)
angle = Angle(VectorA=v1, VectorB=X)  # -> Angle, Reflex
deg = Degrees(Radians=angle.Angle)
panel_3 = Panel(deg)  # disabled
subtraction = Subtraction(B=graft(deg))
panel_4 = Panel(subtraction)
facen = FaceNormals(Mesh=conmesh)  # -> Centers, Normals
medges = MeshEdges(Mesh=conmesh)  # -> NakedEdges, InteriorEdges, NonManifoldEdges
loads_3 = LoadsKaramba(Vector=Z_5, Mesh=conmesh, LCase=0, mode="Mesh Load", menu=[buttons(off, on, off), buttons(on, on)])
distload = MiStrAnDistributedLoad(CenterPoint=facen.Centers, ForceVector_kN=Z_5)
meshtoshell = MeshToShellKaramba(Mesh=conmesh, LDist=0.005)  # -> Point, Element, Info
assemble = MiStrAnAssembleStructure(Mesh=conmesh, MiStrAnSupports=flatten([support, support_2]), MiStrAnLoads=gravity, GeneratedSection=section_2)
analyse = MiStrAnAnalyseStructure(Run=Toggle(False), MiStrAnStructure=assemble)  # -> AnalysedStructure, Displacements, Rotations, Reactions, PrincipalStresses, PrincipalStressAngles, VonMisesStresses
assemble_2 = AssembleModelKaramba(
    Elem=meshtoshell.Element,
    Support=flatten([supp, supp_2]),
    Load=loads_2,
    CrossSection=cross_sections,
    Material=matprops,
    LimitDistance_m=0.005)  # -> Model, Info, Mass_kg, CenterOfGravity
number_slider_8 = Slider(3, range=0..1000)
vlen = VectorLength(Vector=analyse.PrincipalStresses)
panel_5 = Panel(vlen)
devec = DeconstructVector(Vector=analyse.PrincipalStresses)  # -> XComponent, YComponent, ZComponent
devec_2 = DeconstructVector(Vector=analyse.Displacements)  # -> XComponent, YComponent, ZComponent
analyzethi = AnalyzeThIKaramba(Model=assemble_2.Model)  # -> CalculatedModel, MaximumDisplacement_m, ResultingForceOfGravity_kN, ElasticEnergy_kNm
multiplication_2 = Multiplication(A=devec_2.YComponent, B=10000)
panel_6 = Panel(multiplication_2)
division_3 = Division(A=devec.XComponent, B=Slider(100, range=0..100))
modelview = ModelViewKaramba(Model=analyzethi.CalculatedModel, LoadCaseFactorsForLinearSuperposition=1, IndexIncrementOfVisibleLoadcase=0)  # -> Model, DeformedMesh, DeformedAxes, DeformedModel
c_script = CSharpScript(x=division_3)  # -> out, A; inputs x: list of Double
# ---------- c_script: C# ----------
    double outD = 0;
    foreach(double d in x)
    {
      if(d > outD)
        outD = d;
    }

    A = outD;
# ---------- end c_script ----------
multiplication_3 = Multiplication(A=devec_2.ZComponent, B=1)
nodedisp = NodalDisplacementsKaramba(AnalyzedModel=analyzethi.CalculatedModel)  # -> AnalyzedModel, NodalTranslations_m, NodalRotations_rad
visres = VisualiseResults(Structure=analyse.AnalysedStructure, ScaleDeformation=Slider(1, range=0..100), BottomLimiter=0, TopLimiter=1)  # -> DeformedMesh, VonMisesStressPlot
panel_7 = Panel(multiplication_3)
mesh = Mesh(visres.DeformedMesh)
mesh_2 = Mesh(modelview.DeformedMesh)
devec_3 = DeconstructVector(Vector=nodedisp.NodalTranslations_m)  # -> XComponent, YComponent, ZComponent
medges_2 = MeshEdges(Mesh=mesh)  # -> NakedEdges, InteriorEdges, NonManifoldEdges
panel_8 = Panel(c_script.A)
sort = SortList(Keys=devec_2.ZComponent)  # -> Keys, ValuesA
sort_2 = SortList(Keys=devec_3.ZComponent)  # -> Keys, ValuesA
structure = MiStrAnStructure(assemble)
number_slider_9 = Slider(400, range=0..1000)
number_slider_10 = Slider(4002, range=0..10000)
item_11 = ListItem(List=sort.Keys, Index=0, Wrap=True)  # -> Item1, Item
item_12 = ListItem(List=sort_2.Keys, Index=0, Wrap=True)  # -> Item1, Item
dynamics = Dynamics(Structure=analyse.AnalysedStructure, MaximumEigenFrequencyValue=Slider(200, range=0..1000), NumberOfEigenfrequencies=1)  # -> Eigenfrequiences, Structure
eigenfreq = Eigenfrequencies(RangeToSearchWithin=10, NumberOfEigenfrequencies=Slider(10, range=0..10))  # -> LowestEigenfrequency, Structure
number_slider_11 = Slider(0.3, range=0..1)
panel_9 = Panel(item_11.Item)
panel_10 = Panel(item_12.Item)
timer = Timer(TimerInterval=50, Target=c_script_2)  # disabled
c_script_2 = CSharpScript(amp=Slider(2, range=0..100), smooth=Slider(7, range=0..10), y=Toggle(False))  # -> out, A, B; inputs amp: Double, smooth: Double, y: Boolean
# ---------- c_script_2: C# ----------
    if(y )
    {
      count++;
      if(count < smooth)
        move += amp;

      else if (count < 3 * smooth)
        move -= amp;

      else if(count < 4 * smooth)
        move += amp;

      else if(count >= 4 * smooth)
      {
        count = 0;
        move = 0;
      }
    }
    else
    {
      count = 0;
      move = 0;
    }
    A = move;
    B = count;
# ---------- c_script_2: C# additional code ----------
  int count = 0;
  double move = 0;
# ---------- end c_script_2 ----------
panel_11 = Panel(dynamics.Eigenfrequiences)
nvibes = NaturalVibrationsKaramba(Model=analyzethi.CalculatedModel, FromIndex=1, NumberOfModes=1, MaximumNumberOfIterations=30, Epsilon=1e-05)  # -> ModelWithVibrationModesAsLoadCaseResults, NaturalFrequencies_Hz, ModalMass_kg, ParticipationFactorInGlobalXYAndZDirection
division_4 = Division(A=panel_9, B=panel_10)
eigenmodes = EigenModes(Structure=eigenfreq.Structure, ScaleFactor=c_script_2.A)
panel_12 = Panel(c_script_2.A)
panel_13 = Panel(division_4)
eigenfreq_2 = Eigenfrequencies(Structure=analyse.AnalysedStructure, MaximumEigenFrequencyValue=Slider(1000, range=0..1000), NumberOfEigenfrequencies=1)  # -> LowestEigenfrequency, Structure
division_5 = Division(A=panel_11, B=nvibes.NaturalFrequencies_Hz)
emodes = EigenModesKaramba(
    Model=analyzethi.CalculatedModel,
    FromIndex=Slider(4, range=0..10),
    NumberOfModes=1,
    MaximumNumberOfIterations=300,
    Epsilon=1e-07)  # -> ModelWithEigenModesAsLoadCaseResults, Eigenvalues
modelview_2 = ModelViewKaramba(
    Model=emodes.ModelWithEigenModesAsLoadCaseResults,
    LoadCaseFactorsForLinearSuperposition=1,
    IndexIncrementOfVisibleLoadcase=0)  # -> Model, DeformedMesh, DeformedAxes, DeformedModel
panel_14 = Panel(division_5)
item_13 = ListItem(List=eigenmodes, Index=Slider(0, range=0..10), Wrap=True)
medges_3 = MeshEdges(Mesh=item_13)  # -> NakedEdges, InteriorEdges, NonManifoldEdges

# ==== cluster ElementVectors
mesh = ClusterInput()
mesh_2 = Mesh(mesh)
demesh = DeconstructMesh(Mesh=mesh_2)  # -> Vertices, Faces, Colours, Normals
deface = DeconstructFace(Face=demesh.Faces)  # -> CornerA, CornerB, CornerC, CornerD
item = ListItem(List=demesh.Vertices, Index=deface.CornerA, Wrap=True)
item_2 = ListItem(List=demesh.Vertices, Index=deface.CornerB, Wrap=True)
item_3 = ListItem(List=demesh.Vertices, Index=deface.CornerC, Wrap=True)
vec2pt = Vector2Pt(PointA=item, PointB=item_2, Unitize=True)  # -> Vector, Length
vec2pt_2 = Vector2Pt(PointA=item, PointB=item_3, Unitize=True)  # -> Vector, Length
v1 = Vector(vec2pt.Vector)
v2 = Vector(vec2pt_2.Vector)
xprod = CrossProduct(VectorA=v1, VectorB=v2, Unitize=False)  # -> Vector, Length
v3 = Vector(xprod.Vector)
xprod_2 = CrossProduct(VectorA=v3, VectorB=v1, Unitize=False)  # -> Vector, Length
v2_2 = Vector(xprod_2.Vector)
v1_2 = Vector(v1)
v2_3 = Vector(v2_2)
v3_2 = Vector(v3)
unit = UnitVector(Vector=v1_2)
unit_2 = UnitVector(Vector=v3_2)
unit_3 = UnitVector(Vector=v2_3)
V = ClusterOutput(unit)
V_2 = ClusterOutput(unit_3)
V_3 = ClusterOutput(unit_2)
