# Grasshopper definition Gurras_fittbro.gh (Grasshopper 0.9.76)
# plug-ins: MiStrAnGH

xz = XZPlane(Origin=Point(0, 0, 0))
number_slider = Slider(30, range=0..100)
srf = Surface(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)
mirror = Mirror(Geometry=srf, Plane=xz)  # -> Geometry, Transform
multiplication = Multiplication(A=number_slider, B=0.6)
int = Integer(multiplication)
mesh_uv = MeshSurface(Surface=[srf, mirror.Geometry], UCount=number_slider, VCount=int, Overhang=True, Equalize=False)
tri = Triangulate(Mesh=mesh_uv)  # -> Mesh, Count
mjoin = MeshJoin(Meshes=tri.Mesh)
mesh = Mesh(mjoin)
cullmesh = CullMesh(M=mesh)
medges = MeshEdges(Mesh=cullmesh)  # -> NakedEdges, InteriorEdges, NonManifoldEdges
mesh_2 = Mesh(cullmesh)
crv = Curve([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])
demesh = DeconstructMesh(Mesh=cullmesh)  # -> Vertices, Faces, Colours, Normals
facen = FaceNormals(Mesh=mesh_2)  # -> Centers, Normals
project = Project(Geometry=facen.Centers, Plane=PlaneXY(0, 0, 0))  # -> Geometry, Transform
pt = Point(demesh.Vertices)
incurves = PointInCurves(Point=project.Geometry, Curves=crv)  # -> Relationship, Index, Point
graftbyxcoord = GraftByXCoord(pt=pt)
equals = Equality(FirstNumber=incurves.Relationship, SecondNumber=2)  # -> Equality, Inequality
number_slider_2 = Slider(100, range=0..100)
cull = CullPattern(List=facen.Centers, CullPattern=invert(equals.Equality))
firstandlastbranch = FirstAndLAstBranch(pt=graftbyxcoord)  # -> pt_6, pt_5
cull_2 = CullPattern(List=facen.Centers, CullPattern=equals.Equality)
item = ListItem(List=pt, Index=[0, 1], Wrap=True)
support = CreateSupport(
    Point=flatten([firstandlastbranch.pt_6, firstandlastbranch.pt_5]),
    SupportInXDirection=True,
    SupportInYDirection=True,
    SupportInZDirection=True,
    SupportInXXDirection=True,
    SupportInYYDirection=True,
    SupportInZZDirection=True)
carbonfibre = Section(
    FaceCenterPoints=cull_2,
    EModulusInLongitudinalDirection_GPa=142,
    EModulusInTransverseDirection_GPA=7,
    LongitudinalShearModulus_GPA=7.2,
    PoissonsRatio=0.27,
    LaminaThickness_mm=[20, 1, 1, 20, 1, 1, 20],
    Angles_degree=[0, 45, -45, 0, -45, 45, 0],
    Density_kg_m_3=7800)
glassfibre = Section(
    FaceCenterPoints=cull,
    EModulusInLongitudinalDirection_GPa=45,
    EModulusInTransverseDirection_GPA=12,
    LongitudinalShearModulus_GPA=5.5,
    PoissonsRatio=0.19,
    LaminaThickness_mm=[2, 1, 1, 2, 1, 1, 2],
    Angles_degree=[0, 45, -45, 0, -45, 45, 0],
    Density_kg_m_3=7800)
pt_2 = Point(firstandlastbranch.pt_6)
support_2 = CreateSupport(
    Point=item,
    SupportInXDirection=True,
    SupportInYDirection=True,
    SupportInZDirection="false",
    SupportInXXDirection="false",
    SupportInYYDirection="false",
    SupportInZZDirection="false")
pt_3 = Point(firstandlastbranch.pt_5)
gravity = MiStrAnGravityLoad()
section = Section(
    EModulusInLongitudinalDirection_GPa=210,
    EModulusInTransverseDirection_GPA=210,
    LongitudinalShearModulus_GPA=79.3,
    PoissonsRatio=0.3,
    LaminaThickness_mm=10,
    Angles_degree=0,
    Density_kg_m_3=7800)
support_3 = CreateSupport(
    Point=pt_2,
    SupportInXDirection="false",
    SupportInYDirection="false",
    SupportInZDirection=True,
    SupportInXXDirection="false",
    SupportInYYDirection="false",
    SupportInZZDirection="false")
support_4 = CreateSupport(
    Point=pt_3,
    SupportInXDirection="false",
    SupportInYDirection="false",
    SupportInZDirection=True,
    SupportInXXDirection="false",
    SupportInYYDirection="false",
    SupportInZZDirection="false")
num = Number([1.061844625, 1.542676327, 0.006501632897, -0.07134954457, -0.1317175213, -0.2142999663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])
num_2 = Number([1.113059513, -0.1593977191, 1.562567737, 1.457230911, 1.384469135, 0.9531824217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])
merge = Merge(Data1=support_3, Data2=support_4, Data3=support_2)  # -> flatten(Result)
num_3 = Number([1.313152541, 0.8278533194, 0.8049794714, 0.6625774591, 0.5463111868, 0.4338305892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])
num_4 = Number([1.203730661, 0.7995740013, 0.8729487125, 0.9371475724, 0.9003597343, 0.8253935638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])
num_5 = Number([1.075065587, 1.525349812, -0.01532600178, -0.08965519289, -0.1495761307, -0.2196652952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])
number_slider_3 = Slider(0, range=0..100)
assemble = MiStrAnAssembleStructure(Mesh=mesh_2, MiStrAnSupports=flatten(merge), MiStrAnLoads=gravity, GeneratedSection=flatten([carbonfibre, glassfibre]))
panel = Panel(num_3)
deg = Degrees(Radians=panel)
vec = Vector([Vector(1.442156657, -10.07022054, 0), Vector(-3.291508305, -10.8793816, 0), Vector(-3.007553897, -13.15881897, 0), Vector(-2.387534689, -15.07037568, 0), Vector(-1.914077376, -16.95794803, 0), Vector(-1.1286072, -18.97792154, 0)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])
pdecon = Deconstruct(Point=vec)  # -> XComponent, YComponent, ZComponent
panel_2 = Panel(deg)
abs = Absolute(Value=pdecon.YComponent)
abs_2 = Absolute(Value=pdecon.XComponent)
larger = LargerThan(FirstNumber=abs, SecondNumber=abs_2)  # -> LargerThan, OrEqualTo
int_2 = Integer(larger.LargerThan)
multiplication_2 = Multiplication(A=int_2, B=90)
addition = Addition(A=multiplication_2, B=deg)
change_material_angles = ChangeMaterialAngles(Structure=assemble, Angles=addition)
analyse = MiStrAnAnalyseStructure(Run=Toggle(True), MiStrAnStructure=change_material_angles)  # -> AnalysedStructure, Displacements, Rotations, Reactions, PrincipalStresses, PrincipalStressAngles, VonMisesStresses
vlen = VectorLength(Vector=analyse.Displacements)
sort = SortList(Keys=vlen)  # -> Keys, ValuesA
item_2 = ListItem(List=sort.Keys, Index=0, Wrap=True)  # -> Item1, Item
visres = VisualiseResults(Structure=analyse.AnalysedStructure, ScaleDeformation=Slider(4, range=0..100))  # -> DeformedMesh, VonMisesStressPlot, VonMisesStresses
drawcoordsys = DrawElementCoordinateSystem(Structure=change_material_angles)
drawprincarrows = DrawPrincipalstressArrows(Structure=analyse.AnalysedStructure)
panel_3 = Panel(item_2.Item1)
mesh_3 = Mesh(visres.VonMisesStressPlot)
panel_4 = Panel("""24000: 0.098717
15360: 0.091232
8640: 0.082676
3840: 0.074125
960: 0.074079""")

# ==== cluster CullMesh
M = ClusterInput()
demesh = DeconstructMesh(Mesh=M)  # -> Vertices, Faces, Colours, Normals
deface = DeconstructFace(Face=demesh.Faces)  # -> CornerA, CornerB, CornerC, CornerD
cset = CreateSet(List=demesh.Vertices)  # -> Set, Map
index = ItemIndex(List=cset.Map, Item=cset.Map)
panel = Panel(cset.Map)
replace = ReplaceMembers(Set=deface.CornerB, Find=index, Replace=panel)
replace_2 = ReplaceMembers(Set=deface.CornerC, Find=index, Replace=panel)
replace_3 = ReplaceMembers(Set=deface.CornerA, Find=index, Replace=panel)
triangle = MeshTriangle(CornerA=replace_3, CornerB=replace, CornerC=replace_2)
conmesh = ConstructMesh(Vertices=cset.Set, Faces=triangle)
M_2 = ClusterOutput(conmesh)

# ==== cluster GraftByXCoord
pt = ClusterInput()
pt_2 = Point(pt)
pdecon = Deconstruct(Point=pt_2)  # -> XComponent, YComponent, ZComponent
cset = CreateSet(List=pdecon.XComponent)  # -> Set, Map
equals = Equality(FirstNumber=pdecon.XComponent, SecondNumber=graft(cset.Set))  # -> Equality, Inequality
cull = CullPattern(List=pt_2, CullPattern=equals.Equality)
pt_3 = Point(cull)
pt_4 = ClusterOutput(pt_3)

# ==== cluster FirstAndLAstBranch
pt = ClusterInput()
pt_2 = Point(pt)
tstat = TreeStatistics(Tree=pt_2)  # -> Paths, Length, Count
item = ListItem(List=tstat.Paths, Index=0, Wrap=True)  # -> Item1, Item
branch = TreeBranch(Tree=pt_2, Path=item.Item1, MaintainPaths=True)
branch_2 = TreeBranch(Tree=pt_2, Path=item.Item, MaintainPaths=True)
pt_3 = Point(branch_2)
pt_4 = Point(branch)
pt_5 = ClusterOutput(pt_3)
pt_6 = ClusterOutput(pt_4)
