# Grasshopper definition GustavsDynamicsTesting.gh (Grasshopper 0.9.76)
# plug-ins: Karamba, MiStrAnGH

number_slider = Slider(5, range=0..100)
rectangle = Rectangle(Plane=PlaneXY(0, 0, 0), XSize=Domain(-1, 1), YSize=Domain(-1, 1), Radius=0)  # -> Rectangle, Length
mplane = MeshPlane(Boundary=rectangle.Rectangle, WidthCount=number_slider, HeightCount=number_slider)  # -> Mesh, Area
tri = Triangulate(Mesh=mplane.Mesh)  # -> Mesh, Count
mesh = Mesh(tri.Mesh)
demesh = DeconstructMesh(Mesh=mesh)  # -> Vertices, Faces, Colours, Normals
demesh_2 = DeconstructMesh(Mesh=tri.Mesh)  # -> Vertices, Faces, Colours, Normals
lng = ListLength(List=demesh.Faces)
pdecon = Deconstruct(Point=demesh_2.Vertices)  # -> XComponent, YComponent, ZComponent
series = Series(Start=0, Step=1, Count=lng)
number_slider_2 = Slider(180, range=0..1000)
lng_2 = ListLength(List=demesh_2.Vertices)
number_slider_3 = Slider(500, range=0..1000)
number_slider_4 = Slider(1, range=0..1)
meshtoshell = MeshToShellKaramba(Point=demesh.Vertices, Mesh=mesh, LDist=0.005, Identifier=series)  # -> Point, Element, Info
cross_sections = CrossSectionsKaramba(ElementsIdentifiers=meshtoshell.Element, Heights_cm=1, mode="Shell")
equals = Equality(FirstNumber=pdecon.XComponent, SecondNumber=1)  # -> Equality, Inequality
series_2 = Series(Start=0, Step=1, Count=lng_2)
number_slider_5 = Slider(1000, range=0..100000)
loads = LoadsKaramba(Vector=Vector(0, 0, -1), LCase=0, mode="Gravity")
cull = CullPattern(List=demesh_2.Vertices, CullPattern=equals.Equality)
cull_2 = CullPattern(List=series_2, CullPattern=equals.Equality)
number_slider_6 = Slider(180, range=0..1000)
supp = SupportKaramba(PosInd=cull, menu=[buttons(on, on, on, on, on, on)])
matprops = MaterialPropertiesKaramba(
    YoungsModulus_kN_cm2=21000,
    ShearModulus_kN_cm2=8076,
    SpecificWeight_kN_m3=78.5,
    CoefficientOfThermalExpansion_1_C=1e-05,
    YieldStrength_kN_cm2=23.5,
    Name="S235")
section = Section(
    EModulusInLongitudinalDirection_GPa=210,
    EModulusInTransverseDirection_GPA=210,
    LongitudinalShearModulus_GPA=79.3,
    PoissonsRatio=0.3,
    LaminaThickness_mm=10,
    Angles_degree=0,
    Density_kg_m_3=7800)
support = CreateSupport(
    NodeID=cull_2,
    SupportInXDirection=True,
    SupportInYDirection=True,
    SupportInZDirection=True,
    SupportInXXDirection=True,
    SupportInYYDirection=True,
    SupportInZZDirection=True)
number_slider_7 = Slider(12, range=0..100)
division = Division(A=Slider(3000, range=0..10000), B="6201384728.2380047")
assemble = AssembleModelKaramba(
    Point=meshtoshell.Point,
    Elem=meshtoshell.Element,
    Support=supp,
    Load=loads,
    CrossSection=cross_sections,
    Material=matprops,
    LimitDistance_m=0.005)  # -> Model, Info, Mass_kg, CenterOfGravity
gravity = MiStrAnGravityLoad()
number_slider_8 = Slider(4, range=0..100)
number_slider_9 = Slider(100, range=0..100)
number_slider_10 = Slider(13, range=0..100000000)
assemble_2 = MiStrAnAssembleStructure(Mesh=tri.Mesh, MiStrAnSupports=support, MiStrAnLoads=gravity, GeneratedSection=section)
number_slider_11 = Slider(15, range=0..100)
number_slider_12 = Slider(1, range=0..1)
number_slider_13 = Slider(1, range=0..1)
sqrt = SquareRoot(Value=Slider(180, range=0..1000))
analyzethii = AnalyzeThIIKaramba(Model=assemble.Model, LoadCase=-1, RTolerance=1e-07, MaxIterations=50, NoTensionalNII=False)  # -> CalculatedModel, MaximumDisplacement_m, ResultingForceOfGravity_kN, ElasticEnergy_kNm
sqrt_2 = SquareRoot(Value=Slider(180, range=0..1000))
analyse = MiStrAnAnalyseStructure(Run=Toggle(True), MiStrAnStructure=assemble_2)  # -> AnalysedStructure, Displacements, Rotations, Reactions, PrincipalStresses, PrincipalStressAngles, VonMisesStresses
nvibes = NaturalVibrationsKaramba(Model=assemble.Model, FromIndex=1, NumberOfModes=Slider(3, range=0..10), MaximumNumberOfIterations=30, Epsilon=1e-05)  # -> ModelWithVibrationModesAsLoadCaseResults, NaturalFrequencies_Hz, ModalMass_kg, ParticipationFactorInGlobalXYAndZDirection
eigenfreq = Eigenfrequencies(
    Structure=assemble_2,
    RangeToSearchWithin=Slider(1e-06, range=0..1e-06),
    NumberOfEigenfrequencies=Slider(3, range=0..1000))  # -> LowestEigenfrequency, Structure
vlen = VectorLength(Vector=analyse.Displacements)
panel = Panel(nvibes.NaturalFrequencies_Hz)
panel_2 = Panel(eigenfreq.LowestEigenfrequency)
sort = SortList(Keys=vlen)  # -> reverse(Keys), ValuesA
visres = VisualiseResults(
    Structure=analyse.AnalysedStructure,
    ScaleDeformation=Slider(10, range=1..10000),
    BottomLimiter=0,
    TopLimiter=Slider(0.39, range=0..1))  # -> DeformedMesh, VonMisesStressPlot
cull_3 = CullPattern(List=analyse.Reactions, CullPattern=[False, False, True, False, False, False])
item = ListItem(List=reverse(panel), Index=0, Wrap=True)
panel_3 = Panel(sort.Keys)
panel_4 = Panel(analyzethii.MaximumDisplacement_m)
emodes = EigenModesKaramba(
    Model=nvibes.ModelWithVibrationModesAsLoadCaseResults,
    FromIndex=1,
    NumberOfModes=1,
    MaximumNumberOfIterations=300,
    Epsilon=1e-07)  # -> ModelWithEigenModesAsLoadCaseResults, Eigenvalues
ma = MassAddition(Input=cull_3)  # -> Result, PartialResults
panel_5 = Panel(ma.Result)
multiplication = Multiplication(A=item, B=6.283185307)
eigenmodes = EigenModes(Structure=eigenfreq.Structure, ScaleFactor=Slider(10, range=0..10))
mesh_2 = Mesh(visres.DeformedMesh)
nodedisp = NodalDisplacementsKaramba()  # -> AnalyzedModel, NodalTranslations_m, NodalRotations_rad
item_2 = ListItem(List=eigenmodes, Index=0, Wrap=True)
pow = Power(A=multiplication, B=2)
modelview = ModelViewKaramba(
    Model=emodes.ModelWithEigenModesAsLoadCaseResults,
    LoadCaseFactorsForLinearSuperposition=1,
    IndexIncrementOfVisibleLoadcase=0)  # -> Model, DeformedMesh, DeformedAxes, DeformedModel
panel_6 = Panel(pow)
