# Grasshopper definition Kaponjarsbron.gh (Grasshopper 0.9.76)

srf = Surface([<surface referenced from the Rhino model> x5])
srf_2 = Surface(<surface referenced from the Rhino model>)
srf_3 = Surface(<surface referenced from the Rhino model>)
mesh_uv = MeshSurface(Surface=srf, UCount=Slider(150, range=0..1000), VCount=5, Overhang=True, Equalize=False)
mesh_uv_2 = MeshSurface(Surface=srf_2, UCount=Slider(150, range=0..1000), VCount=5, Overhang=True, Equalize=False)
mesh_uv_3 = MeshSurface(Surface=srf_3, UCount=5, VCount=Slider(150, range=0..1000), Overhang=True, Equalize=False)
tri = Triangulate(Mesh=mesh_uv)  # -> Mesh, Count
tri_2 = Triangulate(Mesh=mesh_uv_2)  # -> Mesh, Count
tri_3 = Triangulate(Mesh=mesh_uv_3)  # -> Mesh, Count
medges = MeshEdges(Mesh=tri.Mesh)  # -> NakedEdges, InteriorEdges, NonManifoldEdges
srf_4 = Surface([<surface referenced from the Rhino model> x58])
medges_2 = MeshEdges(Mesh=tri_2.Mesh)  # -> NakedEdges, InteriorEdges, NonManifoldEdges
medges_3 = MeshEdges(Mesh=tri_3.Mesh)  # -> NakedEdges, InteriorEdges, NonManifoldEdges
join = BrepJoin(Breps=srf_4)  # -> Breps, Closed
mesh = MeshBrep(
    Brep=join.Breps,
    Settings={GridMaxCount=0, GridMinCount=16, JaggedSeams=False, MaxEdgeLength=0, MinEdgeLength=0.0001, MinTolerance=0, Refine=True, RefineAngle=0, RelativeTolerance=0.65, SimplePlanes=True, Tolerance=0})
item = ListItem(List=join.Breps, Index=Slider(1, range=0..1), Wrap=True)
tri_4 = Triangulate(Mesh=mesh)  # -> Mesh, Count
medges_4 = MeshEdges(Mesh=tri_4.Mesh)  # -> NakedEdges, InteriorEdges, NonManifoldEdges
