# Grasshopper definition Komposit_verifiering.gh (Grasshopper 0.9.76)
# plug-ins: MiStrAnGH

number_slider = Slider(1, range=0..1)
pt = Point(Point(6.187004391, 14.76879502, 0))
rotate = Rotate(Center=Point(0, 0, 0), From=Vector(1, 0, 0), To=Vector(0, 1, 0))  # -> Geometry, Transform
vec = VectorXYZ(XComponent=number_slider, YComponent=number_slider, ZComponent=number_slider)  # -> Vector, Length
xy = XYPlane(Origin=Point(0, 0, 0))
xz = XZPlane(Origin=Point(0, 0, 0))
number_slider_2 = Slider(1, range=0..1)
number_slider_3 = Slider(10, range=0..10)
number_slider_4 = Slider(1, range=0..10)
pl = ConstructPlane(Origin=pt, XAxis=vec.Vector, YAxis=Vector(0, 1, 0))
X = UnitX(Factor=1)
prot = RotatePlane(Plane=xz, Angle=Slider(0.785, range=0..1))
pln = Plane(xy)
dom = ConstructDomain(DomainStart=expr("-x/2", number_slider_3), DomainEnd=expr("x/2", number_slider_3))
dom_2 = ConstructDomain(DomainStart=expr("-x/2", number_slider_4), DomainEnd=expr("x/2", number_slider_4))
number_slider_5 = Slider(3000, range=0..10000)
number_slider_6 = Slider(1000000, range=0..10000000)
number_slider_7 = Slider(40, range=0..1000)
number_slider_8 = Slider(4, range=0..10)
number_slider_9 = Slider(21.4, range=0..100)
addition = Addition(A=number_slider_8, B=1)
planesrf = PlaneSurface(Plane=pln, XSize=dom, YSize=dom_2)
number_slider_10 = Slider(2.4, range=0..10)
rectangle = Rectangle(Plane=pln, XSize=dom, YSize=dom_2, Radius=0)  # -> Rectangle, Length
panel = Panel("""90
0
0
45
45
0
0
90""")
number_slider_11 = Slider(0.14, range=0..1)
division = Division(A=Slider(10000, range=0..10000), B=addition)
deplane = DeconstructPlane(Plane=pln)  # -> Origin, XAxis, YAxis, ZAxis
srf = Surface(planesrf)
repeat = RepeatData(Data=division, Length=addition)
mplane = MeshPlane(Boundary=rectangle.Rectangle, WidthCount=number_slider_7, HeightCount=number_slider_8)  # -> Mesh, Area
merge = Merge(Data1=Slider(35.1, range=0..100), Data2=Slider(9.6, range=0..10), Data3=Slider(4, range=0..10))
number_slider_12 = Slider(0, range=0..1)
sdivide = DivideSurface(Surface=srf, UCount=number_slider_7, VCount=number_slider_8)  # -> simplify(Points), Normals, Parameters
tstat = TreeStatistics(Tree=sdivide.Points)  # -> Paths, Length, Count
tri = Triangulate(Mesh=mplane.Mesh)  # -> Mesh, Count
element_vectors = ElementVectors(mesh=tri.Mesh)  # -> V, V_2, V_3
v1 = Vector(element_vectors.V)
v2 = Vector(element_vectors.V_2)
v3 = Vector(element_vectors.V_3)
angle = Angle(VectorA=v1, VectorB=X)  # -> Angle, Reflex
deg = Degrees(Radians=angle.Angle)
item = ListItem(List=tstat.Paths, Index=0, Wrap=True)  # -> Item1, Item
panel_2 = Panel("0")
multiplication = Multiplication(A=merge, B=1000000000)
number_slider_13 = Slider(0.25, range=0..1)
demesh = DeconstructMesh(Mesh=tri.Mesh)  # -> Vertices, Faces, Colours, Normals
points = PointList(Points=demesh.Vertices, Size=Slider(0.1, range=0..1))
merge_2 = Merge(Data1=multiplication, Data2=Slider(0.32, range=0..1), Data3=Slider(0.002, range=0..0.01))  # -> graft(Result)
branch = TreeBranch(Tree=simplify(sdivide.Points), Path=item.Item, MaintainPaths=True)  # -> flatten(Branch)
branch_2 = TreeBranch(Tree=simplify(sdivide.Points), Path=item.Item1, MaintainPaths=True)  # -> flatten(Branch)
multiplication_2 = Multiplication(A=deplane.ZAxis, B=repeat)
subtraction = Subtraction(A=panel, B=graft(deg))
vdis = VectorDisplay(Anchor=branch_2, Vector=unitize(multiplication_2))
X_2 = UnitX(Factor=Slider(1000, range=0..1000))
demesh_2 = DeconstructMesh(Mesh=tri.Mesh)  # -> Vertices, Faces, Colours, Normals
medges = MeshEdges(Mesh=tri.Mesh)  # -> NakedEdges, InteriorEdges, NonManifoldEdges
number_slider_14 = Slider(0.2, range=0..1)
bang = ExplodeTree(Data=merge_2)  # -> Branch0, Branch1, Branch2, Branch3, Branch4
support = CreateSupport(
    Point=branch,
    SupportInXDirection=True,
    SupportInYDirection=True,
    SupportInZDirection=True,
    SupportInXXDirection=True,
    SupportInYYDirection=True,
    SupportInZZDirection=True)
pointload = MiStrAnPointload(Point=branch_2, ForceVector=X_2)
index = ItemIndex(List=demesh_2.Faces, Item=demesh_2.Faces)
panel_3 = Panel(multiplication_2)
section = Section(
    IndexesOfFaces=graft(index),
    EModulusInLongitudinalDirection=bang.Branch0,
    EModulusInTransverseDirection=bang.Branch1,
    LongitudinalShearModulus=bang.Branch2,
    PoissonsRatio=bang.Branch3,
    LaminaThickness=bang.Branch4,
    AnglesInDegree=subtraction)  # -> flatten(Generated)
section_2 = Section(IndexesOfFaces=index)
assemble = MiStrAnAssembleStructure(Mesh=tri.Mesh, MiStrAnSupports=support, MiStrAnLoads=pointload, GeneratedSection=section)
number_slider_15 = Slider(10000, range=0..10000)
demesh_3 = DeconstructMesh(Mesh=tri.Mesh)  # -> Vertices, Faces, Colours, Normals
analyse = MiStrAnAnalyseStructure(Run=Toggle(True), MiStrAnStructure=assemble)  # -> Displacements, Rotations, Reactions, DeformedMesh, PrincipalStresses
number_slider_16 = Slider(1000, range=0..1000)
vlen = VectorLength(Vector=analyse.Displacements)
sort = SortList(Keys=vlen)  # -> Keys, ValuesA
item_2 = ListItem(List=sort.Keys, Index=0, Wrap=True)  # -> Item1, Item
multiplication_3 = Multiplication(A=analyse.Displacements, B=Slider(59500, range=0..1000000))
vlen_2 = VectorLength(Vector=analyse.Displacements)
move = Move(Geometry=demesh_3.Vertices, Motion=multiplication_3)  # -> Geometry, Transform
sort_2 = SortList(Keys=vlen_2)  # -> Keys, ValuesA
unit = UnitVector(Vector=analyse.PrincipalStresses)
item_3 = ListItem(List=sort_2.Keys, Index=0, Wrap=True)  # -> Item1, Item
panel_4 = Panel(item_2.Item1)
gradient = Gradient(
    LowerLimit=item_3.Item,
    UpperLimit=item_3.Item1,
    Parameter=vlen_2,
    stops=[0: RGB(39, 72, 161), 0.235: RGB(1, 192, 229), 0.416: RGB(18, 178, 90), 0.539: RGB(79, 186, 8), 0.733: RGB(220, 237, 32), 0.861: RGB(247, 159, 20), 1: RGB(243, 57, 0)])
panel_5 = Panel(unit)
conmesh = ConstructMesh(Vertices=move.Geometry, Faces=demesh_3.Faces, Colours=gradient)
panel_6 = Panel(deg)
medges_2 = MeshEdges(Mesh=conmesh)  # -> NakedEdges, InteriorEdges, NonManifoldEdges

# ==== cluster ElementVectors
mesh = ClusterInput()
mesh_2 = Mesh(mesh)
demesh = DeconstructMesh(Mesh=mesh_2)  # -> Vertices, Faces, Colours, Normals
deface = DeconstructFace(Face=demesh.Faces)  # -> CornerA, CornerB, CornerC, CornerD
item = ListItem(List=demesh.Vertices, Index=deface.CornerA, Wrap=True)
item_2 = ListItem(List=demesh.Vertices, Index=deface.CornerB, Wrap=True)
item_3 = ListItem(List=demesh.Vertices, Index=deface.CornerC, Wrap=True)
vec2pt = Vector2Pt(PointA=item, PointB=item_2, Unitize=True)  # -> Vector, Length
vec2pt_2 = Vector2Pt(PointA=item, PointB=item_3, Unitize=True)  # -> Vector, Length
v1 = Vector(vec2pt.Vector)
v2 = Vector(vec2pt_2.Vector)
xprod = CrossProduct(VectorA=v1, VectorB=v2, Unitize=False)  # -> Vector, Length
v3 = Vector(xprod.Vector)
xprod_2 = CrossProduct(VectorA=v3, VectorB=v1, Unitize=False)  # -> Vector, Length
v2_2 = Vector(xprod_2.Vector)
v1_2 = Vector(v1)
v2_3 = Vector(v2_2)
v3_2 = Vector(v3)
unit = UnitVector(Vector=v1_2)
unit_2 = UnitVector(Vector=v3_2)
unit_3 = UnitVector(Vector=v2_3)
V = ClusterOutput(unit)
V_2 = ClusterOutput(unit_3)
V_3 = ClusterOutput(unit_2)
