# Grasshopper definition MistranKarambaBigEgentyngd.gh (Grasshopper 0.9.76)
# plug-ins: Karamba, MiStrAnGH

xy = XYPlane(Origin=Point(0, 0, 0))
number_slider = Slider(0.785, range=0..1)
number_slider_2 = Slider(1, range=0..1)
number_slider_3 = Slider(10, range=0..100)
number_slider_4 = Slider(1, range=0..10)
xz = XZPlane(Origin=Point(0, 0, 0))
pln = Plane(xy)
dom = ConstructDomain(DomainStart=expr("-x/2", number_slider_3), DomainEnd=expr("x/2", number_slider_3))
dom_2 = ConstructDomain(DomainStart=expr("-x/2", number_slider_4), DomainEnd=expr("x/2", number_slider_4))
number_slider_5 = Slider(3000, range=0..10000)
number_slider_6 = Slider(1000000, range=0..10000000)
number_slider_7 = Slider(1, range=0..100)
number_slider_8 = Slider(3, range=0..1000)
addition = Addition(A=number_slider_7, B=1)
planesrf = PlaneSurface(Plane=pln, XSize=dom, YSize=dom_2)
rectangle = Rectangle(Plane=pln, XSize=dom, YSize=dom_2, Radius=0)  # -> Rectangle, Length
number_slider_9 = Slider(2000, range=0..2000)
division = Division(A=Slider(0, range=0..10000), B=addition)
deplane = DeconstructPlane(Plane=pln)  # -> Origin, XAxis, YAxis, ZAxis
srf = Surface(planesrf)
repeat = RepeatData(Data=division, Length=addition)
mplane = MeshPlane(Boundary=rectangle.Rectangle, WidthCount=number_slider_8, HeightCount=number_slider_7)  # -> Mesh, Area
number_slider_10 = Slider(0, range=0..1)
sdivide = DivideSurface(Surface=srf, UCount=number_slider_8, VCount=number_slider_7)  # -> simplify(Points), Normals, Parameters
tstat = TreeStatistics(Tree=sdivide.Points)  # -> Paths, Length, Count
X = UnitX(Factor=number_slider_9)
Z = UnitZ(Factor=number_slider_9)
tri = Triangulate(Mesh=mplane.Mesh)  # -> Mesh, Count
mesh = Mesh(tri.Mesh)
medges = MeshEdges(Mesh=mesh)  # -> NakedEdges, InteriorEdges, NonManifoldEdges
demesh = DeconstructMesh(Mesh=mesh)  # -> Vertices, Faces, Colours, Normals
item = ListItem(List=tstat.Paths, Index=0, Wrap=True)  # -> Item1, Item
meshtoshell = MeshToShellKaramba(Point=demesh.Vertices, Mesh=mesh, LDist=0.005)  # -> Point, Element, Info
demesh_2 = DeconstructMesh(Mesh=tri.Mesh)  # -> Vertices, Faces, Colours, Normals
points = PointList(Points=demesh_2.Vertices, Size=Slider(0.1, range=0..1))
Z_2 = UnitZ(Factor=-1)
branch = TreeBranch(Tree=simplify(sdivide.Points), Path=item.Item, MaintainPaths=True)  # -> flatten(Branch)
bc_points = Point(branch)
cp = ClosestPoint(Point=bc_points, Cloud=demesh.Vertices)  # -> ClosestPoint, CPIndex, Distance
supp = SupportKaramba(PosInd=bc_points, menu=[buttons(on, on, on, on, on, on)])
branch_2 = TreeBranch(Tree=simplify(sdivide.Points), Path=item.Item1, MaintainPaths=True)  # -> flatten(Branch)
load_pts = Point(branch_2)
cp_2 = ClosestPoint(Point=load_pts, Cloud=demesh.Vertices)  # -> ClosestPoint, CPIndex, Distance
multiplication = Multiplication(A=deplane.ZAxis, B=repeat)
force_vecs = Vector(multiplication)
division_2 = Division(A=force_vecs, B=1000)
loads = LoadsKaramba(ForceVector=division_2, Local=False, PosInd=cp_2.CPIndex, LCase=0, mode="Point")
vdis = VectorDisplay(Anchor=branch_2, Vector=unitize(multiplication))
number_slider_11 = Slider(9, range=0..10)
index = ItemIndex(List=meshtoshell.Point, Item=meshtoshell.Point)
matprops = MaterialPropertiesKaramba(
    ElementsIdentifiers=index,
    YoungsModulus_kN_cm2=21000,
    ShearModulus_kN_cm2=Slider(7930, range=0..10000),
    SpecificWeight_kN_m3=Slider(78, range=0..100),
    CoefficientOfThermalExpansion_1_C=1e-05,
    YieldStrength_kN_cm2=Slider(1000, range=0..1000),
    Name="S235")
loads_2 = LoadsKaramba(Vector=Vector(0, 0, -1), LCase=0, mode="Gravity")
medges_2 = MeshEdges(Mesh=tri.Mesh)  # -> NakedEdges, InteriorEdges, NonManifoldEdges
support = CreateSupport(
    Point=branch,
    SupportInXDirection=True,
    SupportInYDirection=True,
    SupportInZDirection=True,
    SupportInXXDirection=True,
    SupportInYYDirection=True,
    SupportInZZDirection=True)
gravity = MiStrAnGravityLoad()
panel = Panel(multiplication)
section = Section(
    EModulusInLongitudinalDirection_GPa=210,
    EModulusInTransverseDirection_GPA=210,
    LongitudinalShearModulus_GPA=79.3,
    PoissonsRatio=0.3,
    LaminaThickness_mm=10,
    Angles_degree=0,
    Density_kg_m_3=7800)
assemble = MiStrAnAssembleStructure(Mesh=tri.Mesh, MiStrAnSupports=support, MiStrAnLoads=gravity, GeneratedSection=section)
cross_sections = CrossSectionsKaramba(Heights_cm=Slider(1, range=0..10), mode="Shell")
assemble_2 = AssembleModelKaramba(
    Point=meshtoshell.Point,
    Elem=meshtoshell.Element,
    Support=supp,
    Load=loads_2,
    CrossSection=cross_sections,
    Material=matprops,
    LimitDistance_m=0.005)  # -> Model, Info, Mass_kg, CenterOfGravity
analyzethi = AnalyzeThIKaramba(Model=assemble_2.Model)  # -> CalculatedModel, MaximumDisplacement_m, ResultingForceOfGravity_kN, ElasticEnergy_kNm
analyse = MiStrAnAnalyseStructure(Run=Toggle(False), MiStrAnStructure=assemble)  # -> AnalysedStructure, Displacements, Rotations, Reactions, PrincipalStresses, PrincipalStressAngles, VonMisesStresses
nodedisp = NodalDisplacementsKaramba(AnalyzedModel=analyzethi.CalculatedModel)  # -> AnalyzedModel, NodalTranslations_m, NodalRotations_rad
devec = DeconstructVector(Vector=analyse.Displacements)  # -> XComponent, YComponent, ZComponent
sort = SortList(Keys=devec.ZComponent)  # -> Keys, ValuesA
z_mistran = Panel(sort.Keys)
multiplication_2 = Multiplication(A=nodedisp.NodalTranslations_m, B=1000)
devec_2 = DeconstructVector(Vector=nodedisp.NodalTranslations_m)  # -> XComponent, YComponent, ZComponent
sort_2 = SortList(Keys=devec_2.ZComponent)  # -> Keys, ValuesA
z_karamba = Panel(sort_2.Keys)
modelview = ModelViewKaramba(Model=nodedisp.AnalyzedModel, LoadCaseFactorsForLinearSuperposition=1, IndexIncrementOfVisibleLoadcase=0)  # -> Model, DeformedMesh, DeformedAxes, DeformedModel
item_2 = ListItem(List=z_mistran, Index=0, Wrap=True)
item_3 = ListItem(List=z_karamba, Index=0, Wrap=True)
panel_2 = Panel(multiplication_2)
division_3 = Division(A=item_2, B=item_3)
panel_3 = Panel(division_3)
division_4 = Division(A=panel_3, B=0.981)
panel_4 = Panel(division_4)
