# Grasshopper definition MistranKarambaDistLoad.gh (Grasshopper 0.9.76)
# plug-ins: Karamba, MiStrAn

xy = XYPlane(Origin=Point(0, 0, 0))
number_slider = Slider(0.785, range=0..1)
number_slider_2 = Slider(1, range=0..1)
number_slider_3 = Slider(10, range=0..10)
number_slider_4 = Slider(1, range=0..10)
xz = XZPlane(Origin=Point(0, 0, 0))
pln = Plane(xy)
dom = ConstructDomain(DomainStart=expr("-x/2", number_slider_3), DomainEnd=expr("x/2", number_slider_3))
dom_2 = ConstructDomain(DomainStart=expr("-x/2", number_slider_4), DomainEnd=expr("x/2", number_slider_4))
number_slider_5 = Slider(3000, range=0..10000)
number_slider_6 = Slider(1000000, range=0..10000000)
number_slider_7 = Slider(4, range=0..1000)
number_slider_8 = Slider(4, range=0..100)
addition = Addition(A=number_slider_8, B=1)
planesrf = PlaneSurface(Plane=pln, XSize=dom, YSize=dom_2)
rectangle = Rectangle(Plane=pln, XSize=dom, YSize=dom_2, Radius=0)  # -> Rectangle, Length
number_slider_9 = Slider(2000, range=0..2000)
division = Division(A=Slider(0, range=0..10000), B=addition)
deplane = DeconstructPlane(Plane=pln)  # -> Origin, XAxis, YAxis, ZAxis
srf = Surface(planesrf)
repeat = RepeatData(Data=division, Length=addition)
mplane = MeshPlane(Boundary=rectangle.Rectangle, WidthCount=number_slider_7, HeightCount=number_slider_8)  # -> Mesh, Area
number_slider_10 = Slider(0, range=0..1)
sdivide = DivideSurface(Surface=srf, UCount=number_slider_7, VCount=number_slider_8)  # -> simplify(Points), Normals, Parameters
tstat = TreeStatistics(Tree=sdivide.Points)  # -> Paths, Length, Count
number_slider_11 = Slider(1000, range=0..1000)
X = UnitX(Factor=number_slider_9)
Z = UnitZ(Factor=number_slider_9)
tri = Triangulate(Mesh=mplane.Mesh)  # -> Mesh, Count
mesh = Mesh(tri.Mesh)
medges = MeshEdges(Mesh=mesh)  # -> NakedEdges, InteriorEdges, NonManifoldEdges
demesh = DeconstructMesh(Mesh=mesh)  # -> Vertices, Faces, Colours, Normals
item = ListItem(List=tstat.Paths, Index=0, Wrap=True)  # -> Item1, Item
meshtoshell = MeshToShellKaramba(Point=demesh.Vertices, Mesh=mesh, LDist=0.005)  # -> Point, Element, Info
multiplication = Multiplication(A=Slider(7.8, range=0..10), B=9.82)
demesh_2 = DeconstructMesh(Mesh=tri.Mesh)  # -> Vertices, Faces, Colours, Normals
demesh_3 = DeconstructMesh(Mesh=tri.Mesh)  # -> Vertices, Faces, Colours, Normals
points = PointList(Points=demesh_3.Vertices, Size=Slider(0.1, range=0..1))
multiplication_2 = Multiplication(A=multiplication, B=number_slider_11)
multiplication_3 = Multiplication(A=Slider(1000, range=0..1000), B=number_slider_11)
branch = TreeBranch(Tree=simplify(sdivide.Points), Path=item.Item, MaintainPaths=True)  # -> flatten(Branch)
bc_points = Point(branch)
cp = ClosestPoint(Point=bc_points, Cloud=demesh.Vertices)  # -> ClosestPoint, CPIndex, Distance
supp = SupportKaramba(PosInd=cp.CPIndex, menu=[buttons(on, on, on, on, on, on)])
branch_2 = TreeBranch(Tree=simplify(sdivide.Points), Path=item.Item1, MaintainPaths=True)  # -> flatten(Branch)
load_pts = Point(branch_2)
cp_2 = ClosestPoint(Point=load_pts, Cloud=demesh.Vertices)  # -> ClosestPoint, CPIndex, Distance
multiplication_4 = Multiplication(A=deplane.ZAxis, B=repeat)
force_vecs = Vector(multiplication_4)
division_2 = Division(A=force_vecs, B=1000)
loads = LoadsKaramba(ForceVector=division_2, Local=False, PosInd=cp_2.CPIndex, LCase=0, mode="Point")
item_2 = ListItem(List=demesh_2.Faces, Index=2, Wrap=True)
item_3 = ListItem(List=demesh_2.Faces, Index=Slider(30, range=0..100), Wrap=True)
number_slider_12 = Slider(9, range=0..10)
index = ItemIndex(List=meshtoshell.Point, Item=meshtoshell.Point)
matprops = MaterialPropertiesKaramba(
    ElementsIdentifiers=index,
    YoungsModulus_kN_cm2=21000,
    ShearModulus_kN_cm2=8076,
    SpecificWeight_kN_m3=multiplication_2,
    CoefficientOfThermalExpansion_1_C=1e-05,
    YieldStrength_kN_cm2=multiplication_3,
    Name="S235")
loads_2 = LoadsKaramba(Vector=Vector(0, 0, -1), LCase=0, mode="Gravity")
medges_2 = MeshEdges(Mesh=tri.Mesh)  # -> NakedEdges, InteriorEdges, NonManifoldEdges
face = MeshFace([item_3, item_2])
lng = ListLength(List=face)
panel = Panel(multiplication_4)
repeat_2 = RepeatData(Data=Slider(1, range=0..1), Length=lng)
Z_2 = UnitZ(Factor=repeat_2)
multiplication_5 = Multiplication(A=Z_2, B=-10000)
vdis = VectorDisplay(Anchor=branch_2, Vector=unitize(multiplication_4))
dispmeshfaces = DispMeshFaces(L=demesh_2.Vertices, L_2=demesh_2.Vertices, L_3=demesh_2.Vertices, F=face)
mistran = MiStrAn(
    Run=Toggle(False),
    Mesh=tri.Mesh,
    BC=branch,
    LoadPoints=branch_2,
    LoadVectors=multiplication_4,
    DistLoadVFaces=face,
    DistLoadPts=multiplication_5)  # -> Displacements, Rotations, Reactions, DeformedMesh
cross_sections = CrossSectionsKaramba(Heights_cm=Slider(10, range=0..10), mode="Shell")
assemble = AssembleModelKaramba(
    Point=meshtoshell.Point,
    Elem=meshtoshell.Element,
    Support=supp,
    Load=loads_2,
    CrossSection=cross_sections,
    Material=matprops,
    LimitDistance_m=0.005)  # -> Model, Info, Mass_kg, CenterOfGravity
analyzethi = AnalyzeThIKaramba(Model=assemble.Model)  # -> CalculatedModel, MaximumDisplacement_m, ResultingForceOfGravity_kN, ElasticEnergy_kNm
shellview = ShellViewKaramba(Model=assemble.Model)  # -> Model, MeshesOfRenderedShells, LegendColors, LegendTags
nodedisp = NodalDisplacementsKaramba(AnalyzedModel=analyzethi.CalculatedModel)  # -> AnalyzedModel, NodalTranslations_m, NodalRotations_rad
srf_2 = Surface(dispmeshfaces)
mesh_2 = Mesh(mistran.DeformedMesh)
devec = DeconstructVector(Vector=mistran.Displacements)  # -> XComponent, YComponent, ZComponent
z_mistran = Panel(devec.ZComponent)
multiplication_6 = Multiplication(A=nodedisp.NodalTranslations_m, B=1000)
devec_2 = DeconstructVector(Vector=nodedisp.NodalTranslations_m)  # -> XComponent, YComponent, ZComponent
z_karamba = Panel(devec_2.ZComponent)
division_3 = Division(A=devec.ZComponent, B=devec_2.ZComponent)
modelview = ModelViewKaramba(Model=nodedisp.AnalyzedModel, LoadCaseFactorsForLinearSuperposition=1, IndexIncrementOfVisibleLoadcase=0)  # -> Model, DeformedMesh, DeformedAxes, DeformedModel
ratio_z = Panel(division_3)
panel_2 = Panel(multiplication_6)

# ==== cluster DispMeshFaces
F = ClusterInput()
L = ClusterInput()
deface = DeconstructFace(Face=F)  # -> CornerA, CornerB, CornerC, CornerD
L_2 = ClusterInput()
L_3 = ClusterInput()
item = ListItem(List=L, Index=deface.CornerA, Wrap=True)
item_2 = ListItem(List=L_2, Index=deface.CornerB, Wrap=True)
item_3 = ListItem(List=L_3, Index=deface.CornerC, Wrap=True)
srf4pt = _4PointSurface(CornerA=item, CornerB=item_2, CornerC=item_3)
S = ClusterOutput(srf4pt)
