# Grasshopper definition PrincipalDirections_test.gh (Grasshopper 0.9.76)
# plug-ins: Karamba, MiStrAnGH

number_slider = Slider(11, range=0..100)
srf = Surface(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)
mesh_uv = MeshSurface(Surface=srf, UCount=number_slider, VCount=number_slider, Overhang=True, Equalize=False)
number_slider_2 = Slider(2000, range=0..2000)
tri = Triangulate(Mesh=mesh_uv)  # -> Mesh, Count
facen = FaceNormals(Mesh=tri.Mesh)  # -> Centers, Normals
demesh = DeconstructMesh(Mesh=tri.Mesh)  # -> Vertices, Faces, Colours, Normals
X = UnitX(Factor=number_slider_2)
Z = UnitZ(Factor=number_slider_2)
points = PointList(Points=facen.Centers)
pdecon = Deconstruct(Point=demesh.Vertices)  # -> XComponent, YComponent, ZComponent
cset = CreateSet(List=pdecon.XComponent)  # -> Set, Map
equals = Equality(FirstNumber=pdecon.XComponent, SecondNumber=graft(cset.Set))  # -> Equality, Inequality
medges = MeshEdges(Mesh=tri.Mesh)  # -> NakedEdges, InteriorEdges, NonManifoldEdges
number_slider_3 = Slider(9, range=0..10)
cull = CullPattern(List=demesh.Vertices, CullPattern=equals.Equality)
tstat = TreeStatistics(Tree=cull)  # -> Paths, Length, Count
item = ListItem(List=tstat.Paths, Index=0, Wrap=True)  # -> Item1, Item
cross_sections = CrossSectionsKaramba(Heights_cm=Slider(1, range=0..1), mode="Shell")
branch = TreeBranch(Tree=cull, Path=item.Item1, MaintainPaths=True)
load_pts = Point(branch)
branch_2 = TreeBranch(Tree=cull, Path=item.Item, MaintainPaths=True)
bc_points = Point(branch_2)
support = CreateSupport(
    Point=branch_2,
    SupportInXDirection=True,
    SupportInYDirection=True,
    SupportInZDirection=True,
    SupportInXXDirection=True,
    SupportInYYDirection=True,
    SupportInZZDirection=True)
mesh = Mesh(tri.Mesh)
mesh_2 = Mesh(mesh)
medges_2 = MeshEdges(Mesh=mesh_2)  # -> NakedEdges, InteriorEdges, NonManifoldEdges
demesh_2 = DeconstructMesh(Mesh=mesh_2)  # -> Vertices, Faces, Colours, Normals
cp = ClosestPoint(Point=bc_points, Cloud=demesh_2.Vertices)  # -> ClosestPoint, CPIndex, Distance
cp_2 = ClosestPoint(Point=load_pts, Cloud=demesh_2.Vertices)  # -> ClosestPoint, CPIndex, Distance
meshtoshell = MeshToShellKaramba(Point=demesh_2.Vertices, Mesh=mesh_2, LDist=0.005)  # -> Point, Element, Info
supp = SupportKaramba(PosInd=cp.CPIndex, menu=[buttons(on, on, on, on, on, on)])
index = ItemIndex(List=meshtoshell.Point, Item=meshtoshell.Point)
matprops = MaterialPropertiesKaramba(
    ElementsIdentifiers=index,
    YoungsModulus_kN_cm2=21000,
    ShearModulus_kN_cm2=8076,
    SpecificWeight_kN_m3=Slider(0, range=0..100),
    CoefficientOfThermalExpansion_1_C=1e-05,
    YieldStrength_kN_cm2=Slider(500, range=0..1000),
    Name="S235")
Y = UnitY(Factor=Slider(100, range=0..100))
force_vecs = Vector(Y)
loads = LoadsKaramba(ForceVector=force_vecs, Local=False, PosInd=cp_2.CPIndex, LCase=0, mode="Point")
assemble = AssembleModelKaramba(
    Point=meshtoshell.Point,
    Elem=meshtoshell.Element,
    Support=supp,
    Load=loads,
    CrossSection=cross_sections,
    Material=matprops,
    LimitDistance_m=0.005)  # -> Model, Info, Mass_kg, CenterOfGravity
analyzethi = AnalyzeThIKaramba(Model=assemble.Model)  # -> CalculatedModel, MaximumDisplacement_m, ResultingForceOfGravity_kN, ElasticEnergy_kNm
support_2 = CreateSupport(
    Point=branch_2,
    SupportInYDirection=True,
    SupportInZDirection=True,
    SupportInXXDirection=True,
    SupportInYYDirection=True,
    SupportInZZDirection=True,
    SupportInZZDirection_2=True)
facen_2 = FaceNormals(Mesh=tri.Mesh)  # -> Centers, Normals
nodedisp = NodalDisplacementsKaramba(AnalyzedModel=analyzethi.CalculatedModel)  # -> AnalyzedModel, NodalTranslations_m, NodalRotations_rad
section = Section(
    EModulusInLongitudinalDirection_GPa=210,
    EModulusInTransverseDirection_GPA=210,
    LongitudinalShearModulus_GPA=79.3,
    PoissonsRatio=0.3,
    LaminaThickness_mm=10,
    Angles_degree=0,
    Density_kg_m_3=7800)
points_2 = PointList(Points=facen_2.Centers, Size=Slider(0.5, range=0..1))
modelview = ModelViewKaramba(Model=nodedisp.AnalyzedModel, LoadCaseFactorsForLinearSuperposition=1, IndexIncrementOfVisibleLoadcase=0)  # -> Model, DeformedMesh, DeformedAxes, DeformedModel
pointload = MiStrAnPointload(Point=branch, ForceVector_kN=Y)
facen_3 = FaceNormals(Mesh=mesh)  # -> Centers, Normals
crv = Curve([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])
assemble_2 = MiStrAnAssembleStructure(Mesh=mesh, MiStrAnSupports=support, MiStrAnLoads=pointload, GeneratedSection=section)
end = EndPoints(Curve=crv)  # -> Start, End
points_3 = PointList(Points=end.Start, Size=Slider(2, range=0..10))
shellvecresults = ResultVectorsOnShellsKaramba(AnalyzedModel=analyzethi.CalculatedModel, LayerOfResults=0, mode="PrincStress")  # -> AnalyzedModel, Points, FirstPrincipalStressDirection_kN_cm2, SecondPrincipalStressDirection_kN_cm2
pstrainsapp = PrincipalStrainsApproximationKaramba(
    AnalyzedModel=analyzethi.CalculatedModel,
    DeformedModel=modelview.DeformedModel,
    Point=facen_3.Centers,
    Scale=Slider(1000, range=0..1000))  # -> AnalyzedModel, Points, FirstPrincipalStrainDirection, SecondPrincipalStrainDirection
alignmattocurves = AlignMaterialAxisWithCurvesComponent(Structure=assemble_2, DirectionCurves=crv)
analyse = MiStrAnAnalyseStructure(Run=Toggle(True), MiStrAnStructure=assemble_2)  # -> AnalysedStructure, Displacements, Rotations, Reactions, PrincipalStresses, PrincipalStressAngles, VonMisesStresses
s_forces = ShellForcesKaramba(AnalyzedModel=analyzethi.CalculatedModel)  # -> AnalyzedModel, FirstPrincipalForce_kN_m, SecondPrincipalForce_kN_m, FirstPrincipalMoment_kN, SecondPrincipalMoment_kN, ShearForceIn1stDirection_kN_m, ShearForceIn2ndDirection_kN_m
number_slider_4 = Slider(1, range=0..1)
drawcoordsys = DrawElementCoordinateSystem(Structure=analyse.AnalysedStructure)
drawmataxis = DrawMaterialAxis(Structure=alignmattocurves)
drawprincarrows = DrawPrincipalstressArrows(Structure=analyse.AnalysedStructure)
