# Grasshopper definition ShellBalk_SS.gh (Grasshopper 0.9.76)
# plug-ins: MiStrAnGH

number_slider = Slider(1, range=0..10)
height_width = Number(Slider(0.1, range=0..0.1))
length = Number(Slider(10, range=0..1000))
analytical = Panel("0.7326")
Z = UnitZ(Factor=height_width)
division = Division(A=Z, B=2)
dom = ConstructDomain(DomainStart=expr("-x/2", length), DomainEnd=expr("x/2", length))
dom_2 = ConstructDomain(DomainStart=expr("-x/2", height_width), DomainEnd=expr("x/2", height_width))
xy = XYPlane(Origin=Point(0, 0, 0))
xy_2 = XYPlane(Origin=Z)
xz = XZPlane(Origin=division)
mesh_density = Number(Slider(100, range=0..1000))
rectangle = Rectangle(Plane=[xy, xy_2, xz], XSize=dom, YSize=dom_2, Radius=0)  # -> Rectangle, Length
division_2 = Division(A=mesh_density, B=25)
make_even = CSharpScript(x=division_2)  # -> A; inputs x: Int32
# ---------- make_even: C# ----------
      if(x%2.0 == 0)
      A = x;
    else
      A = x + 1;
# ---------- end make_even ----------
mplane = MeshPlane(Boundary=rectangle.Rectangle, WidthCount=mesh_density, HeightCount=make_even)  # -> Mesh, Area
tri = Triangulate(Mesh=mplane.Mesh)  # -> Mesh, Count
mjoin = MeshJoin(Meshes=tri.Mesh)
cullmesh = CullMesh(M=mjoin)
mesh = Mesh(cullmesh)
medges = MeshEdges(Mesh=mesh)  # -> NakedEdges, InteriorEdges, NonManifoldEdges
demesh = DeconstructMesh(Mesh=mesh)  # -> Vertices, Faces, Colours, Normals
sort_pt = SortPoints(Points=demesh.Vertices)  # -> Points, Indices
item = ListItem(List=sort_pt.Points, Index=0, Wrap=True)  # -> Item1, Item
pdecon = Deconstruct(Point=sort_pt.Points)  # -> XComponent, YComponent, ZComponent
pdecon_2 = Deconstruct(Point=[item.Item, item.Item1])  # -> XComponent, YComponent, ZComponent
equals = Equality(FirstNumber=graft(pdecon_2.XComponent), SecondNumber=pdecon.XComponent)  # -> Equality, Inequality
cull = CullPattern(List=sort_pt.Points, CullPattern=equals.Equality)
pdecon_3 = Deconstruct(Point=cull)  # -> XComponent, YComponent, ZComponent
equals_2 = Equality(FirstNumber=pdecon_3.ZComponent, SecondNumber=0)  # -> Equality, Inequality
cull_2 = CullPattern(List=cull, CullPattern=equals_2.Equality)
bang = ExplodeTree(Data=simplify(cull_2))  # -> Branch0, Branch1
item_2 = ListItem(List=demesh.Vertices, Index=35, Wrap=True)
bc = Point(flatten(cull_2))
number_slider_2 = Slider(0.01, range=0..0.01)
toggle = BooleanToggle(False)
Z_2 = UnitZ(Factor=0)
triangle = MeshTriangle(CornerA=0, CornerB=1, CornerC=2)
mesh_2 = Mesh(mesh)
support = CreateSupport(
    Point=bc,
    SupportInXDirection="false",
    SupportInYDirection=True,
    SupportInZDirection=True,
    SupportInXXDirection="false",
    SupportInYYDirection="false",
    SupportInZZDirection="false")
support_2 = CreateSupport(
    Point=item_2,
    SupportInXDirection=True,
    SupportInYDirection="false",
    SupportInZDirection="false",
    SupportInXXDirection="false",
    SupportInYYDirection="false",
    SupportInZZDirection="false")
section = Section(
    EModulusInLongitudinalDirection_GPa=210,
    EModulusInTransverseDirection_GPA=210,
    LongitudinalShearModulus_GPA=79.3,
    PoissonsRatio=0.3,
    LaminaThickness_mm=10,
    Angles_degree=0,
    Density_kg_m_3=7800)
gravity = MiStrAnGravityLoad()
assemble = MiStrAnAssembleStructure(Mesh=mesh_2, MiStrAnSupports=flatten([support, support_2]), MiStrAnLoads=gravity, GeneratedSection=section)
analyse = MiStrAnAnalyseStructure(Run=Toggle(True), MiStrAnStructure=assemble)  # -> AnalysedStructure, Displacements, Rotations, Reactions, PrincipalStresses
visres = VisualiseResults(Structure=analyse.AnalysedStructure, ScaleDeformation=Slider(60, range=0..1000))  # -> DeformedMesh, VonMisesStressPlot
mesh_3 = Mesh(visres.VonMisesStressPlot)
drawprincarrows = DrawPrincipalstressArrows(Structure=analyse.AnalysedStructure)

# ==== cluster CullMesh
M = ClusterInput()
demesh = DeconstructMesh(Mesh=M)  # -> Vertices, Faces, Colours, Normals
deface = DeconstructFace(Face=demesh.Faces)  # -> CornerA, CornerB, CornerC, CornerD
cset = CreateSet(List=demesh.Vertices)  # -> Set, Map
index = ItemIndex(List=cset.Map, Item=cset.Map)
panel = Panel(cset.Map)
replace = ReplaceMembers(Set=deface.CornerB, Find=index, Replace=panel)
replace_2 = ReplaceMembers(Set=deface.CornerC, Find=index, Replace=panel)
replace_3 = ReplaceMembers(Set=deface.CornerA, Find=index, Replace=panel)
triangle = MeshTriangle(CornerA=replace_3, CornerB=replace, CornerC=replace_2)
conmesh = ConstructMesh(Vertices=cset.Set, Faces=triangle)
M_2 = ClusterOutput(conmesh)
