# Grasshopper definition SimpleTestMistranOutOfPlane.gh (Grasshopper 0.9.76)
# plug-ins: Karamba, MiStrAn

number_slider = Slider(1, range=0..100)
number_slider_2 = Slider(1, range=0..1)
number_slider_3 = Slider(1, range=0..10)
xz = XZPlane(Origin=Point(0, 0, 0))
yz = YZPlane(Origin=Point(0, 0, 0))
xy = XYPlane(Origin=Point(0, 0, 0))
pln = Plane(xy)
dom = ConstructDomain(DomainStart=expr("-x/2", number_slider), DomainEnd=expr("x/2", number_slider))
dom_2 = ConstructDomain(DomainStart=expr("-x/2", number_slider), DomainEnd=expr("x/2", number_slider))
number_slider_4 = Slider(2, range=0..10)
addition = Addition(A=number_slider_4, B=1)
planesrf = PlaneSurface(Plane=pln, XSize=dom, YSize=dom_2)
rectangle = Rectangle(Plane=pln, XSize=dom, YSize=dom_2, Radius=0)  # -> Rectangle, Length
division = Division(A=Slider(15, range=0..10000000), B=addition)
deplane = DeconstructPlane(Plane=pln)  # -> Origin, XAxis, YAxis, ZAxis
srf = Surface(planesrf)
repeat = RepeatData(Data=division, Length=addition)
mplane = MeshPlane(Boundary=rectangle.Rectangle, WidthCount=number_slider_4, HeightCount=number_slider_4)  # -> Mesh, Area
sdivide = DivideSurface(Surface=srf, UCount=number_slider_4, VCount=number_slider_4)  # -> simplify(Points), Normals, Parameters
tstat = TreeStatistics(Tree=sdivide.Points)  # -> Paths, Length, Count
item = ListItem(List=tstat.Paths, Index=0, Wrap=True)  # -> Item1, Item
Y = UnitY(Factor=1)
tri = Triangulate(Mesh=mplane.Mesh)  # -> Mesh, Count
demesh = DeconstructMesh(Mesh=tri.Mesh)  # -> Vertices, Faces, Colours, Normals
branch = TreeBranch(Tree=simplify(sdivide.Points), Path=item.Item, MaintainPaths=True)  # -> flatten(Branch)
branch_2 = TreeBranch(Tree=simplify(sdivide.Points), Path=item.Item1, MaintainPaths=True)  # -> flatten(Branch)
number_slider_5 = Slider(78, range=0..10000)
multiplication = Multiplication(A=Y, B=repeat)
points = PointList(Points=demesh.Vertices, Size=Slider(0.2, range=0..1))
medges = MeshEdges(Mesh=tri.Mesh)  # -> NakedEdges, InteriorEdges, NonManifoldEdges
lng = ListLength(List=demesh.Faces)
number_slider_6 = Slider(1000, range=0..1000)
series = Series(Start=0, Step=0, Count=lng)
panel = Panel(multiplication)
division_2 = Division(A=multiplication, B=1000)
vdis = VectorDisplay(Anchor=branch_2, Vector=unitize(multiplication))
Z = UnitZ(Factor=series)
deface = DeconstructFace(Face=demesh.Faces)  # -> CornerA, CornerB, CornerC, CornerD
item_2 = ListItem(List=demesh.Vertices, Index=deface.CornerA, Wrap=True)
mistran = MiStrAn(
    Run=Toggle(False),
    Mesh=tri.Mesh,
    BC=branch,
    LoadPoints=branch_2,
    LoadVectors=multiplication,
    DistLoadVFaces=demesh.Faces,
    DistLoadVecs=Z)  # -> Displacements, Rotations, Reactions, DefMesh
multiplication_2 = Multiplication(A=Slider(7.8, range=0..10), B=9.82)
item_3 = ListItem(List=demesh.Vertices, Index=deface.CornerB, Wrap=True)
item_4 = ListItem(List=demesh.Vertices, Index=deface.CornerC, Wrap=True)
loads = LoadsKaramba(ForceVector=division_2, Local=False, PosInd=branch_2, LCase=0, mode="Point")
multiplication_3 = Multiplication(A=multiplication_2, B=number_slider_6)
srf4pt = _4PointSurface(CornerA=item_2, CornerB=item_3, CornerC=item_4)
supp = SupportKaramba(PosInd=branch, menu=[buttons(on, on, on, on, on, on)])
mesh = Mesh(mistran.DefMesh)
meshtoshell = MeshToShellKaramba(Mesh=tri.Mesh, LDist=0.005)  # -> Point, Element, Info
devec = DeconstructVector(Vector=mistran.Displacements)  # -> XComponent, YComponent, ZComponent
Z_2 = UnitZ(Factor=-1)
item_5 = ListItem(List=srf4pt, Index=Slider(7, range=0..10), Wrap=True)
matprops = MaterialPropertiesKaramba(
    YoungsModulus_kN_cm2=21000,
    ShearModulus_kN_cm2=8076,
    SpecificWeight_kN_m3=multiplication_3,
    CoefficientOfThermalExpansion_1_C=1e-05,
    YieldStrength_kN_cm2=number_slider_6,
    Name="S235")
# Karamba
index = ItemIndex(List=meshtoshell.Point, Item=meshtoshell.Point)
cross_sections = CrossSectionsKaramba(ElementsIdentifiers=index, Heights_cm=Slider(10, range=0..10), mode="Shell")
loads_2 = LoadsKaramba(Vector=Z_2, LCase=0, mode="Gravity")
load = LoadKaramba(flatten([loads, loads_2]))
assemble = AssembleModelKaramba(
    Point=meshtoshell.Point,
    Elem=meshtoshell.Element,
    Support=supp,
    Load=loads_2,
    CrossSection=cross_sections,
    Material=matprops,
    LimitDistance_m=0.005)  # -> Model, Info, Mass_kg, CenterOfGravity
panel_2 = Panel(devec.ZComponent)
panel_3 = Panel(devec.XComponent)
c_script = CSharpScript(x=devec.ZComponent)  # -> out, A; inputs x: list of Double
# ---------- c_script: C# ----------
    List < double > Aa = new List <double>();

    foreach(double d in x)
    {
      if(d == 0)
        Aa.Add(1);
      else
        Aa.Add(d);
    }

    A = Aa;
# ---------- end c_script ----------
analyzethi = AnalyzeThIKaramba(Model=assemble.Model)  # -> CalculatedModel, MaximumDisplacement_m, ResultingForceOfGravity_kN, ElasticEnergy_kNm
nodedisp = NodalDisplacementsKaramba(AnalyzedModel=analyzethi.CalculatedModel)  # -> AnalyzedModel, NodalTranslations_m, NodalRotations_rad
devec_2 = DeconstructVector(Vector=nodedisp.NodalTranslations_m)  # -> XComponent, YComponent, ZComponent
c_script_2 = CSharpScript(x=devec_2.ZComponent)  # -> out, A; inputs x: list of Double; same code as c_script
division_3 = Division(A=c_script.A, B=c_script_2.A)
panel_4 = Panel(division_3)
multiplication_4 = Multiplication(A=devec_2.ZComponent, B=1000)
panel_5 = Panel(devec_2.XComponent)
panel_6 = Panel(multiplication_4)
