# Grasshopper definition SimpleTestMistranVridetPlan.gh (Grasshopper 0.9.76)
# plug-ins: Karamba, MiStrAnGH

number_slider = Slider(1, range=0..100)
number_slider_2 = Slider(1, range=0..1)
number_slider_3 = Slider(1, range=0..10)
xz = XZPlane(Origin=Point(0, 0, 0))
yz = YZPlane(Origin=Point(0, 0, 0))
xy = XYPlane(Origin=Point(0, 0, 0))
pln = Plane(xz)
dom = ConstructDomain(DomainStart=expr("-x/2", number_slider), DomainEnd=expr("x/2", number_slider))
dom_2 = ConstructDomain(DomainStart=expr("-x/2", number_slider), DomainEnd=expr("x/2", number_slider))
number_slider_4 = Slider(10, range=0..10000000)
rad = Radians(Degrees=Slider(30, range=0..1000))
prot = RotatePlane(Plane=pln, Angle=rad)
number_slider_5 = Slider(1, range=0..10)
addition = Addition(A=number_slider_5, B=1)
multiplication = Multiplication(A=number_slider_4, B=1000000)
rectangle = Rectangle(Plane=prot, XSize=dom, YSize=dom_2, Radius=0)  # -> Rectangle, Length
planesrf = PlaneSurface(Plane=prot, XSize=dom, YSize=dom_2)
division = Division(A=number_slider_4, B=addition)
deplane = DeconstructPlane(Plane=pln)  # -> Origin, XAxis, YAxis, ZAxis
srf = Surface(planesrf)
repeat = RepeatData(Data=division, Length=addition)
mplane = MeshPlane(Boundary=rectangle.Rectangle, WidthCount=number_slider_5, HeightCount=number_slider_5)  # -> Mesh, Area
sdivide = DivideSurface(Surface=srf, UCount=number_slider_5, VCount=number_slider_5)  # -> simplify(Points), Normals, Parameters
tstat = TreeStatistics(Tree=sdivide.Points)  # -> Paths, Length, Count
Z = UnitZ(Factor=1)
Y = UnitY(Factor=1)
item = ListItem(List=tstat.Paths, Index=0, Wrap=True)  # -> Item1, Item
Z_2 = UnitZ(Factor=1)
tri = Triangulate(Mesh=mplane.Mesh)  # -> Mesh, Count
demesh = DeconstructMesh(Mesh=tri.Mesh)  # -> Vertices, Faces, Colours, Normals
vrot = Rotate(Vector=Y, Axis=Z_2, Angle=rad)
branch = TreeBranch(Tree=simplify(sdivide.Points), Path=item.Item, MaintainPaths=True)  # -> flatten(Branch)
branch_2 = TreeBranch(Tree=simplify(sdivide.Points), Path=item.Item1, MaintainPaths=True)  # -> flatten(Branch)
multiplication_2 = Multiplication(A=Z_2, B=repeat)
points = PointList(Points=demesh.Vertices, Size=Slider(0.2, range=0..1))
index = ItemIndex(List=demesh.Faces, Item=demesh.Faces)
item_2 = ListItem(List=demesh.Faces, Index=0, Wrap=True)
medges = MeshEdges(Mesh=tri.Mesh)  # -> NakedEdges, InteriorEdges, NonManifoldEdges
Z_3 = UnitZ(Factor=0)
panel = Panel(multiplication_2)
number_slider_6 = Slider(1000, range=0..1000)
number_slider_7 = Slider(10, range=0..10)
division_2 = Division(A=multiplication_2, B=1000)
vdis = VectorDisplay(Anchor=branch_2, Vector=unitize(multiplication_2))
deface = DeconstructFace(Face=demesh.Faces)  # -> CornerA, CornerB, CornerC, CornerD
division_3 = Division(A=number_slider_7, B=100)
multiplication_3 = Multiplication(A=Slider(7.8, range=0..10), B=9.82)
item_3 = ListItem(List=demesh.Vertices, Index=deface.CornerA, Wrap=True)
item_4 = ListItem(List=demesh.Vertices, Index=deface.CornerB, Wrap=True)
item_5 = ListItem(List=demesh.Vertices, Index=deface.CornerC, Wrap=True)
loads = LoadsKaramba(ForceVector=division_2, Local=False, PosInd=branch_2, LCase=0, mode="Point")
multiplication_4 = Multiplication(A=multiplication_3, B=number_slider_6)
section = Section(
    IndexesOfFaces=index,
    EModulusInLongitudinalDirection=Slider(4, range=0..10),
    EModulusInTransverseDirection=Slider(3, range=0..10),
    LongitudinalShearModulus=Slider(3, range=0..10),
    PoissonsRatio=Slider(5, range=0..10),
    LaminaThickness=Slider(3, range=0..10),
    AnglesInDegree=Slider(4, range=0..10),
    Density_kg_m_3=Slider(4, range=0..10))
mistran = MiStrAn(
    Run=Toggle(False),
    Mesh=tri.Mesh,
    BC=branch,
    LoadPoints=branch_2,
    LoadVectors=multiplication_2,
    DistLoadVFaces=item_2,
    DistLoadVecs=Z_3)  # -> Displacements, Rotations, Reactions, DeformedMesh, PrincipalStresses
supp = SupportKaramba(PosInd=branch, menu=[buttons(on, on, on, on, on, on)])
meshtoshell = MeshToShellKaramba(Mesh=tri.Mesh, LDist=0.005)  # -> Point, Element, Info
srf4pt = _4PointSurface(CornerA=item_3, CornerB=item_4, CornerC=item_5)
load = LoadKaramba(flatten(loads))
item_6 = ListItem(List=srf4pt, Index=0, Wrap=True)
matprops = MaterialPropertiesKaramba(
    YoungsModulus_kN_cm2=21000,
    ShearModulus_kN_cm2=8076,
    SpecificWeight_kN_m3=Slider(0, range=0..100),
    CoefficientOfThermalExpansion_1_C=1e-05,
    YieldStrength_kN_cm2=number_slider_6,
    Name="S235")
# Karamba
index_2 = ItemIndex(List=meshtoshell.Point, Item=meshtoshell.Point)
cross_sections = CrossSectionsKaramba(ElementsIdentifiers=index_2, Heights_cm=number_slider_7, mode="Shell")
assemble = AssembleModelKaramba(
    Point=meshtoshell.Point,
    Elem=meshtoshell.Element,
    Support=supp,
    Load=load,
    CrossSection=cross_sections,
    Material=matprops,
    LimitDistance_m=0.005)  # -> Model, Info, Mass_kg, CenterOfGravity
analyzethi = AnalyzeThIKaramba(Model=assemble.Model)  # -> CalculatedModel, MaximumDisplacement_m, ResultingForceOfGravity_kN, ElasticEnergy_kNm
shellvecresults = ResultVectorsOnShellsKaramba(AnalyzedModel=analyzethi.CalculatedModel, LayerOfResults=0, mode="PrincStress")  # -> AnalyzedModel, Points, FirstPrincipalStressDirection_kN_cm2, SecondPrincipalStressDirection_kN_cm2
modelview = ModelViewKaramba(Model=assemble.Model, LoadCaseFactorsForLinearSuperposition=1, IndexIncrementOfVisibleLoadcase=0)  # -> Model, DeformedMesh, DeformedAxes, DeformedModel
vlen = VectorLength(Vector=shellvecresults.FirstPrincipalStressDirection_kN_cm2)
vlen_2 = VectorLength(Vector=shellvecresults.SecondPrincipalStressDirection_kN_cm2)
nodedisp = NodalDisplacementsKaramba(AnalyzedModel=analyzethi.CalculatedModel)  # -> AnalyzedModel, NodalTranslations_m, NodalRotations_rad
shellview = ShellViewKaramba(Model=analyzethi.CalculatedModel)  # -> Model, MeshesOfRenderedShells, LegendColors, LegendTags
multiplication_5 = Multiplication(A=vlen, B=10000000)
multiplication_6 = Multiplication(A=vlen_2, B=10000000)
legend = Legend(Colour=shellview.LegendColors, Tags=shellview.LegendTags, LegendType=1)
