# Grasshopper definition TestCase_beam_1x10x01m.gh (Grasshopper 0.9.76)
# plug-ins: MiStrAn

number_slider = Slider(1, range=0..10)
number_slider_2 = Slider(1, range=0..1)
dom = ConstructDomain(DomainStart=expr("-x/2", number_slider_2), DomainEnd=expr("x/2", number_slider_2))
dom_2 = ConstructDomain(DomainStart=expr("-x/2", number_slider), DomainEnd=expr("x/2", number_slider))
number_slider_3 = Slider(2, range=0..10)
number_slider_4 = Slider(2, range=0..10)
number_slider_5 = Slider(3, range=0..10)
planesrf = PlaneSurface(Plane=PlaneXY(0, 0, 0), XSize=dom_2, YSize=dom)
number_slider_6 = Slider(2, range=0..10)
srf = Surface(planesrf)
multiplication = Multiplication(A=Slider(4, range=0..100), B=10)
panel = Panel("""0
0
0
0
0
0
0
0
0
0
0
0
0""")
sdivide = DivideSurface(Surface=srf, UCount=number_slider_6, VCount=number_slider_6)  # -> Points, Normals, Parameters
del = DelaunayMesh(Points=flatten(sdivide.Points), Plane=PlaneXY(0, 0, 0))
Z = UnitZ(Factor=-1)
branch = TreeBranch(Tree=simplify(sdivide.Points), Path=Slider(0, range=0..100), MaintainPaths=True)  # -> flatten(Branch)
branch_2 = TreeBranch(Tree=simplify(sdivide.Points), Path=Slider(2, range=0..100), MaintainPaths=True)  # -> flatten(Branch)
multiplication_2 = Multiplication(A=Z, B=panel)
demesh = DeconstructMesh(Mesh=del)  # -> Vertices, Faces, Colours, Normals
medges = MeshEdges(Mesh=del)  # -> NakedEdges, InteriorEdges, NonManifoldEdges
number_slider_7 = Slider(1, range=0..10)
mistran = MiStrAn(Run=Toggle(True), Mesh=del, BC=branch, LoadPoints=branch_2, LoadVectors=multiplication_2)  # -> Displacements, Reactions
panel_2 = Panel("""false
false
true
false
false
false""")
points = PointList(Points=demesh.Vertices, Size=Slider(0.1, range=0..0.1))
item = ListItem(List=mistran.Displacements, Index=Slider(1215, range=0..10000), Wrap=True)
cull = CullPattern(List=mistran.Displacements, CullPattern=panel_2)
panel_3 = Panel(item)
panel_4 = Panel(cull)
abs = Absolute(Value=cull)
panel_5 = Panel(mistran.Displacements)
sort = SortList(Keys=abs)  # -> Keys, ValuesA
item_2 = ListItem(List=sort.Keys, Index=0, Wrap=True)  # -> Item1, Item
panel_6 = Panel(item_2.Item1)
panel_7 = Panel(mistran.Reactions)
