# Grasshopper definition TestCase_beam_1x10x01m222222.gh (Grasshopper 0.9.76)
# plug-ins: MiStrAn

number_slider = Slider(1, range=0..10)
number_slider_2 = Slider(1, range=0..1)
xz = XZPlane(Origin=Point(0, 0, 0))
xy = XYPlane(Origin=Point(0, 0, 0))
pln = Plane(xy)
dom = ConstructDomain(DomainStart=expr("-x/2", number_slider), DomainEnd=expr("x/2", number_slider))
dom_2 = ConstructDomain(DomainStart=expr("-x/2", number_slider_2), DomainEnd=expr("x/2", number_slider_2))
number_slider_3 = Slider(3000, range=0..10000)
number_slider_4 = Slider(2, range=0..10)
addition = Addition(A=number_slider_4, B=1)
planesrf = PlaneSurface(Plane=pln, XSize=dom, YSize=dom_2)
rectangle = Rectangle(Plane=pln, XSize=dom, YSize=dom_2, Radius=0)  # -> Rectangle, Length
division = Division(A=Slider(3000000, range=0..10000000), B=addition)
repeat = RepeatData(Data=division, Length=addition)
deplane = DeconstructPlane(Plane=pln)  # -> Origin, XAxis, YAxis, ZAxis
srf = Surface(planesrf)
mplane = MeshPlane(Boundary=rectangle.Rectangle, WidthCount=number_slider_4, HeightCount=number_slider_4)  # -> Mesh, Area
number_slider_5 = Slider(1, range=0..1)
sdivide = DivideSurface(Surface=srf, UCount=number_slider_4, VCount=number_slider_4)  # -> simplify(Points), Normals, Parameters
tstat = TreeStatistics(Tree=sdivide.Points)  # -> Paths, Length, Count
tri = Triangulate(Mesh=mplane.Mesh)  # -> Mesh, Count
item = ListItem(List=tstat.Paths, Index=0, Wrap=True)  # -> Item1, Item
del = DelaunayMesh(Points=flatten(sdivide.Points), Plane=pln)
demesh = DeconstructMesh(Mesh=tri.Mesh)  # -> Vertices, Faces, Colours, Normals
points = PointList(Points=demesh.Vertices, Size=Slider(0.2, range=0..1))
Z = UnitZ(Factor=-1)
branch = TreeBranch(Tree=simplify(sdivide.Points), Path=item.Item1, MaintainPaths=True)  # -> flatten(Branch)
branch_2 = TreeBranch(Tree=simplify(sdivide.Points), Path=item.Item, MaintainPaths=True)  # -> flatten(Branch)
multiplication = Multiplication(A=deplane.YAxis, B=repeat)
item_2 = ListItem(List=sdivide.Points, Index=0, Wrap=True)  # -> flatten(Item)
item_3 = ListItem(List=sdivide.Points, Index=Slider(2, range=0..10), Wrap=True)  # -> flatten(Item)
medges = MeshEdges(Mesh=tri.Mesh)  # -> NakedEdges, InteriorEdges, NonManifoldEdges
panel = Panel(multiplication)
vdis = VectorDisplay(Anchor=item_3, Vector=deplane.XAxis)
panel_2 = Panel("""false
true
false
false
false
false""")
mistran = MiStrAn(Run=Toggle(True), Mesh=tri.Mesh, BC=item_2, LoadPoints=item_3, LoadVectors=multiplication)  # -> Displacements, Reactions
panel_3 = Panel("""true
false
false
false
false
false""")
panel_4 = Panel("""false
false
true
false
false
false""")
item_4 = ListItem(List=mistran.Displacements, Index=Slider(1215, range=0..10000), Wrap=True)
cull = CullPattern(List=mistran.Displacements, CullPattern=panel_3)
cull_2 = CullPattern(List=mistran.Displacements, CullPattern=panel_2)
cull_3 = CullPattern(List=mistran.Displacements, CullPattern=panel_4)
panel_5 = Panel(item_4)
panel_6 = Panel(cull)
vec = VectorXYZ(XComponent=cull, YComponent=cull_2, ZComponent=cull_3)  # -> Vector, Length
vlen = VectorLength(Vector=vec.Vector)
sort = SortList(Keys=vlen)  # -> Keys, ValuesA
item_5 = ListItem(List=sort.Keys, Index=0, Wrap=True)  # -> Item1, Item
panel_7 = Panel(mistran.Displacements)
Y = Panel(cull_2)
panel_8 = Panel(item_5.Item1)
panel_9 = Panel(mistran.Reactions)
