# Grasshopper definition TestCase_beam_Karamba.gh (Grasshopper 0.9.76)
# plug-ins: Karamba

number_slider = Slider(1, range=0..2)
number_slider_2 = Slider(1, range=0..10)
xz = XZPlane(Origin=Point(0, 0, 0))
xy = XYPlane(Origin=Point(0, 0, 0))
pln = Plane(xy)
dom = ConstructDomain(DomainStart=expr("-x/2", number_slider_2), DomainEnd=expr("x/2", number_slider_2))
dom_2 = ConstructDomain(DomainStart=expr("-x/2", number_slider), DomainEnd=expr("x/2", number_slider))
number_slider_3 = Slider(3000, range=0..10000)
number_slider_4 = Slider(2, range=0..10)
addition = Addition(A=number_slider_4, B=1)
planesrf = PlaneSurface(Plane=pln, XSize=dom, YSize=dom_2)
rectangle = Rectangle(Plane=pln, XSize=dom, YSize=dom_2, Radius=0)  # -> Rectangle, Length
number_slider_5 = Slider(3, range=0..10)
division = Division(A=Slider(2000000, range=0..10000000), B=addition)
repeat = RepeatData(Data=division, Length=addition)
deplane = DeconstructPlane(Plane=pln)  # -> Origin, XAxis, YAxis, ZAxis
number_slider_6 = Slider(2000, range=0..2000)
srf = Surface(planesrf)
mplane = MeshPlane(Boundary=rectangle.Rectangle, WidthCount=number_slider_4, HeightCount=number_slider_4)  # -> Mesh, Area
addition_2 = Addition(A=number_slider_4, B=1)
sdivide = DivideSurface(Surface=srf, UCount=number_slider_4, VCount=number_slider_4)  # -> simplify(Points), Normals, Parameters
tstat = TreeStatistics(Tree=sdivide.Points)  # -> Paths, Length, Count
tri = Triangulate(Mesh=mplane.Mesh)  # -> Mesh, Count
item = ListItem(List=tstat.Paths, Index=0, Wrap=True)  # -> Item1, Item
division_2 = Division(A=number_slider_6, B=addition_2)
addition_3 = Addition(A=number_slider_4, B=1)
del = DelaunayMesh(Points=flatten(sdivide.Points), Plane=pln)
multiplication = Multiplication(A=deplane.YAxis, B=repeat)
demesh = DeconstructMesh(Mesh=del)  # -> Vertices, Faces, Colours, Normals
points = PointList(Points=demesh.Vertices, Size=Slider(0.2, range=0..1))
series = Series(Start=0, Step=1, Count=addition_3)
branch = TreeBranch(Tree=simplify(sdivide.Points), Path=item.Item, MaintainPaths=True)  # -> flatten(Branch)
series_2 = Series(Start=expr("x*(x+1)", number_slider_4), Step=1, Count=expr("x+1", number_slider_4))
branch_2 = TreeBranch(Tree=simplify(sdivide.Points), Path=item.Item1, MaintainPaths=True)  # -> flatten(Branch)
X = UnitX(Factor=number_slider_6)
Y = UnitY(Factor=division_2)
Z = UnitZ(Factor=number_slider_6)
vdis = VectorDisplay(Anchor=branch_2, Vector=deplane.YAxis)
medges = MeshEdges(Mesh=del)  # -> NakedEdges, InteriorEdges, NonManifoldEdges
supp = SupportKaramba(PosInd=series, menu=[buttons(on, on, on, on, on, on)])
meshtoshell = MeshToShellKaramba(Mesh=del, LDist=0.005)  # -> Point, Element, Info
item_2 = ListItem(List=meshtoshell.Point, Index=Slider(3, range=0..10), Wrap=True)
item_3 = ListItem(List=meshtoshell.Point, Index=Slider(2, range=0..10), Wrap=True)
loads = LoadsKaramba(ForceVector=Y, Local=False, PosInd=series_2, LCase=0, mode="Point")
panel = Panel(multiplication)
toggle = BooleanToggle(True)
panel_2 = Panel("""false
true
false
false
false
false""")
panel_3 = Panel("""true
false
false
false
false
false""")
index = ItemIndex(List=meshtoshell.Point, Item=meshtoshell.Point)
matprops = MaterialPropertiesKaramba(
    ElementsIdentifiers=index,
    YoungsModulus_kN_cm2=21000,
    ShearModulus_kN_cm2=8076,
    SpecificWeight_kN_m3=Slider(0, range=0..100),
    CoefficientOfThermalExpansion_1_C=1e-05,
    YieldStrength_kN_cm2=Slider(500, range=0..1000),
    Name="S235")
panel_4 = Panel("""false
false
true
false
false
false""")
culln = CullNth(List=index, CullFrequency=Slider(9, range=0..10))
number_slider_7 = Slider(0, range=0..100)
cross_sections = CrossSectionsKaramba(ElementsIdentifiers=culln, Heights_cm=Slider(10, range=0..10), mode="Shell")
assemble = AssembleModelKaramba(
    Point=meshtoshell.Point,
    Elem=meshtoshell.Element,
    Support=supp,
    Load=loads,
    CrossSection=cross_sections,
    Material=matprops,
    LimitDistance_m=0.005)  # -> Model, Info, Mass_kg, CenterOfGravity
analyzethi = AnalyzeThIKaramba(Model=assemble.Model)  # -> CalculatedModel, MaximumDisplacement_m, ResultingForceOfGravity_kN, ElasticEnergy_kNm
item_4 = ListItem(Index=Slider(1215, range=0..10000), Wrap=True)
cull = CullPattern(CullPattern=panel_3)
cull_2 = CullPattern(CullPattern=panel_2)
cull_3 = CullPattern(CullPattern=panel_4)
panel_5 = Panel(item_4)
modelview = ModelViewKaramba(Model=analyzethi.CalculatedModel, LoadCaseFactorsForLinearSuperposition=1, IndexIncrementOfVisibleLoadcase=0)  # -> Model, DeformedMesh, DeformedAxes, DeformedModel
panel_6 = Panel(cull)
vec = VectorXYZ(XComponent=cull, YComponent=cull_2, ZComponent=cull_3)  # -> Vector, Length
panel_7 = Panel(analyzethi.MaximumDisplacement_m)
nodedisp = NodalDisplacementsKaramba(AnalyzedModel=analyzethi.CalculatedModel)  # -> AnalyzedModel, NodalTranslations_m, NodalRotations_rad
mesh = Mesh(modelview.DeformedMesh)
vlen = VectorLength(Vector=vec.Vector)
multiplication_2 = Multiplication(A=nodedisp.NodalTranslations_m, B=Slider(1000, range=0..1000))
sort = SortList(Keys=vlen)  # -> Keys, ValuesA
item_5 = ListItem(List=sort.Keys, Index=0, Wrap=True)  # -> Item1, Item
panel_8 = Panel(multiplication_2)
Y_2 = Panel(cull_2)
panel_9 = Panel(item_5.Item1)
