# Grasshopper definition TestCase_beam_Karamba_sphere.gh (Grasshopper 0.9.76)
# plug-ins: Karamba

number_slider = Slider(10, range=0..10)
number_slider_2 = Slider(13, range=0..100)
number_slider_3 = Slider(4, range=0..10)
number_slider_4 = Slider(3000, range=0..10000)
msphere = MeshSphere(Base=PlaneXY(0, 0, 0), Radius=10, UCount=number_slider_2, VCount=number_slider_2)
tri = Triangulate(Mesh=msphere)  # -> Mesh, Count
addition = Addition(A=Slider(2, range=0..10), B=1)
number_slider_5 = Slider(3, range=0..10)
division = Division(A=Slider(2000000, range=0..10000000), B=addition)
medges = MeshEdges(Mesh=tri.Mesh)  # -> NakedEdges, InteriorEdges, NonManifoldEdges
repeat = RepeatData(Data=division, Length=addition)
deplane = DeconstructPlane(Plane=PlaneXY(0, 0, 0))  # -> Origin, XAxis, YAxis, ZAxis
demesh = DeconstructMesh(Mesh=tri.Mesh)  # -> Vertices, Faces, Colours, Normals
series = Series(Start=0, Step=1, Count=Slider(3, range=0..10))
item = ListItem(List=demesh.Vertices, Index=series, Wrap=True)
number_slider_6 = Slider(2000, range=0..2000)
multiplication = Multiplication(A=deplane.YAxis, B=repeat)
item_2 = ListItem(List=demesh.Vertices, Index=Slider(22, range=0..100), Wrap=True)
X = UnitX(Factor=number_slider_6)
Z = UnitZ(Factor=number_slider_6)
vdis = VectorDisplay(Anchor=item, Vector=deplane.YAxis)
meshtoshell = MeshToShellKaramba(Point=demesh.Vertices, Mesh=tri.Mesh, LDist=0.005)  # -> Point, Element, Info
item_3 = ListItem(List=meshtoshell.Point, Index=Slider(3, range=0..10), Wrap=True)
item_4 = ListItem(List=meshtoshell.Point, Index=Slider(2, range=0..10), Wrap=True)
loads = LoadsKaramba(ForceVector=X, Local=False, PosInd=item_2, LCase=0, mode="Point")
supp = SupportKaramba(PosInd=item, menu=[buttons(on, on, on, on, on, on)])
panel = Panel(multiplication)
toggle = BooleanToggle(False)
panel_2 = Panel("""0
90
45
90
45""")
number_slider_7 = Slider(9, range=0..10)
index = ItemIndex(List=meshtoshell.Point, Item=meshtoshell.Point)
matprops = MaterialPropertiesKaramba(
    ElementsIdentifiers=index,
    YoungsModulus_kN_cm2=21000,
    ShearModulus_kN_cm2=8076,
    SpecificWeight_kN_m3=Slider(0, range=0..100),
    CoefficientOfThermalExpansion_1_C=1e-05,
    YieldStrength_kN_cm2=Slider(500, range=0..1000),
    Name="S235")
cross_sections = CrossSectionsKaramba(Heights_cm=Slider(10, range=0..10), mode="Shell")
assemble = AssembleModelKaramba(
    Point=meshtoshell.Point,
    Elem=meshtoshell.Element,
    Support=supp,
    Load=loads,
    CrossSection=cross_sections,
    Material=matprops,
    LimitDistance_m=0.005)  # -> Model, Info, Mass_kg, CenterOfGravity
analyzethi = AnalyzeThIKaramba(Model=assemble.Model)  # -> CalculatedModel, MaximumDisplacement_m, ResultingForceOfGravity_kN, ElasticEnergy_kNm
nodedisp = NodalDisplacementsKaramba(AnalyzedModel=analyzethi.CalculatedModel)  # -> AnalyzedModel, NodalTranslations_m, NodalRotations_rad
devec = DeconstructVector(Vector=nodedisp.NodalTranslations_m)  # -> XComponent, YComponent, ZComponent
multiplication_2 = Multiplication(A=nodedisp.NodalTranslations_m, B=1000)
modelview = ModelViewKaramba(Model=nodedisp.AnalyzedModel, LoadCaseFactorsForLinearSuperposition=1, IndexIncrementOfVisibleLoadcase=0)  # -> Model, DeformedMesh, DeformedAxes, DeformedModel
panel_3 = Panel(devec.XComponent)
