# Grasshopper definition TestCase_beam_Mistran_sphere.gh (Grasshopper 0.9.76)
# plug-ins: Karamba, MiStrAn

number_slider = Slider(10, range=0..10)
number_slider_2 = Slider(5, range=0..100)
number_slider_3 = Slider(9, range=0..10)
number_slider_4 = Slider(9, range=0..10)
number_slider_5 = Slider(5, range=0..100)
msphere = MeshSphere(Base=PlaneXY(0, 0, 0), Radius=number_slider, UCount=number_slider_2, VCount=number_slider_2)
tri = Triangulate(Mesh=msphere)  # -> Mesh, Count
msphere_2 = MeshSphere(Base=PlaneXY(0, 0, 0), Radius=number_slider, UCount=number_slider_2, VCount=number_slider_2)
medges = MeshEdges(Mesh=tri.Mesh)  # -> NakedEdges, InteriorEdges, NonManifoldEdges
demesh = DeconstructMesh(Mesh=tri.Mesh)  # -> Vertices, Faces, Colours, Normals
tri_2 = Triangulate(Mesh=msphere_2)  # -> Mesh, Count
medges_2 = MeshEdges(Mesh=tri_2.Mesh)  # -> NakedEdges, InteriorEdges, NonManifoldEdges
demesh_2 = DeconstructMesh(Mesh=tri_2.Mesh)  # -> Vertices, Faces, Colours, Normals
series = Series(Start=0, Step=1, Count=Slider(3, range=0..10))
item = ListItem(List=demesh_2.Faces, Index=0, Wrap=True)
points = PointList(Points=demesh_2.Vertices, Size=Slider(0.7, range=0..1))
meshtoshell = MeshToShellKaramba(Point=demesh.Vertices, Mesh=tri.Mesh, LDist=0.005)  # -> Point, Element, Info
item_2 = ListItem(List=meshtoshell.Point, Index=Slider(3, range=0..10), Wrap=True)
item_3 = ListItem(List=demesh_2.Vertices, Index=series, Wrap=True)
item_4 = ListItem(List=meshtoshell.Point, Index=Slider(2, range=0..10), Wrap=True)
supp = SupportKaramba(PosInd=item_3, menu=[buttons(on, on, on, on, on, on)])
X = UnitX(Factor=Slider(1000000, range=0..10000000))
division = Division(A=X, B=1000)
toggle = BooleanToggle(False)
item_5 = ListItem(List=demesh_2.Vertices, Index=Slider(18, range=0..100), Wrap=True)
loads = LoadsKaramba(ForceVector=division, Local=False, PosInd=item_5, LCase=0, mode="Point")
deplane = DeconstructPlane(Plane=PlaneXY(0, 0, 0))  # -> Origin, XAxis, YAxis, ZAxis
number_slider_6 = Slider(1, range=0..100)
index = ItemIndex(List=meshtoshell.Point, Item=meshtoshell.Point)
matprops = MaterialPropertiesKaramba(
    ElementsIdentifiers=index,
    YoungsModulus_kN_cm2=21000,
    ShearModulus_kN_cm2=8076,
    SpecificWeight_kN_m3=Slider(0, range=0..100),
    CoefficientOfThermalExpansion_1_C=1e-05,
    YieldStrength_kN_cm2=Slider(1000, range=0..1000),
    Name="S235")
Z = UnitZ(Factor=0)
division_2 = Division(A=number_slider_6, B=100)
vdis = VectorDisplay(Anchor=item_3, Vector=deplane.YAxis)
mistran = MiStrAn(
    Run=Toggle(False),
    Mesh=tri_2.Mesh,
    BC=item_3,
    LoadPoints=item_5,
    LoadVectors=X,
    DistLoadVFaces=item,
    DistLoadVecs=Z,
    Thickness=division_2)  # -> Displacements, Rotations, Reactions, DeformedMesh, PrincipalStresses
cross_sections = CrossSectionsKaramba(Heights_cm=number_slider_6, mode="Shell")
assemble = AssembleModelKaramba(
    Point=meshtoshell.Point,
    Elem=meshtoshell.Element,
    Support=supp,
    Load=loads,
    CrossSection=cross_sections,
    Material=matprops,
    LimitDistance_m=0.005)  # -> Model, Info, Mass_kg, CenterOfGravity
analyzethi = AnalyzeThIKaramba(Model=assemble.Model)  # -> CalculatedModel, MaximumDisplacement_m, ResultingForceOfGravity_kN, ElasticEnergy_kNm
shellvecresults = ResultVectorsOnShellsKaramba(AnalyzedModel=analyzethi.CalculatedModel, LayerOfResults=0, mode="PrincStress")  # -> AnalyzedModel, Points, FirstPrincipalStressDirection_kN_cm2, SecondPrincipalStressDirection_kN_cm2
vlen = VectorLength(Vector=shellvecresults.FirstPrincipalStressDirection_kN_cm2)
vlen_2 = VectorLength(Vector=shellvecresults.SecondPrincipalStressDirection_kN_cm2)
devec = DeconstructVector(Vector=mistran.PrincipalStresses)  # -> XComponent, YComponent, ZComponent
nodedisp = NodalDisplacementsKaramba(AnalyzedModel=analyzethi.CalculatedModel)  # -> AnalyzedModel, NodalTranslations_m, NodalRotations_rad
devec_2 = DeconstructVector(Vector=mistran.Displacements)  # -> XComponent, YComponent, ZComponent
multiplication = Multiplication(A=vlen, B=10000000)
multiplication_2 = Multiplication(A=vlen_2, B=10000000)
panel = Panel(devec.XComponent)
panel_2 = Panel(devec.YComponent)
devec_3 = DeconstructVector(Vector=nodedisp.NodalTranslations_m)  # -> XComponent, YComponent, ZComponent
modelview = ModelViewKaramba(Model=nodedisp.AnalyzedModel, LoadCaseFactorsForLinearSuperposition=1, IndexIncrementOfVisibleLoadcase=0)  # -> Model, DeformedMesh, DeformedAxes, DeformedModel
panel_3 = Panel(multiplication)
panel_4 = Panel(multiplication_2)
division_3 = Division(A=panel, B=panel_3)
ratio_karamba_vs_team_olsson = Panel(division_3)
