# Grasshopper definition TestRhinoShape.gh (Grasshopper 0.9.76)
# plug-ins: MiStrAn

srf = Surface(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)
sdivide = DivideSurface(Surface=srf, UCount=10, VCount=10)  # -> Points, Normals, Parameters
neg = Negative(Value=Slider(10000, range=0..10000))
Z = UnitZ(Factor=neg)
item = ListItem(List=sdivide.Points, Index=0, Wrap=True)  # -> flatten(Item1), flatten(Item)
del = DelaunayMesh(Points=flatten(sdivide.Points), Plane=PlaneXY(0, 0, 0))
triangle = MeshTriangle(CornerA=0, CornerB=1, CornerC=2)
lng = ListLength(List=item.Item)
medges = MeshEdges(Mesh=del)  # -> NakedEdges, InteriorEdges, NonManifoldEdges
dup = DuplicateData(Data=Z, Number=lng, Order=True)
mistran = MiStrAn(Run=Toggle(True), Mesh=del, BC=item.Item1, LoadPoints=item.Item, LoadVectors=dup)  # -> Displacements, Reactions, DefMesh
panel = Panel("""true
false
false
false
false
false""")
shift = ShiftList(List=panel, Shift=-1, Wrap=True)
shift_2 = ShiftList(List=panel, Shift=-2, Wrap=True)
cull = CullPattern(List=mistran.Displacements, CullPattern=shift)
cull_2 = CullPattern(List=mistran.Displacements, CullPattern=panel)
cull_3 = CullPattern(List=mistran.Displacements, CullPattern=shift_2)
number_slider = Slider(0.1, range=0..0.1)
number_slider_2 = Slider(0.1, range=0..0.1)
number_slider_3 = Slider(0.001, range=0..0.001)
number_slider_4 = Slider(0.01, range=0..0.01)
vec = VectorXYZ(XComponent=cull_2, YComponent=cull, ZComponent=cull_3)  # -> Vector, Length
demesh = DeconstructMesh(Mesh=del)  # -> Vertices, Faces, Colours, Normals
multiplication = Multiplication(A=vec.Vector, B=Slider(1, range=0..1))
move = Move(Geometry=demesh.Vertices, Motion=multiplication)  # -> Geometry, Transform
conmesh = ConstructMesh(Vertices=move.Geometry, Faces=demesh.Faces)
