# Grasshopper definition Verification1.gh (Grasshopper 0.9.76)
# plug-ins: MiStrAnGH

xy = XYPlane(Origin=Point(0, 0, 0))
number_slider = Slider(1, range=0..1)
number_slider_2 = Slider(10, range=0..10)
number_slider_3 = Slider(1, range=0..10)
pln = Plane(xy)
dom = ConstructDomain(DomainStart=expr("-x/2", number_slider_2), DomainEnd=expr("x/2", number_slider_2))
dom_2 = ConstructDomain(DomainStart=expr("-x/2", number_slider_3), DomainEnd=expr("x/2", number_slider_3))
number_slider_4 = Slider(40, range=0..100)
number_slider_5 = Slider(4, range=0..1000)
planesrf = PlaneSurface(Plane=pln, XSize=dom, YSize=dom_2)
rectangle = Rectangle(Plane=pln, XSize=dom, YSize=dom_2, Radius=0)  # -> Rectangle, Length
X = UnitX(Factor=1)
srf = Surface(planesrf)
mplane = MeshPlane(Boundary=rectangle.Rectangle, WidthCount=number_slider_4, HeightCount=number_slider_5)  # -> Mesh, Area
tri = Triangulate(Mesh=mplane.Mesh)  # -> Mesh, Count
element_vectors = ElementVectors(mesh=tri.Mesh)  # -> V, V_2, V_3
v1 = Vector(element_vectors.V)
v2 = Vector(element_vectors.V_2)
v3 = Vector(element_vectors.V_3)
angle = Angle(VectorA=v1, VectorB=X)  # -> Angle, Reflex
sdivide = DivideSurface(Surface=srf, UCount=number_slider_4, VCount=number_slider_5)  # -> simplify(Points), Normals, Parameters
tstat = TreeStatistics(Tree=sdivide.Points)  # -> Paths, Length, Count
item = ListItem(List=tstat.Paths, Index=0, Wrap=True)  # -> Item1, Item
deg = Degrees(Radians=angle.Angle)
panel = Panel(deg)  # disabled
facen = FaceNormals(Mesh=tri.Mesh)  # -> graft(Centers), Normals
branch = TreeBranch(Tree=simplify(sdivide.Points), Path=item.Item1, MaintainPaths=True)  # -> flatten(Branch)
item_2 = ListItem(List=branch, Index=0, Wrap=True)  # -> Item1, Item
branch_2 = TreeBranch(Tree=simplify(sdivide.Points), Path=item.Item, MaintainPaths=True)  # -> flatten(Branch)
panel_2 = Panel("""45
-45
-45
45""")
medges = MeshEdges(Mesh=tri.Mesh)  # -> NakedEdges, InteriorEdges, NonManifoldEdges
v = Panel("""0.27
0.19
0.19
0.27""")
item_3 = ListItem(List=branch_2, Index=0, Wrap=True)  # -> Item1, Item
gxy = Panel("""7.2
5.5
5.5
7.2""")
pt = Point([item_3.Item1, item_3.Item])
pt_2 = Point([item_2.Item1, item_2.Item])
X_2 = UnitX(Factor=Slider(40000, range=0..100000))
subtraction = Subtraction(A=panel_2, B=graft(deg))
ey = Panel("""10.3
12
12
10.3""")
pointload = MiStrAnPointload(Point=pt_2, ForceVector=X_2)
t = Panel("""1
2
2
1""")
panel_3 = Panel(subtraction)
ex = Panel("""142
45
45
142""")
support = CreateSupport(
    Point=pt,
    SupportInXDirection=True,
    SupportInYDirection=True,
    SupportInZDirection=True,
    SupportInXXDirection=True,
    SupportInYYDirection=True,
    SupportInZZDirection=True)
number_slider_6 = Slider(2, range=0..10)
section = Section(
    FaceCenterPoints=simplify(facen.Centers),
    EModulusInLongitudinalDirection_GPa=ex,
    EModulusInTransverseDirection_GPA=ey,
    LongitudinalShearModulus_GPA=gxy,
    PoissonsRatio=v,
    LaminaThickness_mm=t,
    Angles_degree=simplify(subtraction),
    Density_kg_m_3=7800)  # -> flatten(Generated)
assemble = MiStrAnAssembleStructure(Mesh=tri.Mesh, MiStrAnSupports=support, MiStrAnLoads=pointload, GeneratedSection=section)
analyse = MiStrAnAnalyseStructure(Run=Toggle(False), MiStrAnStructure=assemble)  # -> AnalysedStructure, Displacements, Rotations, Reactions, PrincipalStresses
devec = DeconstructVector(Vector=analyse.Displacements)  # -> XComponent, YComponent, ZComponent
multiplication = Multiplication(A=devec.YComponent, B=10000)
visres = VisualiseResults(Structure=analyse.AnalysedStructure, ScaleDeformation=Slider(129, range=0..1000))  # -> DeformedMesh, VonMisesStressPlot
panel_4 = Panel(multiplication)
multiplication_2 = Multiplication(A=devec.XComponent, B=1000)
mesh = Mesh(visres.DeformedMesh)
panel_5 = Panel(multiplication_2)
medges_2 = MeshEdges(Mesh=mesh)  # -> NakedEdges, InteriorEdges, NonManifoldEdges
item_4 = ListItem(List=panel_5, Index=0, Wrap=True)  # -> Item1, Item
division = Division(A=Slider(7.746, range=0..10), B=item_4.Item1)
panel_6 = Panel(division)

# ==== cluster ElementVectors
mesh = ClusterInput()
mesh_2 = Mesh(mesh)
demesh = DeconstructMesh(Mesh=mesh_2)  # -> Vertices, Faces, Colours, Normals
deface = DeconstructFace(Face=demesh.Faces)  # -> CornerA, CornerB, CornerC, CornerD
item = ListItem(List=demesh.Vertices, Index=deface.CornerA, Wrap=True)
item_2 = ListItem(List=demesh.Vertices, Index=deface.CornerB, Wrap=True)
item_3 = ListItem(List=demesh.Vertices, Index=deface.CornerC, Wrap=True)
vec2pt = Vector2Pt(PointA=item, PointB=item_2, Unitize=True)  # -> Vector, Length
vec2pt_2 = Vector2Pt(PointA=item, PointB=item_3, Unitize=True)  # -> Vector, Length
v1 = Vector(vec2pt.Vector)
v2 = Vector(vec2pt_2.Vector)
xprod = CrossProduct(VectorA=v1, VectorB=v2, Unitize=False)  # -> Vector, Length
v3 = Vector(xprod.Vector)
xprod_2 = CrossProduct(VectorA=v3, VectorB=v1, Unitize=False)  # -> Vector, Length
v2_2 = Vector(xprod_2.Vector)
v1_2 = Vector(v1)
v2_3 = Vector(v2_2)
v3_2 = Vector(v3)
unit = UnitVector(Vector=v1_2)
unit_2 = UnitVector(Vector=v3_2)
unit_3 = UnitVector(Vector=v2_3)
V = ClusterOutput(unit)
V_2 = ClusterOutput(unit_3)
V_3 = ClusterOutput(unit_2)
