# Grasshopper definition Verification2Beam.gh (Grasshopper 0.9.76)
# plug-ins: Karamba, MiStrAnGH

xy = XYPlane(Origin=Point(0, 0, 0))
number_slider = Slider(1, range=0..1)
number_slider_2 = Slider(10, range=0..10)
number_slider_3 = Slider(1, range=0..10)
yz = YZPlane(Origin=Point(0, 0, 0))
X = UnitX(Factor=1)
pln = Plane(xy)
Z = UnitZ(Factor=0.5)
dom = ConstructDomain(DomainStart=expr("-x/2", number_slider_2), DomainEnd=expr("x/2", number_slider_2))
dom_2 = ConstructDomain(DomainStart=expr("-x/2", number_slider_3), DomainEnd=expr("x/2", number_slider_3))
number_slider_4 = Slider(40, range=0..160)
number_slider_5 = Slider(4, range=0..1000)
planesrf = PlaneSurface(Plane=pln, XSize=dom, YSize=dom_2)
rectangle = Rectangle(Plane=pln, XSize=dom, YSize=dom_2, Radius=0)  # -> Rectangle, Length
srf = Surface(planesrf)
rotate = Rotate(Geometry=srf, Angle=1.570796327, Plane=yz)  # -> Geometry, Transform
move = Move(Geometry=srf, Motion=srf)  # -> Geometry, Transform
move_2 = Move(Geometry=rotate.Geometry, Motion=Z)  # -> Geometry, Transform
sdivide = DivideSurface(Surface=move.Geometry, UCount=number_slider_4, VCount=number_slider_5)  # -> simplify(Points), Normals, Parameters
sdivide_2 = DivideSurface(Surface=move_2.Geometry, UCount=number_slider_4, VCount=number_slider_5)  # -> simplify(Points), Normals, Parameters
tstat = TreeStatistics(Tree=sdivide.Points)  # -> Paths, Length, Count
mplane = MeshPlane(Boundary=rectangle.Rectangle, WidthCount=number_slider_4, HeightCount=number_slider_5)  # -> Mesh, Area
tstat_2 = TreeStatistics(Tree=sdivide_2.Points)  # -> Paths, Length, Count
Z_2 = UnitZ(Factor=1)
tri = Triangulate(Mesh=mplane.Mesh)  # -> Mesh, Count
sdivide_3 = DivideSurface(Surface=srf, UCount=number_slider_4, VCount=number_slider_5)  # -> simplify(Points), Normals, Parameters
tstat_3 = TreeStatistics(Tree=sdivide_3.Points)  # -> Paths, Length, Count
yz_2 = YZPlane(Origin=Point(0, 0, 0))
item = ListItem(List=tstat.Paths, Index=0, Wrap=True)  # -> Item1, Item
item_2 = ListItem(List=tstat_2.Paths, Index=0, Wrap=True)  # -> Item1, Item
item_3 = ListItem(List=tstat_3.Paths, Index=0, Wrap=True)  # -> Item1, Item
branch = TreeBranch(Tree=simplify(sdivide_2.Points), Path=item_3.Item1, MaintainPaths=True)  # -> flatten(Branch)
Z_3 = UnitZ(Factor=0.5)
rotate_2 = Rotate(Geometry=tri.Mesh, Angle=1.570796327, Plane=yz_2)  # -> Geometry, Transform
item_4 = ListItem(List=branch, Index=0, Wrap=True)  # -> Item1, Item
branch_2 = TreeBranch(Tree=simplify(sdivide_2.Points), Path=item_2.Item, MaintainPaths=True)  # -> flatten(Branch)
branch_3 = TreeBranch(Tree=simplify(sdivide_3.Points), Path=item_3.Item, MaintainPaths=True)  # -> flatten(Branch)
branch_4 = TreeBranch(Tree=simplify(sdivide.Points), Path=item.Item, MaintainPaths=True)  # -> flatten(Branch)
move_3 = Move(Geometry=tri.Mesh, Motion=Z_2)  # -> Geometry, Transform
move_4 = Move(Geometry=rotate_2.Geometry, Motion=Z_3)  # -> Geometry, Transform
branch_5 = TreeBranch(Tree=simplify(sdivide_3.Points), Path=item.Item1, MaintainPaths=True)
item_5 = ListItem(List=branch_2, Index=0, Wrap=True)  # -> Item1, Item
item_6 = ListItem(List=branch_3, Index=0, Wrap=True)  # -> Item1, Item
item_7 = ListItem(List=branch_4, Index=0, Wrap=True)  # -> Item1, Item
mjoin = MeshJoin(Meshes=[move_4.Geometry, move_3.Geometry, tri.Mesh])
v = Panel("""0.27
0.19
0.27
0.19
0.27""")
gxy = Panel("""7.2
5.5
7.2
5.5
7.2""")
demesh = DeconstructMesh(Mesh=mjoin)  # -> Vertices, Faces, Colours, Normals
pt = Point([item_6.Item1, item_6.Item, item_7.Item1, item_7.Item, item_5.Item1, item_5.Item])
pt_2 = Point([item_4.Item1, item_4.Item])
Z_4 = UnitZ(Factor=Slider(50, range=0..100))
toggle = BooleanToggle(False)
panel = Panel("""45
-45
90
-45
45""")
panel_2 = Panel("""0
0
0
0
0""")
number_slider_6 = Slider(4, range=0..10)
ey = Panel("""10.3
12
10.3
12
10.3""")
pointload = MiStrAnPointload(Point=pt_2, ForceVector_kN=Z_4)
ex = Panel("""142
45
142
45
142""")
number_slider_7 = Slider(1, range=0..1)
support = CreateSupport(
    Point=branch_3,
    SupportInXDirection=True,
    SupportInYDirection=True,
    SupportInZDirection=True,
    SupportInXXDirection=True,
    SupportInYYDirection=True,
    SupportInZZDirection=True)
support_2 = CreateSupport(
    Point=branch_5,
    SupportInXDirection=toggle,
    SupportInYDirection=toggle,
    SupportInZDirection=True,
    SupportInXXDirection=True,
    SupportInYYDirection=True,
    SupportInZZDirection=True)
gravity = MiStrAnGravityLoad()
t = Panel("""1
2
1
2
1""")
deface = DeconstructFace(Face=demesh.Faces)  # -> CornerA, CornerB, CornerC, CornerD
cullpt = CullDuplicates(Points=demesh.Vertices, Tolerance=1e-06, CullMode=3)  # -> Points, Indices, Valence
division = Division(A=number_slider_7, B=10)
supp = SupportKaramba(PosInd=branch_3, menu=[buttons(on, on, on, on, on, on)])
item_8 = ListItem(List=demesh.Vertices, Index=deface.CornerA, Wrap=True)
supp_2 = SupportKaramba(PosInd=branch_5, menu=[buttons(off, off, on, on, on, on)])
item_9 = ListItem(List=demesh.Vertices, Index=deface.CornerB, Wrap=True)
item_10 = ListItem(List=demesh.Vertices, Index=deface.CornerC, Wrap=True)
section = Section(
    EModulusInLongitudinalDirection_GPa=ex,
    EModulusInTransverseDirection_GPA=ey,
    LongitudinalShearModulus_GPA=gxy,
    PoissonsRatio=v,
    LaminaThickness_mm=t,
    Angles_degree=simplify(panel_2),
    Density_kg_m_3=7800)  # -> flatten(Generated)
section_2 = Section(
    EModulusInLongitudinalDirection_GPa=210,
    EModulusInTransverseDirection_GPA=210,
    LongitudinalShearModulus_GPA=79.3,
    PoissonsRatio=0.3,
    LaminaThickness_mm=number_slider_7,
    Angles_degree=0,
    Density_kg_m_3=7800)
cross_sections = CrossSectionsKaramba(Heights_cm=division, mode="Shell")
cp = ClosestPoint(Point=item_8, Cloud=cullpt.Points)  # -> ClosestPoint, CPIndex, Distance
cp_2 = ClosestPoint(Point=item_10, Cloud=cullpt.Points)  # -> ClosestPoint, CPIndex, Distance
cp_3 = ClosestPoint(Point=item_9, Cloud=cullpt.Points)  # -> ClosestPoint, CPIndex, Distance
loads = LoadsKaramba(Vector=Vector(0, 0, -1), LCase=0, mode="Gravity")
matprops = MaterialPropertiesKaramba(
    YoungsModulus_kN_cm2=21000,
    ShearModulus_kN_cm2=Slider(7930, range=0..10000),
    SpecificWeight_kN_m3=Slider(78, range=0..100),
    CoefficientOfThermalExpansion_1_C=1e-05,
    YieldStrength_kN_cm2=23.5,
    Name="S235")
triangle = MeshTriangle(CornerA=cp.CPIndex, CornerB=cp_3.CPIndex, CornerC=cp_2.CPIndex)
conmesh = ConstructMesh(Vertices=cullpt.Points, Faces=triangle)
element_vectors = ElementVectors(mesh=conmesh)  # -> V, V_2, V_3
v3 = Vector(element_vectors.V_3)
v1 = Vector(element_vectors.V)
v2 = Vector(element_vectors.V_2)
angle = Angle(VectorA=v1, VectorB=X)  # -> Angle, Reflex
deg = Degrees(Radians=angle.Angle)
panel_3 = Panel(deg)  # disabled
subtraction = Subtraction(B=graft(deg))
panel_4 = Panel(subtraction)
facen = FaceNormals(Mesh=conmesh)  # -> graft(Centers), Normals
medges = MeshEdges(Mesh=conmesh)  # -> NakedEdges, InteriorEdges, NonManifoldEdges
assemble = MiStrAnAssembleStructure(Mesh=conmesh, MiStrAnSupports=flatten([support, support_2]), MiStrAnLoads=gravity, GeneratedSection=section_2)
meshtoshell = MeshToShellKaramba(Mesh=conmesh, LDist=0.005)  # -> Point, Element, Info
analyse = MiStrAnAnalyseStructure(Run=Toggle(True), MiStrAnStructure=assemble)  # -> AnalysedStructure, Displacements, Rotations, Reactions, PrincipalStresses, PrincipalStressAngles, VonMisesStresses
assemble_2 = AssembleModelKaramba(
    Elem=meshtoshell.Element,
    Support=flatten([supp, supp_2]),
    Load=loads,
    CrossSection=cross_sections,
    Material=matprops,
    LimitDistance_m=0.005)  # -> Model, Info, Mass_kg, CenterOfGravity
number_slider_8 = Slider(3, range=0..1000)
vlen = VectorLength(Vector=analyse.PrincipalStresses)
panel_5 = Panel(vlen)
devec = DeconstructVector(Vector=analyse.PrincipalStresses)  # -> XComponent, YComponent, ZComponent
devec_2 = DeconstructVector(Vector=analyse.Displacements)  # -> XComponent, YComponent, ZComponent
analyzethi = AnalyzeThIKaramba(Model=assemble_2.Model)  # -> CalculatedModel, MaximumDisplacement_m, ResultingForceOfGravity_kN, ElasticEnergy_kNm
multiplication = Multiplication(A=devec_2.YComponent, B=10000)
visres = VisualiseResults(Structure=analyse.AnalysedStructure, ScaleDeformation=Slider(8, range=0..100))  # -> DeformedMesh, VonMisesStressPlot, VonMisesStresses
panel_6 = Panel(multiplication)
division_2 = Division(A=devec.XComponent, B=Slider(100, range=0..100))
c_script = CSharpScript(x=division_2)  # -> out, A; inputs x: list of Double
# ---------- c_script: C# ----------
    double outD = 0;
    foreach(double d in x)
    {
      if(d > outD)
        outD = d;
    }

    A = outD;
# ---------- end c_script ----------
multiplication_2 = Multiplication(A=devec_2.ZComponent, B=1)
mesh = Mesh(visres.DeformedMesh)
panel_7 = Panel(multiplication_2)
medges_2 = MeshEdges(Mesh=mesh)  # -> NakedEdges, InteriorEdges, NonManifoldEdges
panel_8 = Panel(c_script.A)
c_script_2 = CSharpScript(x=panel_7)  # -> out, A; inputs x: list of Double
# ---------- c_script_2: C# ----------
    double outD = 0;
    foreach(double d in x)
    {
      if(d>outD)
        outD = d;
    }
    
    A = outD;
# ---------- end c_script_2 ----------
division_3 = Division(A=visres.VonMisesStresses, B=100000000)
item_11 = ListItem(List=panel_7, Index=0, Wrap=True)  # -> Item1, Item
panel_9 = Panel(c_script_2.A)
c_script_3 = CSharpScript(x=division_3)  # -> out, A; inputs x: list of Double; same code as c_script
panel_10 = Panel(c_script_3.A)
division_4 = Division(A=Slider(0.4097, range=0..1), B=panel_9)
panel_11 = Panel(division_4)

# ==== cluster ElementVectors
mesh = ClusterInput()
mesh_2 = Mesh(mesh)
demesh = DeconstructMesh(Mesh=mesh_2)  # -> Vertices, Faces, Colours, Normals
deface = DeconstructFace(Face=demesh.Faces)  # -> CornerA, CornerB, CornerC, CornerD
item = ListItem(List=demesh.Vertices, Index=deface.CornerA, Wrap=True)
item_2 = ListItem(List=demesh.Vertices, Index=deface.CornerB, Wrap=True)
item_3 = ListItem(List=demesh.Vertices, Index=deface.CornerC, Wrap=True)
vec2pt = Vector2Pt(PointA=item, PointB=item_2, Unitize=True)  # -> Vector, Length
vec2pt_2 = Vector2Pt(PointA=item, PointB=item_3, Unitize=True)  # -> Vector, Length
v1 = Vector(vec2pt.Vector)
v2 = Vector(vec2pt_2.Vector)
xprod = CrossProduct(VectorA=v1, VectorB=v2, Unitize=False)  # -> Vector, Length
v3 = Vector(xprod.Vector)
xprod_2 = CrossProduct(VectorA=v3, VectorB=v1, Unitize=False)  # -> Vector, Length
v2_2 = Vector(xprod_2.Vector)
v1_2 = Vector(v1)
v2_3 = Vector(v2_2)
v3_2 = Vector(v3)
unit = UnitVector(Vector=v1_2)
unit_2 = UnitVector(Vector=v3_2)
unit_3 = UnitVector(Vector=v2_3)
V = ClusterOutput(unit)
V_2 = ClusterOutput(unit_3)
V_3 = ClusterOutput(unit_2)
