# Grasshopper definition export_coord.gh (Grasshopper 0.9.76)

srf = Surface(<surface referenced from the Rhino model>)
sdivide = DivideSurface(Surface=srf, UCount=10, VCount=10)  # -> Points, Normals, Parameters
flip = FlipMatrix(Data=sdivide.Points)
tstat = TreeStatistics(Tree=flip)  # -> Paths, Length, Count
lng = ListLength(List=tstat.Paths)
pdecon = Deconstruct(Point=flip)  # -> XComponent, YComponent, ZComponent
panel = Panel(pdecon.XComponent)
concat = Concatenate(FragmentA=pdecon.XComponent, FragmentB=" ")
concat_2 = Concatenate(FragmentA=concat, FragmentB=pdecon.YComponent)
dup = DuplicateData(Number=lng, Order=True)  # -> graft(Data)
concat_3 = Concatenate(FragmentA=concat_2, FragmentB=" ")
concat_4 = Concatenate(FragmentA=concat_3, FragmentB=pdecon.ZComponent)
panel_2 = Panel(concat_4)
merge = Merge(Data1=simplify(concat_4), Data2=simplify(dup))  # -> flatten(Result)
panel_3 = Panel(merge)
