# Grasshopper definition kaponjar2.gh (Grasshopper 0.9.76)
# plug-ins: Karamba, MiStrAnGH

pipeline = GeometryPipeline(
    GroupByLayer=False,
    GroupByType=False,
    IncludeHidden=True,
    IncludeLocked=True,
    LayerFilter="deckSidesLeft",
    NameFilter="*",
    TypeFilter=4)
pipeline_2 = GeometryPipeline(
    GroupByLayer=False,
    GroupByType=False,
    IncludeHidden=True,
    IncludeLocked=True,
    LayerFilter="deckSidesRight",
    NameFilter="*",
    TypeFilter=4)
pipeline_3 = GeometryPipeline(
    GroupByLayer=False,
    GroupByType=False,
    IncludeHidden=True,
    IncludeLocked=True,
    LayerFilter="sidingRight",
    NameFilter="*",
    TypeFilter=4)
pipeline_4 = GeometryPipeline(
    GroupByLayer=False,
    GroupByType=False,
    IncludeHidden=True,
    IncludeLocked=True,
    LayerFilter="sidingLeft",
    NameFilter="*",
    TypeFilter=4)
pipeline_5 = GeometryPipeline(
    GroupByLayer=False,
    GroupByType=False,
    IncludeHidden=True,
    IncludeLocked=True,
    LayerFilter="deck",
    NameFilter="*",
    TypeFilter=4)
pipeline_6 = GeometryPipeline(
    GroupByLayer=False,
    GroupByType=False,
    IncludeHidden=True,
    IncludeLocked=True,
    LayerFilter="underside_poly",
    NameFilter="*",
    TypeFilter=4)
end = EndPoints(Curve=[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])  # -> Start, End
end_2 = EndPoints(Curve=[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])  # -> Start, End
crv = Curve([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])
crv_2 = Curve([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])
crv_3 = Curve([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])
ln = Line(StartPoint=end.Start, EndPoint=end.End)
ln_2 = Line(StartPoint=end_2.Start, EndPoint=end_2.End)
crv_4 = Curve([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])
reb = RebuildCurve(Curve=crv_2, Count=10, Tangents=False)
reb_2 = RebuildCurve(Curve=crv, Count=3, Tangents=False)
reb_3 = RebuildCurve(Curve=crv_3, Count=10, Tangents=False)
sort_curves = SortCurves(crv=ln)
sort_curves_2 = SortCurves(crv=ln_2)
explode = Explode(Curve=reb_2, Recursive=True)  # -> Segments, Vertices
sort_curves_3 = SortCurves(crv=crv_4)
sort_curves_4 = SortCurves(crv=reb)
sort_curves_5 = SortCurves(crv=reb_3)
sort_curves_6 = SortCurves(crv=reb_2)
crv_5 = Curve(sort_curves)
crv_6 = Curve(sort_curves_2)
crv_7 = Curve(sort_curves_4)
crv_8 = Curve(sort_curves_6)
crv_9 = Curve(sort_curves_5)
crv_10 = Curve(sort_curves_3)
end_3 = EndPoints(Curve=crv_7)  # -> Start, End
loft = Loft(Curves=crv_10, Options={Adjust=False, Closed=False, LoftEnds=0, LoftSimp=0, LoftType=0, Rebuild=10, Refit=0.01})
loft_2 = Loft(Curves=crv_8, Options={Adjust=False, Closed=False, LoftEnds=0, LoftSimp=0, LoftType=0, Rebuild=10, Refit=0.01})
end_4 = EndPoints(Curve=crv_9)  # -> Start, End
intcrv = Interpolate(Vertices=end_3.End, Degree=3, Periodic=False, KnotStyle=1)  # -> Curve, Length, Domain
rails = Curve(intcrv.Curve)
debrep = DeconstructBrep(Brep=loft_2)  # -> Faces, Edges, Vertices
debrep_2 = DeconstructBrep(Brep=loft)  # -> Faces, Edges, Vertices
get_rails = GetRails_2(brep=loft_2)
get_rails_2 = GetRails(brep=loft)
rails_2 = Curve(get_rails_2)
rails_3 = Curve(get_rails_2)
intcrv_2 = Interpolate(Vertices=end_4.Start, Degree=3, Periodic=False, KnotStyle=1)  # -> Curve, Length, Domain
rails_4 = Curve(intcrv_2.Curve)
item = ListItem(List=rails_2, Index=1, Wrap=True)
item_2 = ListItem(List=rails_3, Index=0, Wrap=True)
rails_5 = Curve(get_rails)
rails_6 = Curve(rails_5)
item_3 = ListItem(List=rails_6, Index=0, Wrap=True)  # -> Item, Item1
flip = FlipCurve(Curve=item_3.Item1)  # -> Curve, Flag
swp2 = Sweep2(Rail1=flip.Curve, Rail2=rails_4, Sections=crv_5, SameHeight=False)
swp2_2 = Sweep2(Rail1=rails, Rail2=item_3.Item, Sections=crv_6, SameHeight=False)
end_5 = EndPoints(Curve=item)  # -> Start, End
flip_2 = FlipCurve(Curve=item)  # -> Curve, Flag
swp2_3 = Sweep2(Rail1=flip_2.Curve, Rail2=intcrv.Curve, Sections=crv_7, SameHeight=False)
swp2_4 = Sweep2(Rail1=item_2, Rail2=intcrv_2.Curve, Sections=crv_9, SameHeight=False)
custom_mesh_settings = SettingsCustom(
    StitchSeams=True,
    SimplePlanes=True,
    Refine=False,
    MinCount=16,
    MaxCount=0,
    AspectRatio=Slider(1, range=0..10),
    MaxDistance=0,
    MaxAngle=0,
    MinEdge=0,
    MaxEdge=0)
merge = Merge(Data1=loft, Data2=loft_2, Data3=swp2_4, Data4=swp2_3, Data5=swp2, Data6=swp2_2)  # -> flatten(Result)
number_slider = Slider(10, range=0..10)
join = BrepJoin(Breps=merge)  # -> Breps, Closed
debrep_3 = DeconstructBrep(Brep=join.Breps)  # -> Faces, Edges, Vertices
cap = CapHoles(Brep=join.Breps)
mesh = MeshBrep(Brep=cap, Settings=custom_mesh_settings)
number_slider_2 = Slider(0.001, range=0..0.001)
mesh_uv = MeshSurface(Surface=debrep_3.Faces, UCount=Slider(130, range=0..1000), VCount=Slider(10, range=0..100), Overhang=True, Equalize=True)
mjoin = MeshJoin(Meshes=mesh_uv)
tri = Triangulate(Mesh=mesh)  # -> Mesh, Count
item_4 = ListItem(List=mesh_uv, Index=0, Wrap=True)
tri_2 = Triangulate(Mesh=mjoin)  # -> Mesh, Count
medges = MeshEdges(Mesh=tri_2.Mesh)  # -> NakedEdges, InteriorEdges, NonManifoldEdges
cullmesh = CullMeshVertices(Mesh=tri.Mesh, Tolerance=Slider(0, range=0..0.001))
mesh_2 = Mesh(cullmesh)
medges_2 = MeshEdges(Mesh=cullmesh)  # -> NakedEdges, InteriorEdges, NonManifoldEdges
pt = ConstructPoint(XCoordinate=0, YCoordinate=Slider(1, range=0..1), ZCoordinate=0)
xz = XZPlane(Origin=pt)
split = SplitBrep(Brep=cap, Cutter=xz)
demesh = DeconstructMesh(Mesh=mesh_2)  # -> Vertices, Faces, Colours, Normals
pdecon = Deconstruct(Point=demesh.Vertices)  # -> XComponent, YComponent, ZComponent
sort = SortList(Keys=pdecon.XComponent, ValuesA=demesh.Vertices)  # -> Keys, ValuesA
pdecon_2 = Deconstruct(Point=demesh.Vertices)  # -> XComponent, YComponent, ZComponent
rectangle = Rectangle(Plane=xz, XSize=Domain(-1000, 1000), YSize=Domain(-2000, 2000), Radius=0)  # -> Rectangle, Length
item_5 = ListItem(List=sort.Keys, Index=-1, Wrap=True)
sec = MeshPlane(Mesh=mesh_2, Plane=xz)
sort_2 = SortList(Keys=pdecon_2.ZComponent, ValuesA=demesh.Vertices)  # -> Keys, ValuesA
msplit = MeshSplitPlane(Mesh=mesh_2, Plane=xz)  # -> Above, Below
mesh_3 = Mesh(cullmesh)
equals = Equality(FirstNumber=item_5, SecondNumber=pdecon.XComponent)  # -> Equality, Inequality
item_6 = ListItem(List=sort.ValuesA, Index=0, Wrap=True)
explode_2 = Explode(Curve=sec, Recursive=True)  # -> Segments, Vertices
mplane = MeshPlane(Boundary=rectangle.Rectangle, WidthCount=10, HeightCount=10)  # -> Mesh, Area
series = Series(Start=0, Step=1, Count=Slider(70, range=0..100))
cull = CullPattern(List=demesh.Vertices, CullPattern=equals.Equality)
patch = Patch(Curves=sec, Spans=20, Flexibility=1, Trim=True)
del = DelaunayMesh(Points=explode_2.Vertices, Plane=PlaneXY(0, 0, 0))
pt_2 = Point([Point(-11.97452927, -1.786750555, 1.679330349), Point(-11.3770504, -0.8951234818, 1.673700571), Point(-10.77957058, -0.003496399382, 1.668070793), Point(-10.18209076, 0.8881306648, 1.662441015), Point(-9.584611893, 1.779757738, 1.656811357), Point(-8.987132072, 2.671384811, 1.651181579), Point(-12.81672478, -3.043570757, 1.750768423), Point(-12.7351532, -2.921839714, 1.728832364), Point(-12.57200909, -2.678377628, 1.684960127)])
boundary = BoundarySurfaces(Edges=sec)
mesh_4 = Mesh(boundary)
msplit_2 = MeshSplit(Mesh=mplane.Mesh, Splitters=mesh_3)
item_7 = ListItem(List=sort_2.ValuesA, Index=series, Wrap=True)
msplit_3 = MeshSplitPlane(Plane=PlaneXY(0, 0, 0))  # -> Above, Below
smesh = SimpleMesh(Brep=boundary)
mesh_5 = MeshBrep(
    Brep=boundary,
    Settings={GridMaxCount=0, GridMinCount=16, JaggedSeams=False, MaxEdgeLength=0, MinEdgeLength=0.0001, MinTolerance=0, Refine=False, RefineAngle=0, RelativeTolerance=0.65, SimplePlanes=True, Tolerance=0})
item_8 = ListItem(List=msplit_2, Index=Slider(1, range=0..1), Wrap=True)
support = CreateSupport(
    Point=cull,
    SupportInXDirection="false",
    SupportInYDirection="false",
    SupportInZDirection=True,
    SupportInXXDirection="false",
    SupportInYYDirection="false",
    SupportInZZDirection="false")
support_2 = CreateSupport(
    Point=item_6,
    SupportInXDirection=True,
    SupportInYDirection="false",
    SupportInZDirection="false",
    SupportInXXDirection="false",
    SupportInYYDirection="false",
    SupportInZZDirection="false")
support_3 = CreateSupport(
    Point=item_7,
    SupportInXDirection="false",
    SupportInYDirection=True,
    SupportInZDirection=True,
    SupportInXXDirection="false",
    SupportInYYDirection="false",
    SupportInZZDirection="false")
medges_3 = MeshEdges(Mesh=mesh_5)  # -> NakedEdges, InteriorEdges, NonManifoldEdges
c_script = CSharpScript(x=sec)  # -> out, A; inputs x: Polyline
# ---------- c_script: C# ----------
    A = Mesh.CreateFromClosedPolyline(x);
# ---------- end c_script ----------
medges_4 = MeshEdges(Mesh=c_script.A)  # -> NakedEdges, InteriorEdges, NonManifoldEdges
gravity = MiStrAnGravityLoad()
section = Section(
    EModulusInLongitudinalDirection_GPa=210,
    EModulusInTransverseDirection_GPA=210,
    LongitudinalShearModulus_GPA=79.3,
    PoissonsRatio=0.3,
    LaminaThickness_mm=10,
    Angles_degree=0,
    Density_kg_m_3=7800)
assemble = MiStrAnAssembleStructure(Mesh=mesh_2, MiStrAnSupports=flatten([support, support_2, support_3]), MiStrAnLoads=gravity, GeneratedSection=section)
analyse = MiStrAnAnalyseStructure(Run=Toggle(False), MiStrAnStructure=assemble)  # -> AnalysedStructure, Displacements, Rotations, Reactions, PrincipalStresses, PrincipalStressAngles, VonMisesStresses
license = LicenseKaramba()
sort_3 = SortList(Keys=analyse.VonMisesStresses)  # -> Keys, ValuesA
vlen = VectorLength(Vector=analyse.Displacements)
number_slider_3 = Slider(100, range=0..100)
number_slider_4 = Slider(21, range=0..100)
sort_4 = SortList(Keys=vlen)  # -> Keys, ValuesA
number_slider_5 = Slider(500, range=0..1000)
number_slider_6 = Slider(5000, range=0..10000)
visres = VisualiseResults(
    Structure=analyse.AnalysedStructure,
    ScaleDeformation=Slider(2, range=0..100),
    BottomLimiter=0,
    TopLimiter=Slider(0.25, range=0..1))  # -> DeformedMesh, VonMisesStressPlot
drawprincarrows = DrawPrincipalstressArrows(Structure=analyse.AnalysedStructure)
get_stressed_elements = GetStressedElements(
    MeshToEvaluate=mesh_2,
    PrincipalStressesVector=analyse.PrincipalStresses,
    NbOfHighestStressedElements=Slider(3000, range=0..100000))  # -> NbElementsWithHighestStresses, TheRestOfTheStresses
mesh_6 = Mesh(visres.VonMisesStressPlot)
pt_3 = Point(get_stressed_elements.NbElementsWithHighestStresses)

# ==== cluster SortCurves
crv = ClusterInput()
crv_2 = Curve(crv)
curvepoint = PointOnCurve(crv_2, parameter=0.5)
pdecon = Deconstruct(Point=curvepoint)  # -> XComponent, YComponent, ZComponent
sort = SortList(Keys=pdecon.XComponent, ValuesA=crv_2)  # -> Keys, ValuesA
crv_3 = Curve(sort.ValuesA)
crv_4 = ClusterOutput(crv_3)

# ==== cluster GetRails
brep = ClusterInput()
brep_2 = Brep(brep)
edges = BrepEdges(Brep=brep_2)  # -> Naked, Interior, NonManifold
panel = Panel("""0
1
4
5""")
join = JoinCurves(Curves=edges.Naked, Preserve=False)
disc = Discontinuity(Curve=join, Level=1)  # -> Points, Parameters
item = ListItem(List=disc.Parameters, Index=panel, Wrap=True)
shatter = Shatter(Curve=join, Parameters=item)
cull = CullPattern(List=shatter, CullPattern=[True, False])
crv = Curve(cull)
crv_2 = ClusterOutput(crv)

# ==== cluster GetRails_2
brep = ClusterInput()
brep_2 = Brep(brep)
edges = BrepEdges(Brep=brep_2)  # -> Naked, Interior, NonManifold
panel = Panel("""0
1
3
4""")
join = JoinCurves(Curves=edges.Naked, Preserve=False)
disc = Discontinuity(Curve=join, Level=1)  # -> Points, Parameters
item = ListItem(List=disc.Parameters, Index=panel, Wrap=True)
shatter = Shatter(Curve=join, Parameters=item)
cull = CullPattern(List=shatter, CullPattern=[True, False])
crv = Curve(cull)
crv_2 = ClusterOutput(crv)
