# Grasshopper definition meshTesting.gh (Grasshopper 0.9.76)
# plug-ins: Karamba, Human, MiStrAnGH

number_slider = Slider(387, range=0..1000)
mesh = Mesh(<mesh referenced from the Rhino model>)
brep = Brep([<brep referenced from the Rhino model> x388])
cullmesh = CleanMesh(Mesh=mesh, Tolerance=Slider(0.001, range=0..0.001))  # -> CulledMesh, CulledFaces
brep_2 = Brep(<brep referenced from the Rhino model>)
panel = Panel("""2
5""")
medges = MeshEdges(Mesh=cullmesh.CulledMesh)  # -> NakedEdges, InteriorEdges, NonManifoldEdges
item = ListItem(List=brep, Index=Slider(387, range=0..387), Wrap=True)
number_slider_2 = Slider(0.05, range=0..1)
line = Line(medges.NakedEdges)
number_slider_3 = Slider(0.1, range=0..1)
brep_3 = Brep(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)
brep_4 = Brep(item)
number_slider_4 = Slider(100, range=0..100)
edges = BrepEdges(Brep=brep_4)  # -> Naked, Interior, NonManifold
debrep = DeconstructBrep(Brep=brep_3)  # -> Faces, Edges, Vertices
item_2 = ListItem(List=debrep.Edges, Index=panel, Wrap=True)
item_3 = ListItem(List=item_2, Index=1, Wrap=True)  # -> Item1, Item
equidistant = CSharpScript(C=item_3.Item, D=number_slider_2)  # -> P; inputs C: Curve, D: Double
# ---------- equidistant: C# ----------
    double L = C.GetLength();
    double N = L / D;// -L % D;
    int n = (int) N;

    double[] t = C.DivideByCount(n, true);

    List<Point3d> pts = new List<Point3d>();

    if(t != null)
    {
      for (int i = 0; i < t.Length; i++)
      {
        pts.Add(C.PointAt(t[i]));
      }
    }

    else
    {
      pts.Add(C.PointAtStart);
      pts.Add(C.PointAtEnd);
    }

    P = pts;
# ---------- end equidistant ----------
equidistant_2 = CSharpScript(C=item_3.Item1, D=number_slider_2)  # -> P; inputs C: Curve, D: Double; same code as equidistant
cp = ClosestPoint(Point=equidistant, Cloud=equidistant_2)  # -> ClosestPoint, CPIndex, Distance
number_slider_5 = Slider(0.1, range=0..1)
join = JoinCurves(Curves=edges.Naked, Preserve=False)
len = Length(Curve=edges.Naked)
item_4 = ListItem(List=debrep.Faces, Index=0, Wrap=True)  # -> Item1, Item
equidistant_3 = CSharpScript(C=edges.Naked, D=number_slider_3)  # -> P; inputs C: Curve, D: Double; same code as equidistant
mesh_breps = MeshBreps(
    Brep=brep_4,
    MeshResolution=number_slider_3,
    EdgeRefinementFactor=0.67,
    PointReduction=False,
    SmoothingStepSize=0,
    SmoothingIterations=5)  # -> Mesh, Info
ln = Line(StartPoint=cp.ClosestPoint, EndPoint=equidistant)
end = EndPoints(Curve=simplify(graft(debrep.Edges)))  # -> Start, End
divdist = DivideDistance(Curve=debrep.Edges, Distance=number_slider_5)  # -> simplify(Points), Tangents, Parameters
alongcrv = SortAlongCurve(Points=flatten(equidistant_3), Curve=join)  # -> Points, Indices
equidistant_4 = CSharpScript(C=ln, D=number_slider_2)  # -> P; inputs C: Curve, D: Double; same code as equidistant
tstat = TreeStatistics(Tree=equidistant_3)  # -> Paths, Length, Count
sort = SortList(Keys=len, ValuesA=tstat.Paths)  # -> Keys, reverse(ValuesA)
mesh_2 = Mesh(<mesh referenced from the Rhino model>)
bang = ExplodeTree(Data=[divdist.Points, end.Start, end.End])  # -> Branch0, Branch1, Branch2, Branch3, Branch4, Branch5, Branch6
mesh_breps_2 = MeshBreps(
    Brep=item_4.Item1,
    MeshResolution=number_slider_2,
    EdgeRefinementFactor=0.67,
    PointReduction=False,
    SmoothingStepSize=0,
    SmoothingIterations=5)  # -> Mesh, Info
item_5 = ListItem(List=sort.ValuesA, Index=0, Wrap=True)  # -> Item, Item1
merge = Merge(Data1=bang.Branch0, Data2=bang.Branch1, Data3=bang.Branch2, Data4=bang.Branch3)  # -> flatten(Result)
merge_2 = Merge(Data1=bang.Branch2, Data2=bang.Branch4, Data3=bang.Branch5, Data4=bang.Branch6)
branch = TreeBranch(Tree=equidistant_3, Path=item_5.Item, MaintainPaths=True)
srf_cp = SurfaceClosestPoint(Point=equidistant_4, Surface=item_4.Item1)  # -> Point, flatten(UVPoint), Distance
srf_cp_2 = SurfaceClosestPoint(Point=alongcrv.Points, Surface=brep_4)  # -> Point, UVPoint, Distance
pt = Point(srf_cp_2.UVPoint)
pline = PolyLine(Vertices=pt, Closed=True)
branch_2 = TreeBranch(Tree=equidistant_3, Path=item_5.Item1, MaintainPaths=True)
flip = FlipMatrix(Data=equidistant_4)
entwine = Entwine(Branch00=merge, Branch01=merge_2, FlattenInputs=True)
cp_2 = ClosestPoint(Point=branch, Cloud=branch_2)  # -> ClosestPoint, CPIndex, Distance
pt_2 = Point(pt)
mesh_breps_3 = MeshBreps(
    Brep=graft(debrep.Faces),
    InclusionPoints=entwine,
    MeshResolution=number_slider_5,
    EdgeRefinementFactor=0.67,
    PointReduction=False,
    SmoothingStepSize=1,
    SmoothingIterations=5)  # -> Mesh, Info
item_6 = ListItem(List=flip, Index=0, Wrap=True)  # -> Item1, Item
cull_i = CullIndex(List=branch_2, Indices=cp_2.CPIndex, Wrap=True)
number_slider_6 = Slider(0.001, range=0..0.001)
multiplication = Multiplication(A=number_slider_3, B=0.8)
evalsrf = EvaluateSurface(Surface=item_4.Item1, Point=srf_cp.UVPoint)  # -> Point, Normal, Frame
del = DelaunayMesh(Points=srf_cp.UVPoint, Plane=PlaneXY(0, 0, 0))
mjoin = MeshJoin(Meshes=flatten(mesh_breps_3.Mesh))
cp_3 = ClosestPoint(Point=cull_i, Cloud=branch)  # -> ClosestPoint, CPIndex, Distance
number_slider_7 = Slider(0.005, range=0..0.01)
ma = MassAddition(Input=pt_2)  # -> Result, PartialResults
lng = ListLength(List=pt_2)
ln_2 = Line(StartPoint=branch, EndPoint=cp_2.ClosestPoint)
ln_3 = Line(StartPoint=cull_i, EndPoint=cp_3.ClosestPoint)
cullmesh_2 = CleanMesh(Mesh=mjoin, Tolerance=Slider(0.001, range=0..0.001))  # -> CulledMesh, CulledFaces
demesh = DeconstructMesh(Mesh=del)  # -> Vertices, Faces, Colours, Normals
merge_3 = Merge(Data1=ln_3, Data2=ln_2)  # -> flatten(Result)
equidistant_5 = CSharpScript(C=merge_3, D=number_slider_3)  # -> P; inputs C: Curve, D: Double; same code as equidistant
cullpt = CullDuplicates(Points=flatten(equidistant_5), Tolerance=multiplication, CullMode=3)  # -> Points, Indices, Valence
number_slider_8 = Slider(0.001, range=0..0.001)
medges_2 = MeshEdges(Mesh=cullmesh_2.CulledMesh)  # -> NakedEdges, InteriorEdges, NonManifoldEdges
edges_2 = BrepEdges(Brep=item_4.Item1)  # -> Naked, Interior, NonManifold
conmesh = ConstructMesh(Vertices=evalsrf.Point, Faces=demesh.Faces)
facen = FaceNormals(Mesh=conmesh)  # -> Centers, Normals
srf_cp_3 = SurfaceClosestPoint(Point=facen.Centers, Surface=item_4.Item1)  # -> Point, UVPoint, Distance
demesh_2 = DeconstructMesh(Mesh=conmesh)  # -> Vertices, Faces, Colours, Normals
larger = LargerThan(FirstNumber=srf_cp_3.Distance, SecondNumber=number_slider_7)  # -> LargerThan, OrEqualTo
division = Division(A=ma.Result, B=lng)
entwine_2 = Entwine(Branch00=equidistant_3, Branch01=cullpt.Points, FlattenInputs=True)  # -> flatten(Result)
join_2 = JoinCurves(Curves=edges_2.Naked, Preserve=False)
alongcrv_2 = SortAlongCurve(Points=flatten([item_6.Item1, item_6.Item, equidistant, cp.ClosestPoint]), Curve=join_2)  # -> Points, Indices
merge_4 = Merge(Data1=alongcrv_2.Points, Data2=srf_cp.Point)  # -> flatten(Result)
del_2 = DelaunayMesh(Points=flatten(merge_4), Plane=PlaneXY(0, 0, 0))
line_2 = Line(medges_2.NakedEdges)
pt_3 = Point(division)
ln_4 = Line(StartPoint=pt, EndPoint=pt_3)
srf_cp_4 = SurfaceClosestPoint(Point=entwine_2, Surface=brep_4)  # -> Point, UVPoint, Distance
pline_2 = PolyLine(Vertices=srf_cp_2.UVPoint, Closed=True)
equidistant_6 = CSharpScript(C=ln_4, D=number_slider_3)  # -> flatten(P); inputs C: Curve, D: Double; same code as equidistant
pt_4 = Point(srf_cp_4.UVPoint)
ma_2 = MassAddition(Input=pt_4)  # -> Result, PartialResults
lng_2 = ListLength(List=pt_4)
cullpt_2 = CullDuplicates(Points=alongcrv_2.Points, Tolerance=Slider(0.001, range=0..0.001), CullMode=3)  # -> Points, Indices, Valence
incurve = PointInCurve(Point=equidistant_6, Curve=pline)  # -> Relationship, Point
division_2 = Division(A=ma_2.Result, B=lng_2)
pline_3 = PolyLine(Vertices=cullpt_2.Points, Closed=False)
crv_cp = CurveClosestPoint(Point=facen.Centers, Curve=pline_3)  # -> Point, Parameter, Distance
smaller = SmallerThan(FirstNumber=number_slider_7, SecondNumber=crv_cp.Distance)  # -> SmallerThan, OrEqualTo
and = GateAnd(A=invert(larger.LargerThan), B=smaller.SmallerThan)
cull = CullPattern(List=demesh_2.Faces, CullPattern=and)
conmesh_2 = ConstructMesh(Vertices=demesh_2.Vertices, Faces=cull)
facen_2 = FaceNormals(Mesh=del)  # -> Centers, Normals
equals = Equality(FirstNumber=incurve.Relationship, SecondNumber=2)  # -> Equality, Inequality
pt_5 = Point(division_2)
points = PointList(Points=facen_2.Centers)
cull_2 = CullPattern(List=equidistant_6, CullPattern=equals.Equality)
cullpt_3 = CullDuplicates(Points=cull_2, Tolerance=multiplication, CullMode=3)  # -> Points, Indices, Valence
merge_5 = Merge(Data1=pt, Data2=cullpt_3.Points)  # -> flatten(Result)
cullpt_4 = CullDuplicates(Points=merge_5, Tolerance=Slider(0.001, range=0..0.001), CullMode=3)  # -> Points, Indices, Valence
del_3 = DelaunayMesh(Points=cullpt_4.Points, Plane=PlaneXY(0, 0, 0))
facen_3 = FaceNormals(Mesh=del_3)  # -> Centers, Normals
incurve_2 = PointInCurve(Point=facen_3.Centers, Curve=pline_2)  # -> Relationship, Point
demesh_3 = DeconstructMesh(Mesh=del_3)  # -> Vertices, Faces, Colours, Normals
equals_2 = Equality(FirstNumber=incurve_2.Relationship, SecondNumber=2)  # -> Equality, Inequality
cull_3 = CullPattern(List=demesh_3.Faces, CullPattern=equals_2.Equality)
evalsrf_2 = EvaluateSurface(Surface=brep_4, Point=demesh_3.Vertices)  # -> Point, Normal, Frame
conmesh_3 = ConstructMesh(Vertices=evalsrf_2.Point, Faces=cull_3)
mesh_3 = Mesh(conmesh_3)
bake = BakeGeometry(Bake=Toggle(True), Geometry=mesh_3, DeleteOldBakes=False, PreserveTrees=False)
facen_4 = FaceNormals(Mesh=conmesh_3)  # -> Centers, Normals
del_4 = DelaunayMesh(Points=cullpt_4.Points, Plane=PlaneXY(0, 0, 0))
medges_3 = MeshEdges(Mesh=conmesh_3)  # -> NakedEdges, InteriorEdges, NonManifoldEdges
