# Grasshopper definition patchTest.gh (Grasshopper 0.9.76)

mesh = Mesh(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)
srf = Surface(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)
tri = Triangulate(Mesh=mesh)  # -> Mesh, Count
mesh_2 = Mesh(srf)
tri_2 = Triangulate(Mesh=mesh_2)  # -> Mesh, Count
medges = MeshEdges(Mesh=tri_2.Mesh)  # -> NakedEdges, InteriorEdges, NonManifoldEdges
demesh = DeconstructMesh(Mesh=tri_2.Mesh)  # -> Vertices, Faces, Colours, Normals
lng = ListLength(List=demesh.Faces)
deface = DeconstructFace(Face=demesh.Faces)  # -> CornerA, CornerB, CornerC, CornerD
item = ListItem(List=demesh.Vertices, Index=deface.CornerC, Wrap=True)  # -> graft(Item)
item_2 = ListItem(List=demesh.Vertices, Index=deface.CornerB, Wrap=True)  # -> graft(Item)
item_3 = ListItem(List=demesh.Vertices, Index=deface.CornerA, Wrap=True)  # -> graft(Item)
cluster = Cluster(P=item_3)
dup = DuplicateData(Number=lng, Order=True)  # -> graft(Data)
cluster_2 = Cluster(P=item)
cluster_3 = Cluster(P=item_2)
merge = Merge(Data1=simplify(cluster), Data2=simplify(cluster_3), Data3=simplify(cluster_2), Data4=simplify(dup))  # -> flatten(Result)
panel = Panel(merge)

# ==== cluster Cluster
P = ClusterInput()
pdecon = Deconstruct(Point=P)  # -> XComponent, YComponent, ZComponent
addition = Addition(A=pdecon.XComponent, B=pdecon.YComponent)
subtraction = Subtraction(A="1.928", B=addition)
division = Division(A=pdecon.ZComponent, B=10)
concat = Concatenate(
    FragmentA=pdecon.XComponent,
    FragmentB=" ",
    FragmentC=pdecon.YComponent,
    FragmentD=" ",
    FragmentE=subtraction,
    FragmentF=" ",
    FragmentG=division)
R = ClusterOutput(concat)
