# Grasshopper definition testSimple.gh (Grasshopper 0.9.76)
# plug-ins: MiStrAn

number_slider = Slider(2, range=0..10)
mplane = MeshPlane(
    Boundary={Plane=PlaneXY(0, 0, 0), Size=Domain2(u=-10..10, v=-10..10)},
    WidthCount=number_slider,
    HeightCount=number_slider)  # -> Mesh, Area
dom = ConstructDomain(DomainStart=Slider(2, range=0..10), DomainEnd=Slider(3, range=0..10))
dom_2 = ConstructDomain(DomainStart=Slider(4, range=0..10), DomainEnd=Slider(5, range=0..10))
mesh = Mesh(mplane.Mesh)
demesh = DeconstructMesh(Mesh=mesh)  # -> Vertices, Faces, Colours, Normals
subset = SubList(List=demesh.Vertices, Domain=dom, Wrap=True)  # -> List, Index
subset_2 = SubList(List=demesh.Vertices, Domain=dom_2, Wrap=True)  # -> List, Index
pt = Point(subset_2.List)
pt_2 = Point(subset.List)
mistran = MiStrAn(Mesh=mesh, BC=pt_2, Load=pt)
