# Grasshopper definition testSimple2.gh (Grasshopper 0.9.76)
# plug-ins: MiStrAn

number_slider = Slider(1, range=0..1)
dom = ConstructDomain(DomainStart=expr("-x/2", number_slider), DomainEnd=expr("x/2", number_slider))
number_slider_2 = Slider(6, range=0..10)
number_slider_3 = Slider(10, range=0..10)
number_slider_4 = Slider(10, range=0..100)
rectangle = Rectangle(Plane=PlaneXY(0, 0, 0), XSize=dom, YSize=dom, Radius=0)  # -> Rectangle, Length
mplane = MeshPlane(Boundary=rectangle.Rectangle, WidthCount=number_slider_4, HeightCount=number_slider_4)  # -> Mesh, Area
mesh = Mesh(mplane.Mesh)
demesh = DeconstructMesh(Mesh=mesh)  # -> Vertices, Faces, Colours, Normals
points = PointList(Points=demesh.Vertices, Size=Slider(0.1, range=0..1))
hull = ConvexHull(Points=demesh.Vertices, Plane=PlaneXY(0, 0, 0))  # -> Hull, HullZ, Indices
crv_cp = CurveClosestPoint(Point=demesh.Vertices, Curve=hull.Hull)  # -> Point, Parameter, Distance
smaller = SmallerThan(FirstNumber=crv_cp.Distance, SecondNumber=Slider(0.001, range=0..0.001))  # -> SmallerThan, OrEqualTo
cull = CullPattern(List=demesh.Vertices, CullPattern=smaller.SmallerThan)
cull_2 = CullPattern(List=demesh.Vertices, CullPattern=invert(smaller.SmallerThan))
mistran = MiStrAn(Run=Toggle(True), Mesh=mesh, BC=cull, Load=cull_2)  # -> Displacements, Reactions
